# Grasshopper definition Surface Winding 005 (Animations) [Jul-07 '19, 2022].gh (Grasshopper 1.0.7)
# plug-ins: Robots, treesloth01, Anemone, Human

base_sphere_radius = Slider(150, range=0.1..500)
base_sphere_height = Slider(250, range=0..1000)
minimal_radius = Slider(40, range=0.1..500)
section_radius = Slider(150, range=0.1..500)
number = Number(base_sphere_radius)
division = Division(A="455", B=2)
number_2 = Number(base_sphere_height)
number_3 = Number(section_radius)
number_4 = Number(minimal_radius)
cdomain = ConstructDomain(DomainStart=number_4, DomainEnd=number_3)
range = Range(Domain=cdomain, Steps="8")
panel = Panel("""0
-1""")
cull_index = CullIndex(List=range, Indices=panel, Wrap=True)
circle = Circle(Plane=PlaneXY(0, 0, 0), Radius=range)
subtraction = Subtraction(A="8", B=2)
number_5 = Number(number_3)
circle_2 = Circle(Plane=PlaneXY(0, 0, 0), Radius=number_5)
number_6 = Number(cull_index)

# ---- group: Loop
loop_start = LoopStart(Repeat=subtraction, Trigger=Button(), curr_value=number_3, curr_circle=circle_2, list_of_values=number_6)  # -> port, Counter, Data, Data_2, Data_3, Data_4, Data_5
curve = Curve(reparameterize(loop_start.Data_2))
number_7 = Number(loop_start.Data_5)
curve_2 = Curve(loop_start.Data_3)
point = Point(loop_start.Data_4)
number_8 = Number(loop_start.Data)
integer = Integer(loop_start.Counter)

# ---- group: Loop / Seed modification
integer_2 = Integer(integer)
multiplication = Multiplication(A=integer_2, B=Slider(343, range=0..1000))
integer_3 = Integer(multiplication)

# ---- group: Loop
boundary_surfaces = BoundarySurfaces(Edges=circle_2)  # disabled
panel_2 = Panel("1")  # disabled
populate_geometry = PopulateGeometry(Geometry=boundary_surfaces, Count=panel_2, Seed=1, Points=point)  # disabled
curve_closest_point = CurveClosestPoint(Point=populate_geometry, Curve=curve)  # -> Point, Parameter, Distance; disabled
panel_3 = Panel("0.1")  # disabled
list_length = ListLength(List=curve_closest_point.Parameter)  # disabled
smaller_than = SmallerThan(FirstNumber=curve_closest_point.Parameter, SecondNumber=panel_3)  # -> SmallerThan, OrEqualTo; disabled
boolean = Boolean(invert(list_length))  # disabled
gate_or = GateOr(A=boolean, B=smaller_than.SmallerThan)  # disabled

# ---- group: Loop / Circle section domain
integer_4 = Integer(integer_3)
cdomain_2 = ConstructDomain(DomainStart=Slider(0.5, range=0..1), DomainEnd=Slider(0.8, range=0..1))
multiplication_2 = Multiplication(A=integer_4, B=Slider(806, range=0..1000))
random = Random(Range=cdomain_2, Number=1, Seed=multiplication_2)

# ----
construct_point = ConstructPoint(XCoordinate=0, YCoordinate=0, ZCoordinate="5")
construct_point_2 = ConstructPoint(XCoordinate=0, YCoordinate=0, ZCoordinate="190")
cylinder = Cylinder(Base=construct_point, Radius=Slider(4, range=0..1000), Length=Slider(370, range=0..1000))
cylinder_2 = Cylinder(Base=construct_point, Radius=Slider(35, range=0..1000), Length=Slider(207, range=0..1000))
cap_holes = CapHoles(Brep=cylinder_2)
weight_in_kg = Panel("2")
number_slider = Slider(64, range=0..100)
surface_closest_point = SurfaceClosestPoint()  # -> Point, UVPoint, Distance
evaluate_surface = EvaluateSurface()  # -> Point, Normal, UDirection, VDirection, Frame
xy_plane = XYPlane(Origin=Point(0, 0, 0))
curve_3 = Curve([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])
panel_4 = Panel("-15")
construct_point_3 = ConstructPoint(XCoordinate=0, YCoordinate=0, ZCoordinate=Slider(-15.2, range=-1000..1000))
xy_plane_2 = XYPlane(Origin=construct_point_3)
unit_x = UnitX(Factor=1)
swap_axes = BooleanToggle(True)
reverse_y = BooleanToggle(False)
reverse_x = BooleanToggle(True)
swap_axes_2 = BooleanToggle(False)
reverse_y_2 = BooleanToggle(True)
reverse_x_2 = BooleanToggle(True)

speed = Slider(34, range=0..100)
list = FlagFields({"Shoulder": 1, "Elbow": 2, "Wrist": 4}, selected="Shoulder")
list_2 = ValueList({"Joint", "Linear"}, selected="Linear")
speed_parameter = SpeedParameter(speed)
zone_parameter = ZoneParameter("2")
configuration = Integer(list)
motion_type = Text(list_2)

speed_2 = Slider(23, range=0..100)
list_3 = FlagFields({"Shoulder": 1, "Elbow": 2, "Wrist": 4}, selected=["Shoulder", "Wrist"])
list_4 = ValueList({"Joint", "Linear"}, selected="Linear")
speed_parameter_2 = SpeedParameter(speed_2)
zone_parameter_2 = ZoneParameter("5")
configuration_2 = Integer(list_3)
motion_type_2 = Text(list_4)

program_step_size = Slider(0.64, range=0..1)  # disabled

number_slider_2 = Slider(0, range=0..1000)  # disabled
number_slider_3 = Slider(0.015, range=0..0.1)  # disabled
panel_5 = Panel("1000")  # disabled
panel_6 = Panel("0")  # disabled
button = Button()  # disabled
loop_start_2 = LoopStart(Repeat=panel_5, Trigger=button, Data=panel_6, D1=number_slider_3, D2=number_slider_2)  # -> port, Counter, Data, Data_2, Data_3; disabled
addition = Addition(A=loop_start_2.Data, B=loop_start_2.Data_2)  # disabled
panel_7 = Panel("1")  # disabled
larger_than = LargerThan(FirstNumber=addition, SecondNumber=panel_7)  # -> LargerThan, OrEqualTo; disabled
time_buffer = TimeBuffer(Data=addition, Ms=loop_start_2.Data_3, UseThread=False)  # disabled
boolean_toggle = BooleanToggle(True)  # disabled
gate_or_2 = GateOr(A=boolean_toggle, B=larger_than.OrEqualTo)  # disabled
loop_end = LoopEnd(
    port=loop_start_2.port,
    Exit=gate_or_2,
    Data=time_buffer,
    Data_2=loop_start_2.Data_2,
    Data_3=loop_start_2.Data_3,
    TimeOutVal=0,
    pausedState=False,
    state="Constant output")  # -> Data, D1, D2; disabled
panel_8 = Panel(loop_end.Data)  # disabled

panel_9 = Panel("""0
1
2
3
4
5
6""")  # disabled
panel_10 = Panel("3")  # disabled
panel_11 = Panel("5")  # disabled
panel_12 = Panel("7")  # disabled
number_slider_4 = Slider(4, range=0..10)  # disabled
colour_swatch = ColourSwatch(SwatchColor=RGB(255, 0, 0))  # disabled
boolean_toggle_2 = BooleanToggle(True)  # disabled
number_slider_5 = Slider(1, range=0..1)  # disabled
number_9 = Number(loop_end.Data)  # disabled
number_slider_6 = Slider(10.104, range=0..20)  # disabled
colour_picker = ColourPicker(PickedColour=RGB(0, 0, 0))  # disabled

speed_3 = Slider(34, range=0..100)  # disabled
list_5 = FlagFields({"Shoulder": 1, "Elbow": 2, "Wrist": 4}, selected=["Shoulder", "Wrist"])  # disabled
list_6 = ValueList({"Joint", "Linear"}, selected="Joint")  # disabled
panel_13 = Panel("2")  # disabled
speed_parameter_3 = SpeedParameter(speed_3)  # disabled
zone_parameter_3 = ZoneParameter(panel_13)  # disabled
configuration_3 = Integer(list_5)  # disabled
motion_type_3 = Text(list_6)  # disabled

speed_4 = Slider(23, range=0..100)  # disabled
list_7 = FlagFields({"Shoulder": 1, "Elbow": 2, "Wrist": 4}, selected=["Shoulder", "Wrist"])  # disabled
list_8 = ValueList({"Joint", "Linear"}, selected="Linear")  # disabled
panel_14 = Panel("5")  # disabled
speed_parameter_4 = SpeedParameter(speed_4)  # disabled
zone_parameter_4 = ZoneParameter(panel_14)  # disabled
configuration_4 = Integer(list_7)  # disabled
motion_type_4 = Text(list_8)  # disabled

# ---- group: Create sphere and Helper geometry
# Comment: Creates Sphere according to Z offset and radius. also creates a point and a value of the increased radius (important for boolean operations)
A = Data(number_2)
A_2 = Data(number)

subtraction_2 = Subtraction(A=A, B=A_2)
construct_point_4 = ConstructPoint(XCoordinate=0, YCoordinate=0, ZCoordinate=subtraction_2)
multiplication_3 = Multiplication(A=A_2, B=1.1)
circle_3 = Circle(Plane=construct_point_4, Radius=multiplication_3)
sphere = Sphere(Base=construct_point_4, Radius=A_2)
boundary_surfaces_2 = BoundarySurfaces(Edges=circle_3)
split_brep = SplitBrep(Brep=sphere, Cutter=boundary_surfaces_2)  # -> graft(Result)

point_2 = Data(construct_point_4)
result = Data(split_brep)
result_2 = Data(multiplication_3)

# ---- group: Find upper half
# Comment: Over-complicated method of finding the upper half of the sphere if the Brep split rverses the order for any reason
radius_number = Number(result_2)
brep = Brep(result)
point_3 = Point(point_2)

unit_z = UnitZ(Factor=1)
line_sdl = LineSDL(Start=point_3, Direction=unit_z, Length=radius_number)
brep_curve = BrepCurve(Brep=brep, Curve=line_sdl)  # -> Curves, Points
trim_tree = TrimTree(Tree=brep_curve.Points, Depth=1)
clean_tree = CleanTree(RemoveNulls=True, RemoveInvalid=True, RemoveEmpty=True, Tree=trim_tree)
tree_statistics = TreeStatistics(Tree=clean_tree)  # -> Paths, Length, Count
tree_branch = TreeBranch(Tree=brep, Path=tree_statistics.Paths, MaintainPaths=True)

brep_2 = Brep(tree_branch)

# ---- group: Create Section Cutter
section_radius_2 = Number(number_3)
point_4 = Point(point_2)
number_10 = Number(number)

multiplication_4 = Multiplication(A=number_10, B=1.1)
negative = Negative(Value=multiplication_4)
merge = Merge(Data1=multiplication_4, Data2=negative)
cylinder_3 = Cylinder(Base=point_4, Radius=section_radius_2, Length=merge)
brep_join = BrepJoin(Breps=cylinder_3)  # -> Breps, Closed
cap_holes_2 = CapHoles(Brep=brep_join.Breps)

brep_3 = Brep(cap_holes_2)

# ---- group: Cut Section
# Comment: Cuts the section from the base sphere and chooses only the section not the outer part of the base sphere
brep_4 = Brep(brep_3)
brep_5 = Brep(brep_2)

split_brep_2 = SplitBrep(Brep=brep_5, Cutter=brep_4)
area = Area(Geometry=split_brep_2)  # -> Area, Centroid
deconstruct = Deconstruct(Point=area.Centroid)  # -> XComponent, YComponent, ZComponent
sort_list = SortList(Keys=deconstruct.ZComponent, ValuesValuesA=split_brep_2)  # -> Keys, ValuesValuesA
panel_15 = Panel("-1")
first_last = FirstLast(List=sort_list.ValuesValuesA)  # -> FirstValue, LastValue

brep_6 = Brep(first_last.LastValue)

# ----
cap_holes_3 = CapHoles(Brep=brep_6)
solid_union = SolidUnion(Breps=flatten([cap_holes, cap_holes_3, cylinder]))
brep_7 = Brep(brep_6)

# ---- group: Loop / Create circle section
panel_16 = Panel("0")
number_11 = Number(random)
curve_4 = Curve(curve)

cdomain_3 = ConstructDomain(DomainStart=panel_16, DomainEnd=number_11)
sub_curve = SubCurve(BaseCurve=curve_4, Domain=cdomain_3)
end_points = EndPoints(Curve=sub_curve)  # -> Start, End

point_5 = Point(end_points.End)
point_6 = Point(end_points.Start)

# ---- group: Loop
point_7 = Point(loop_start.Data_4)
point_8 = Point(point_5)
merge_2 = Merge(Data1=flatten(point_7), Data2=flatten(point_8))

# ---- group: Loop / List management of circle radii
number_slider_7 = Slider(433, range=0..1000)
integer_5 = Integer(integer_3)
number_12 = Number(number_7)

multiplication_5 = Multiplication(A=integer_5, B=number_slider_7)
jitter = Jitter(List=number_12, Jitter=1, Seed=multiplication_5)  # -> Values, Indices
first_last_2 = FirstLast(List=jitter.Values)  # -> FirstValue, LastValue
cull_index_2 = CullIndex(List=jitter.Values, Indices="0", Wrap=True)

list_without_current_circle = Number(cull_index_2)
next_circle_radius = Number(first_last_2.FirstValue)

# ---- group: Create Form TCP and Mesh
height_num = Number(number_2)
mold_form_brep = Brep(solid_union)
point_9 = Point(construct_point_2)

cap_holes_4 = CapHoles(Brep=mold_form_brep)
point_10 = ConstructPoint(XCoordinate=0, YCoordinate=0, ZCoordinate=height_num)
xy_plane_3 = XYPlane(Origin=point_10)
plane = Plane(xy_plane_3)
mesh = Mesh(cap_holes_4)
create_tool = CreateTool(Name="DefaultGHTool", TCP=plane, Weight=weight_in_kg, Centroid=point_9, Mesh=mesh)  # -> Tool, TCP

tool_parameter = ToolParameter(create_tool.Tool)
tcp_plane = Plane(plane)

# ---- group: Loop / Create radial line
number_13 = Number(number_8)
number_14 = Number(next_circle_radius)
point_11 = Point(point_5)

xy_plane_4 = XYPlane(Origin=Point(0, 0, 0))
subtraction_3 = Subtraction(A=number_13, B=number_14)
vector_2pt = Vector2Pt(PointA=point_11, PointB=xy_plane_4, Unitize=False)  # -> Vector, Length
line_sdl_2 = LineSDL(Start=point_11, Direction=vector_2pt.Vector, Length=subtraction_3)

line = Line(line_sdl_2)

# ---- group: Loop
curve_5 = Curve(line)
number_15 = Number(next_circle_radius)

circle_4 = Circle(Plane=PlaneXY(0, 0, 0), Radius=number_15)
curve_curve = CurveCurve(CurveA=circle_4, CurveB=curve_5)  # -> Points, ParamsA, ParamsB
seam = Seam(Curve=circle_4, Seam=curve_curve.ParamsA)

circle_5 = Circle(seam)

# ---- group: Loop / Join all previos curves
curve_6 = Curve(curve_2)
curve_7 = Curve(sub_curve)
line_2 = Line(line)

merge_3 = Merge(Data1=curve_7, Data2=line_2)  # -> flatten(Result)
join_curves = JoinCurves(Curves=merge_3, Preserve=False)
merge_4 = Merge(Data1=curve_6, Data2=join_curves)  # -> flatten(Result)
join_curves_2 = JoinCurves(Curves=merge_4, Preserve=False)

curve_8 = Curve(join_curves_2)

# ---- group: Loop
loop_end_2 = LoopEnd(
    port=loop_start.port,
    Exit=False,
    Data=next_circle_radius,
    Data_2=circle_5,
    Data_3=curve_8,
    Data_4=merge_2,
    Data_5=list_without_current_circle,
    TimeOutVal=0,
    pausedState=False,
    state="Output last")  # -> D0, Data, D2, D3, D4

# ----
data_recorder = DataRecorder(loop_end_2.D2, DataLimit=-10, RecordData=True)
browse_history = BrowseHistory(
    Iteration=number_slider,
    Data_0=loop_end_2.D0,
    Data_1=loop_end_2.Data,
    Data_2=loop_end_2.D2,
    Data_3=loop_end_2.D3,
    Data_4=loop_end_2.D4)  # -> Data_0, Data_1, Data_2, Data_3, Data_4
browse_history_2 = BrowseHistory(Iteration=number_slider, Data_0=data_recorder)

# ---- group: Add last circle fully
panel_17 = Panel("0 to 0.999")
curve_9 = Curve(reparameterize(loop_end_2.Data))
curve_10 = Curve(loop_end_2.D2)

sub_curve_2 = SubCurve(BaseCurve=reparameterize(curve_9), Domain=panel_17)
merge_5 = Merge(Data1=flatten(curve_10), Data2=flatten(sub_curve_2))
join_curves_3 = JoinCurves(Curves=merge_5, Preserve=False)

curve_11 = Curve(join_curves_3)

# ----
end_points_2 = EndPoints(Curve=curve_11)  # -> Start, End
point_12 = Point(end_points_2.Start)
vector_2pt_2 = Vector2Pt(PointA=point_12, PointB=xy_plane, Unitize=False)  # -> Vector, Length
line_sdl_3 = LineSDL(Start=point_12, Direction=vector_2pt_2.Vector, Length=vector_2pt_2.Length)
curve_curve_2 = CurveCurve(CurveA=curve_11, CurveB=line_sdl_3)  # -> Points, ParamsA, ParamsB
cull_index_3 = CullIndex(List=curve_curve_2.ParamsB, Indices="0", Wrap=True)
jitter_2 = Jitter(List=cull_index_3, Jitter=1, Seed=Slider(200, range=0..1000))  # -> Values, Indices
first_last_3 = FirstLast(List=jitter_2.Values)  # -> FirstValue, LastValue
cdomain_4 = ConstructDomain(DomainStart="0", DomainEnd=first_last_3.FirstValue)
sub_curve_3 = SubCurve(BaseCurve=line_sdl_3, Domain=cdomain_4)
merge_6 = Merge(Data1=flatten(curve_11), Data2=flatten(sub_curve_3))
join_curves_4 = JoinCurves(Curves=merge_6, Preserve=False)
data_dam = DataDam(DataA=curve_11, BufferDelay=10000000, BufferMode=0)
end_points_3 = EndPoints(Curve=join_curves_4)  # -> Start, End
point_13 = Point(end_points_3.End)
point_14 = Point(end_points_3.Start)
data_recorder_2 = DataRecorder(data_dam, DataLimit=-10, RecordData=True)
curve_12 = Curve(data_recorder_2)

# ---- group: Iterative shape generation
list_9 = Data(curve_12)
animation_controller = Slider(0.969, range=0..1)
list_length_2 = ListLength(List=list_9)
multiplication_6 = Multiplication(A=animation_controller, B=list_length_2)
round = Round(Number=multiplication_6)  # -> Nearest, Floor, Ceiling
panel_18 = Panel(round.Floor)
list_item = ListItem(List=list_9, Index=round.Floor, Wrap=True)
modulus = Modulus(A=multiplication_6, B="1")
construct_domain = ConstructDomain(DomainStart="0", DomainEnd=modulus)
panel_19 = Panel(modulus)
sub_curve_4 = SubCurve(BaseCurve=reparameterize(list_item), Domain=construct_domain)

# ---- group: Iterative shape generation+ grid
list_10 = Data(curve_12)
animation_controller_2 = Slider(1, range=0..1)
list_length_3 = ListLength(List=list_10)
multiplication_7 = Multiplication(A=animation_controller_2, B=list_length_3)
round_2 = Round(Number=multiplication_7)  # -> Nearest, Floor, Ceiling
number_slider_8 = Slider(1.5, range=-1000..1000)
panel_20 = Panel(round_2.Floor)
list_item_2 = ListItem(List=list_10, Index=round_2.Floor, Wrap=True)
modulus_2 = Modulus(A=multiplication_7, B="1")
construct_point_5 = ConstructPoint(XCoordinate=Slider(-638.5, range=-1000..1000), YCoordinate=Slider(188.2, range=-1000..1000), ZCoordinate=0)
construct_domain_2 = ConstructDomain(DomainStart="0", DomainEnd=modulus_2)
number_slider_9 = Slider(4, range=0..10)
panel_21 = Panel(modulus_2)
plane_2 = Plane(construct_point_5)
flip_plane = FlipPlane(Plane=plane_2, ReverseX=Toggle(False), ReverseY=Toggle(True), SwapAxes=Toggle(True))
sub_curve_5 = SubCurve(BaseCurve=reparameterize(list_item_2), Domain=construct_domain_2)
number_16 = Number(number_3)
division_2 = Division(A=list_length_3, B=number_slider_9)
series = Series(Start=0, Step=1, Count=list_length_3)
addition_2 = Addition(A=number_16, B=Slider(-61.8, range=-1000..1000))
square = Square(Plane=flip_plane, Size=addition_2, ExtentX=division_2, ExtentY=number_slider_9)  # -> Cells, Points
split_list = SplitList(List=series, Index=round_2.Floor)  # -> ListA, ListB
split_list_2 = SplitList(List=list_10, Index=round_2.Floor)  # -> ListA, ListB
flip_matrix = FlipMatrix(Data=square.Points)
point_15 = Point(flatten(square.Points))
list_item_3 = ListItem(List=point_15, Index=split_list.ListA, Wrap=True)
reverse_list = ReverseList(List=point_15)
xy_plane_5 = XYPlane(Origin=Point(0, 0, 0))
vector_2pt_3 = Vector2Pt(PointA=xy_plane_5, PointB=list_item_3, Unitize=False)  # -> Vector, Length
move = Move(Geometry=split_list_2.ListA, Motion=vector_2pt_3.Vector)  # -> Geometry, Transform
scale = Scale(Geometry=move.Geometry, Center=list_item_3, Factor=Slider(0.2, range=0..1))  # -> Geometry, Transform
colour_swatch_2 = ColourSwatch(SwatchColor=RGB(0, 0, 0))
custom_preview_lineweights = CustomPreviewLineweights(Geometry=sub_curve_5, Shader=colour_swatch_2, Thickness=Slider(8.2, range=0..10), Absolute=False)
custom_preview_lineweights_2 = CustomPreviewLineweights(Geometry=scale.Geometry, Shader=colour_swatch_2, Thickness=Slider(1.6, range=0..3), Absolute=False)

# ----
curve_13 = Curve(curve_12)
list_length_4 = ListLength(List=curve_13)
multiplication_8 = Multiplication(A=list_length_4, B=Slider(0.2138, range=0..1))
list_item_4 = ListItem(List=curve_13, Index=multiplication_8, Wrap=True)
curve_14 = Curve(list_item_4)

# ---- group: Scale and Rotate shape
rotate_frame_shape = Slider(358.7, range=0..360)
number_slider_10 = Slider(0.98, range=0..1)
curve_15 = Curve(join_curves_4)

scale_2 = Scale(Geometry=curve_15, Center=Point(0, 0, 0), Factor=number_slider_10)  # -> Geometry, Transform
radians = Radians(Degrees=rotate_frame_shape)
rotate = Rotate(Geometry=scale_2.Geometry, Angle=radians, Plane=PlaneXY(0, 0, 0))  # -> Geometry, Transform

curve_16 = Curve(rotate.Geometry)

# ----
curve_17 = Curve(curve_16)
project = Project(Curve=curve_17, Brep=brep_7, Direction=Vector(0, 0, 1))  # -> reparameterize(Curve)
divide_distance = DivideDistance(Curve=project, Distance=Slider(7.6, range=0..100))  # -> Points, Tangents, Parameters; disabled
brep_closest_point = BrepClosestPoint(Point=divide_distance.Points, Brep=brep_7)  # -> Point, Normal, Distance
plane_normal = PlaneNormal(Origin=brep_closest_point.Point, ZAxis=brep_closest_point.Normal)
align_plane = AlignPlane(Plane=plane_normal, Direction=unit_x)  # -> Plane, Angle
vector_2pt_4 = Vector2Pt(PointA=construct_point_3, PointB=align_plane.Plane, Unitize=False)  # -> Vector, Length
xy_plane_6 = XYPlane(Origin=align_plane.Plane)
plane_normal_2 = PlaneNormal(Origin=align_plane.Plane, ZAxis=vector_2pt_4.Vector)
align_plane_2 = AlignPlane(Plane=plane_normal_2, Direction=unit_x)  # -> Plane, Angle

# ---- group: Show plane axi
plane_3 = Plane(align_plane_2.Plane)
plane_axis_viewer = PlaneAxisViewer(plane=plane_3, length=Slider(30, range=0..30))

# ----
adjust_plane = AdjustPlane(Plane=align_plane.Plane, Normal=Vector(0, 0, 1))
flip_plane_2 = FlipPlane(Plane=adjust_plane, ReverseX=reverse_x, ReverseY=reverse_y, SwapAxes=swap_axes)
angle = Angle(Plane=plane_normal_2)  # -> Angle, Reflex
flip_plane_3 = FlipPlane(Plane=align_plane_2.Plane, ReverseX=reverse_x_2, ReverseY=reverse_y_2, SwapAxes=swap_axes_2)
plane_4 = Plane(flip_plane_2)
multiplication_9 = Multiplication(A=angle.Angle, B=Slider(0, range=0..1))
plane_5 = Plane(flip_plane_3)
rotate_plane = RotatePlane(Plane=plane_4, Angle=multiplication_9)

# ---- group: Extruder nozzle position
number_slider_11 = Slider(-150, range=-1000..1000)
number_slider_12 = Slider(-730, range=-1000..1000)
number_slider_13 = Slider(564, range=-1000..1000)

construct_point_6 = ConstructPoint(XCoordinate=number_slider_11, YCoordinate=number_slider_12, ZCoordinate=number_slider_13)
xy_plane_7 = XYPlane(Origin=construct_point_6)

# ----
yz_plane = YZPlane(Origin=construct_point_6)
yz_plane_2 = YZPlane(Origin=construct_point_6)
xz_plane = XZPlane(Origin=construct_point_6)
flip_plane_4 = FlipPlane(Plane=yz_plane_2, ReverseX=False, ReverseY=False, SwapAxes=True)

# ---- group: Extruder nozzle position (continued)
plane_6 = Plane(xz_plane)

# ---- group: Convert planes to TCP position
plane_7 = Plane(tcp_plane)
plane_8 = Plane(plane_5)
plane_9 = Plane(plane_6)
orient = Orient(Geometry=plane_7, Source=plane_8, Target=plane_9)  # -> Geometry, Transform
transform = Transform(orient.Transform)
plane_10 = Plane(orient.Geometry)

# ----
number_slider_14 = Slider(-45.708, range=-100..0)
plane_11 = Plane(plane_10)
unit_z_2 = UnitZ(Factor=number_slider_14)
unit_y = UnitY(Factor=expr("x*-1", number_slider_14))
list_item_5 = ListItem(List=plane_11, Index=0, Wrap=True)
move_2 = Move(Geometry=list_item_5, Motion=unit_y)  # -> Geometry, Transform

speed_parameter_5 = SpeedParameter(speed_parameter)
zone_parameter_5 = ZoneParameter(zone_parameter)
tool_parameter_2 = ToolParameter(tool_parameter)
configuration_5 = Integer(configuration)
motion_type_5 = Text(motion_type)
plane_12 = Plane(move_2.Geometry)
create_target = CreateTarget(
    Plane=flatten(plane_12),
    RobConf=configuration_5,
    Motion=motion_type_5,
    Tool=tool_parameter_2,
    Speed=speed_parameter_5,
    Zone=zone_parameter_5,
    IsCartesian=True)
target_parameter = TargetParameter(create_target)

speed_parameter_6 = SpeedParameter(speed_parameter_2)
zone_parameter_6 = ZoneParameter(zone_parameter_2)
tool_parameter_3 = ToolParameter(tool_parameter)
configuration_6 = Integer(configuration_2)
motion_type_6 = Text(motion_type_2)
plane_13 = Plane(plane_10)
create_target_2 = CreateTarget(
    Plane=flatten(plane_13),
    RobConf=configuration_6,
    Motion=motion_type_6,
    Tool=tool_parameter_3,
    Speed=speed_parameter_6,
    Zone=zone_parameter_6,
    IsCartesian=True)
target_parameter_2 = TargetParameter(flatten(create_target_2))

target_parameter_3 = TargetParameter(target_parameter_2)  # disabled
target_parameter_4 = TargetParameter(target_parameter)  # disabled

# ---- group: Extruder position visualisation
number_slider_15 = Slider(69.678, range=0..100)
unit_z_3 = UnitZ(Factor=number_slider_15)

# ----
unit_y_2 = UnitY(Factor=expr("x*-1", number_slider_15))
unit_x_2 = UnitX(Factor=number_slider_15)

# ---- group: Extruder position visualisation (continued)
move_3 = Move(Geometry=plane_6, Motion=unit_y_2)  # -> Geometry, Transform
cone = Cone(Base=move_3.Geometry, Radius=Slider(25.219, range=0..100), Length=expr("-x", number_slider_15))  # -> Cone, Tip
brep_8 = Brep(cone.Cone)

# ---- group: Start angle configuration
_1 = Slider(0, range=-1..1)
_3 = Slider(0, range=-1..1)
_4 = Slider(0, range=-1..1)
_5 = Slider(0, range=-1..1)
_0 = Slider(0, range=-1..1)
_2 = Slider(0, range=-1..1)
boolean_toggle_3 = BooleanToggle(True)

merge_7 = Merge(Data1=_0, Data2=_1, Data3=_2, Data4=_3, Data5=_4, Data6=_5)
multiplication_10 = Multiplication(A="360", B=merge_7)

# ----
number_slider_16 = Slider(3, range=0..100)  # disabled
panel_22 = Panel("6")  # disabled
zone_soft_radius = Number(panel_22)  # disabled
tool_parameter_4 = ToolParameter(tool_parameter)  # disabled
speed_5 = Number(number_slider_16)  # disabled

# ---- group: Create Robot Program
list_11 = ValueList({"Bartlett-IRB120", "Bartlett-IRB1600", "Bartlett-KR6", "Bartlett-KR60", "Bartlett-UR10", "BURG Halle-UR5", "BURG Halle-UR5 on table", "KULeuven-IRB120", "KULeuven-UR5", "KULeuven-UR10"}, selected="BURG Halle-UR5")  # disabled

load_robot_system = LoadRobotSystem(Name=list_11, Base=PlaneXY(0, 0, 0))  # disabled

# ---- group: Start angle configuration (continued)
kinematics = Kinematics(RobotSystem=load_robot_system, Target=target_parameter, DisplayGeometry=boolean_toggle_3)  # -> Meshes, Joints, Planes, Errors
text_split = TextSplit(Text=kinematics.Joints, Separators=",")
degrees = Degrees(Radians=text_split)
subtraction_4 = Subtraction(A=degrees, B=multiplication_10)
number_17 = Number(subtraction_4)
radians_2 = Radians(Degrees=number_17)
text_join = TextJoin(Text=radians_2, Join=",")

# ----
start_angles_before_optimisation = Panel(degrees)
start_angles_after_optimisation = Panel(number_17)

list_length_5 = ListLength(List=kinematics.Meshes)
multiplication_11 = Multiplication(A=Slider(0.9, range=0..1), B=list_length_5)
list_item_6 = ListItem(List=kinematics.Meshes, Index=Slider(5, range=0..10), Wrap=True)
list_item_7 = ListItem(List=kinematics.Meshes, Index=multiplication_11, Wrap=True)

# ---- group: Start angle configuration (continued)
joint_angles = Text(text_join)

# ----
joint_angles_2 = Text(joint_angles)  # disabled
create_target_3 = CreateTarget(Joints=joint_angles_2, Tool=tool_parameter_4, Speed=speed_5, Zone=zone_soft_radius, IsCartesian=False)  # disabled
target_parameter_5 = TargetParameter(create_target_3)  # disabled

target_parameter_6 = TargetParameter(target_parameter_5)  # disabled

# ---- group: Create Robot Program (continued)
merge_8 = Merge(Data1=flatten(target_parameter_6), Data2=flatten(target_parameter_3))  # disabled

create_program = CreateProgram(Name="DefaultProgram", RobotSystem=load_robot_system, Targets1=merge_8, StepSize=program_step_size)  # -> Program, Code, Duration, Warnings, Errors; disabled

program_parameter = ProgramParameter(create_program.Program)  # disabled
number_18 = Number(create_program.Duration)  # disabled
text = Text(create_program.Warnings)  # disabled
text_2 = Text(create_program.Code)  # disabled
text_3 = Text(create_program.Errors)  # disabled

# ---- group: Program Code and Errors
program_code = Panel(text_2)
warnings = Panel(text)
errors = Panel(text_3)
program = Panel(program_parameter)

# ----
warnings_2 = Panel(text)  # disabled

# ---- group: Length of the program
list_length_6 = ListLength(List=text_2)  # disabled
commands = Panel(list_length_6)  # disabled

# ---- group: Upload to Robot
robot_ip_adress = Panel("192.168.178.22")  # disabled
upload = Button()  # disabled
pause = Button()  # disabled
play = Button()  # disabled
boolean_2 = Boolean(play)  # disabled
boolean_3 = Boolean(pause)  # disabled
boolean_4 = Boolean(upload)  # disabled

# ----
ip_adress = Text(robot_ip_adress)  # disabled
boolean_5 = Boolean(boolean_4)  # disabled
boolean_6 = Boolean(boolean_2)  # disabled
boolean_7 = Boolean(boolean_3)  # disabled
remote_connection = RemoteConnection(Program=program_parameter, IP=ip_adress, Upload=boolean_5, Play=boolean_6, Pause=boolean_7)  # disabled
text_4 = Text(remote_connection)  # disabled
data_recorder_3 = DataRecorder(text_4, DataLimit=-10, RecordData=True)  # disabled

# ---- group: Robot Simulation
extruder_tip = Brep(brep_8)  # disabled
simulation_control = ControlKnob(Decimals=6, Limit=False, Maximum=1, Minimum=0, Range=0.1, Value=3.982766)  # disabled
trail_length = Slider(6847, range=0..10000)  # disabled
panel_23 = Panel("1")  # disabled
modulus_3 = Modulus(A=simulation_control, B=panel_23)  # disabled
number_19 = Number(number_slider_5)  # disabled

number_20 = Number(trail_length)  # disabled
number_21 = Number(number_19)  # disabled

program_simulation = ProgramSimulation(Program=program_parameter, Time=number_21, Normalized=True)  # -> SystemMeshes, JointRotations, Plane, Index, Time, Program, Errors; disabled
check_collisions = CheckCollisions(
    Program=program_simulation.Program,
    FirstSet=panel_12,
    SecondSet=panel_10,
    EnvironmentPlane=-1,
    LinearStepSize=number_slider_4,
    AngularStepSize=0.7853981634)  # -> CollisionFound, TargetIndex, CollidedMeshes; disabled
simple_trail = SimpleTrail(Program=program_simulation.Program, Length=number_20, MechanicalGroup=0)  # disabled
split_list_3 = SplitList(List=program_simulation.SystemMeshes, Index=7)  # -> ListA, ListB; disabled

colliding_meshes_mesh = Mesh(check_collisions.CollidedMeshes)  # disabled
collisions = Panel(check_collisions.CollisionFound)  # disabled
number_22 = Number(program_simulation.JointRotations)  # disabled
plane_14 = Plane(program_simulation.Plane)  # disabled
integer_6 = Integer(program_simulation.Index)  # disabled
curve_18 = Curve(simple_trail)  # disabled
robot_mesh = Mesh(split_list_3.ListA)  # disabled
tool_mesh = Mesh(split_list_3.ListB)  # disabled

# ----
integer_7 = Integer(check_collisions.TargetIndex)  # disabled
panel_24 = Panel(integer_7)  # disabled
custom_preview = CustomPreview(Geometry=colliding_meshes_mesh, Material=colour_swatch)  # disabled
degrees_2 = Degrees(Radians=number_22)  # disabled
panel_25 = Panel(integer_6)  # disabled
panel_26 = Panel(degrees_2)  # disabled

# ---- group: Robot Simulation (continued)
tool_mesh_2 = Mesh(tool_mesh)  # disabled
simulation_robot_trail = Curve(curve_18)  # disabled
simulatied_robot_mesh = Mesh(robot_mesh)  # disabled

# ----
plane_15 = Plane(plane_14)  # disabled
plane_16 = Plane(tcp_plane)  # disabled

list_item_8 = ListItem(List=plane_15, Index=-1, Wrap=True)  # disabled
orient_2 = Orient(Source=plane_16, Target=list_item_8)  # -> Geometry, Transform; disabled

transform_2 = Transform(orient_2.Transform)  # disabled

swatch = ColourSwatch(SwatchColor=RGB(158, 158, 158))  # disabled
swatch_2 = ColourSwatch(SwatchColor=RGB(255, 31, 31))  # disabled
swatch_3 = ColourSwatch(SwatchColor=RGBA(0, 136, 255, 143))  # disabled
swatch_4 = ColourSwatch(SwatchColor=RGB(224, 196, 38))  # disabled
preview = CustomPreview(Geometry=simulatied_robot_mesh, Shader=swatch)  # disabled
preview_2 = CustomPreview(Geometry=tool_mesh_2, Shader=swatch_4)  # disabled

# ---- group: Create extrusion simulation
simulation_index = Integer(integer_6)  # disabled
point_16 = Point(flatten(plane_5))  # disabled
transform_3 = Transform(transform_2)  # disabled

split_list_4 = SplitList(List=point_16, Index=simulation_index)  # -> ListA, ListB; disabled
number_slider_17 = Slider(5.268, range=0..10)  # disabled
number_slider_18 = Slider(2.73, range=0..10)  # disabled
point_17 = Point(split_list_4.ListA)  # disabled
cull_duplicates = CullDuplicates(Points=point_17, Tolerance=number_slider_17, CullMode=3)  # -> Points, Indices, Valence; disabled
interpolate = Interpolate(Vertices=cull_duplicates.Points, Degree=0, Periodic=False, KnotStyle=0)  # -> Curve, Length, Domain; disabled
pipe = Pipe(Curve=interpolate.Curve, Radius=number_slider_18, Caps=2)  # disabled
transform_4 = Transform(Geometry=pipe, Transform=transform_3)  # disabled

# ----
transform_5 = Transform(Geometry=point_17, Transform=transform_3)  # disabled
polyline = PolyLine(Vertices=transform_5, Closed=False)  # disabled
reduce = Reduce(Polyline=polyline, Tolerance=1)  # -> Polyline, Reduction; disabled
smooth_polyline = SmoothPolyline(Polyline=polyline, Strength=1, Times=1)  # disabled
transform_6 = Transform(Geometry=interpolate.Curve, Transform=transform_3)  # disabled
custom_preview_lineweights_3 = CustomPreviewLineweights(Geometry=flatten(polyline), Shader=colour_picker, Thickness=number_slider_6, Absolute=False)  # disabled

# ---- group: Create extrusion simulation (continued)
brep_9 = Brep(transform_4)  # disabled

# ---- group: Create Form TCP and Mesh
mold_form_brep_2 = Brep()  # disabled
height_num_2 = Number()  # disabled

cap_holes_5 = CapHoles(Brep=mold_form_brep_2)  # disabled
pen_sharpness = Slider(15.94, range=0..50)  # disabled
pen_thickness = Slider(5.3, range=0..100)  # disabled
point_18 = ConstructPoint(XCoordinate=0, YCoordinate=0, ZCoordinate=height_num_2)  # disabled
xy_plane_8 = XYPlane(Origin=point_18)  # disabled
number_23 = Number(pen_thickness)  # disabled
number_24 = Number(pen_sharpness)  # disabled
plane_17 = Plane(xy_plane_8)  # disabled
mesh_2 = Mesh(cap_holes_5)  # disabled
pen_holder_mesh = PenHolderMesh(number_3=number_23, number=height_num_2, number_2=number_24)  # disabled
create_tool_2 = CreateTool(Name="DefaultGHTool", TCP=plane_17, Weight=0, Mesh=mesh_2)  # -> Tool, TCP; disabled

tool_parameter_5 = ToolParameter(create_tool_2.Tool)  # disabled
tcp_plane_2 = Plane(plane_17)  # disabled

# ---- group: Convert planes to TCP position
plane_18 = Plane(tcp_plane_2)  # disabled
plane_19 = Plane()  # disabled
plane_20 = Plane(plane_6)  # disabled
orient_3 = Orient(Geometry=plane_18, Source=plane_19, Target=plane_20)  # -> Geometry, Transform; disabled
transform_7 = Transform(orient_3.Transform)  # disabled
plane_21 = Plane(orient_3.Geometry)  # disabled

# ----
number_slider_19 = Slider(-45.708, range=-100..0)  # disabled
plane_22 = Plane(plane_21)  # disabled
unit_z_4 = UnitZ(Factor=number_slider_19)  # disabled
list_item_9 = ListItem(List=plane_22, Index=0, Wrap=True)  # disabled
move_4 = Move(Geometry=list_item_9, Motion=unit_z_4)  # -> Geometry, Transform; disabled

speed_parameter_7 = SpeedParameter(speed_parameter_3)  # disabled
zone_parameter_7 = ZoneParameter(zone_parameter_3)  # disabled
tool_parameter_6 = ToolParameter(tool_parameter_5)  # disabled
configuration_7 = Integer(configuration_3)  # disabled
motion_type_7 = Text(motion_type_3)  # disabled
plane_23 = Plane(move_4.Geometry)  # disabled
create_target_4 = CreateTarget(
    Plane=flatten(plane_23),
    RobConf=configuration_7,
    Motion=motion_type_7,
    Tool=tool_parameter_6,
    Speed=speed_parameter_7,
    Zone=zone_parameter_7,
    IsCartesian=True)  # disabled
target_parameter_7 = TargetParameter(create_target_4)  # disabled

speed_parameter_8 = SpeedParameter(speed_parameter_4)  # disabled
zone_parameter_8 = ZoneParameter(zone_parameter_4)  # disabled
tool_parameter_7 = ToolParameter(tool_parameter_5)  # disabled
configuration_8 = Integer(configuration_4)  # disabled
motion_type_8 = Text(motion_type_4)  # disabled
plane_24 = Plane(plane_21)  # disabled
create_target_5 = CreateTarget(
    Plane=flatten(plane_24),
    RobConf=configuration_8,
    Motion=motion_type_8,
    Tool=tool_parameter_7,
    Speed=speed_parameter_8,
    Zone=zone_parameter_8,
    IsCartesian=True)  # disabled
target_parameter_8 = TargetParameter(flatten(create_target_5))  # disabled

# ---- group: Start angle configuration
_0_2 = Slider(0, range=-1..1)  # disabled
_1_2 = Slider(0, range=-1..1)  # disabled
_2_2 = Slider(0, range=-1..1)  # disabled
_3_2 = Slider(0, range=-1..1)  # disabled
_4_2 = Slider(0, range=-1..1)  # disabled
_5_2 = Slider(0, range=-1..1)  # disabled
boolean_toggle_4 = BooleanToggle(False)  # disabled

# ----
panel_27 = Panel(",")  # disabled
merge_9 = Merge(Data1=_0_2, Data2=_1_2, Data3=_2_2, Data4=_3_2, Data5=_4_2, Data6=_5_2)  # disabled
panel_28 = Panel("360")  # disabled
multiplication_12 = Multiplication(A=panel_28, B=merge_9)  # disabled

number_slider_20 = Slider(3, range=0..100)  # disabled
panel_29 = Panel("6")  # disabled
zone_soft_radius_2 = Number(panel_29)  # disabled
tool_parameter_8 = ToolParameter(tool_parameter_5)  # disabled
speed_6 = Number(number_slider_20)  # disabled

# ---- group: Create Robot Program
list_12 = ValueList({"Bartlett-IRB120", "Bartlett-IRB1600", "Bartlett-KR6", "Bartlett-KR60", "Bartlett-UR10", "BURG Halle-UR5", "BURG Halle-UR5 on table", "KULeuven-IRB120", "KULeuven-UR5", "KULeuven-UR10"}, selected="BURG Halle-UR5")  # disabled

# ----
program_step_size_2 = Slider(0.64, range=0..1)  # disabled
polyline_2 = PolyLine(Closed=True)  # disabled
number_slider_21 = Slider(8.222, range=0..20)  # disabled

# ---- group: Create Robot Program
load_robot_system_2 = LoadRobotSystem(Name=list_12, Base=PlaneXY(0, 0, 0))  # disabled

# ----
kinematics_2 = Kinematics(RobotSystem=load_robot_system_2, Target=target_parameter_7, DisplayGeometry=boolean_toggle_4)  # -> Meshes, Joints, Planes, Errors; disabled
text_split_2 = TextSplit(Text=kinematics_2.Joints, Separators=panel_27)  # disabled
degrees_3 = Degrees(Radians=text_split_2)  # disabled
subtraction_5 = Subtraction(A=degrees_3, B=multiplication_12)  # disabled
number_25 = Number(subtraction_5)  # disabled
radians_3 = Radians(Degrees=number_25)  # disabled
text_join_2 = TextJoin(Text=radians_3, Join=panel_27)  # disabled

start_angles_before_optimisation_2 = Panel(degrees_3)  # disabled
start_angles_after_optimisation_2 = Panel(number_25)  # disabled

# ---- group: Start angle configuration (continued)
joint_angles_3 = Text(text_join_2)  # disabled

# ----
joint_angles_4 = Text(joint_angles_3)  # disabled
create_target_6 = CreateTarget(Joints=joint_angles_4, Tool=tool_parameter_8, Speed=speed_6, Zone=zone_soft_radius_2, IsCartesian=False)  # disabled
target_parameter_9 = TargetParameter(create_target_6)  # disabled

# ---- group: Create Robot Program (continued)
merge_10 = Merge(
    Data1=flatten(target_parameter_9),
    Data2=flatten(target_parameter_8),
    Data3=flatten(target_parameter_7),
    Data4=flatten(target_parameter_9))  # disabled

create_program_2 = CreateProgram(Name="DefaultProgram", RobotSystem=load_robot_system_2, Targets1=merge_10, StepSize=program_step_size_2)  # -> Program, Code, Duration, Warnings, Errors; disabled

program_parameter_2 = ProgramParameter(create_program_2.Program)  # disabled
text_5 = Text(create_program_2.Code)  # disabled
number_26 = Number(create_program_2.Duration)  # disabled
text_6 = Text(create_program_2.Warnings)  # disabled
text_7 = Text(create_program_2.Errors)  # disabled

# ----
ip_adress_2 = Text(robot_ip_adress)  # disabled
boolean_8 = Boolean(boolean_4)  # disabled
boolean_9 = Boolean(boolean_2)  # disabled
boolean_10 = Boolean(boolean_3)  # disabled
remote_connection_2 = RemoteConnection(Program=program_parameter_2, IP=ip_adress_2, Upload=boolean_8, Play=boolean_9, Pause=boolean_10)  # disabled
text_8 = Text(remote_connection_2)  # disabled
data_recorder_4 = DataRecorder(text_8, DataLimit=-10, RecordData=True)  # disabled

# ---- group: Upload to Robot (continued)
text_9 = Text(data_recorder_4)  # disabled
log = Panel(text_9)  # disabled

# ---- group: Length of the program
list_length_7 = ListLength(List=text_5)  # disabled
commands_2 = Panel(list_length_7)  # disabled

# ----
warnings_3 = Panel(text_6)  # disabled

# ---- group: Robot Simulation
number_27 = Number(trail_length)  # disabled
number_28 = Number(number_19)  # disabled

program_simulation_2 = ProgramSimulation(Program=program_parameter_2, Time=number_28, Normalized=True)  # -> SystemMeshes, JointRotations, Plane, Index, Time, Program, Errors; disabled
check_collisions_2 = CheckCollisions(
    Program=program_simulation_2.Program,
    FirstSet=7,
    SecondSet=4,
    EnvironmentPlane=-1,
    LinearStepSize=100,
    AngularStepSize=0.7853981634)  # -> CollisionFound, TargetIndex, CollidedMeshes; disabled
simple_trail_2 = SimpleTrail(Program=program_simulation_2.Program, Length=number_27, MechanicalGroup=0)  # disabled
split_list_5 = SplitList(List=program_simulation_2.SystemMeshes, Index=7)  # -> ListA, ListB; disabled

collisions_2 = Panel(check_collisions_2.CollisionFound)  # disabled
colliding_meshes_mesh_2 = Mesh(check_collisions_2.CollidedMeshes)  # disabled
number_29 = Number(program_simulation_2.JointRotations)  # disabled
plane_25 = Plane(program_simulation_2.Plane)  # disabled
integer_8 = Integer(program_simulation_2.Index)  # disabled
curve_19 = Curve(simple_trail_2)  # disabled
robot_mesh_2 = Mesh(split_list_5.ListA)  # disabled
tool_mesh_3 = Mesh(split_list_5.ListB)  # disabled

# ----
plane_26 = Plane(plane_25)  # disabled
plane_27 = Plane(tcp_plane_2)  # disabled

list_item_10 = ListItem(List=plane_26, Index=-1, Wrap=True)  # disabled
orient_4 = Orient(Source=plane_27, Target=list_item_10)  # -> Geometry, Transform; disabled

transform_8 = Transform(orient_4.Transform)  # disabled

# ---- group: Move Curve according to TCP position
transform_9 = Transform(transform_8)  # disabled
curve_20 = Curve(polyline_2)  # disabled
transform_10 = Transform(Geometry=curve_20, Transform=transform_9)  # disabled
curve_21 = Curve(transform_10)  # disabled

# ---- group: Robot Simulation (continued)
curve_in_position = Curve(curve_21)  # disabled

# ----
preview_3 = CustomPreview(Geometry=curve_in_position, Shader=swatch_3)  # disabled

# ---- group: Create extrusion simulation
simulation_index_2 = Integer(integer_8)  # disabled
point_19 = Point()  # disabled
transform_11 = Transform(transform_8)  # disabled

split_list_6 = SplitList(List=point_19, Index=simulation_index_2)  # -> ListA, ListB; disabled
number_slider_22 = Slider(5.268, range=0..10)  # disabled
number_slider_23 = Slider(2.73, range=0..10)  # disabled
point_20 = Point(split_list_6.ListA)  # disabled
cull_duplicates_2 = CullDuplicates(Points=point_20, Tolerance=number_slider_22, CullMode=3)  # -> Points, Indices, Valence; disabled
interpolate_2 = Interpolate(Vertices=cull_duplicates_2.Points, Degree=3, Periodic=False, KnotStyle=0)  # -> Curve, Length, Domain; disabled
pipe_2 = Pipe(Curve=interpolate_2.Curve, Radius=number_slider_23, Caps=2)  # disabled
transform_12 = Transform(Geometry=pipe_2, Transform=transform_11)  # disabled

# ----
transform_13 = Transform(Geometry=cull_duplicates_2.Points, Transform=transform_11)  # disabled
polyline_3 = PolyLine(Vertices=point_20, Closed=False)  # disabled
smooth_polyline_2 = SmoothPolyline(Polyline=polyline_3, Strength=1, Times=1)  # disabled
reduce_2 = Reduce(Polyline=polyline_3, Tolerance=1)  # -> Polyline, Reduction; disabled
transform_14 = Transform(Geometry=interpolate_2.Curve, Transform=transform_11)  # disabled
custom_preview_lineweights_4 = CustomPreviewLineweights(
    Geometry=flatten(transform_14),
    Shader={diffuse=RGB(255, 105, 180), emission=RGB(76, 32, 54), shine=0.5, specular=RGB(255, 255, 255), transparency=0},
    Thickness=number_slider_21,
    Absolute=False)  # disabled

# ---- group: Create extrusion simulation (continued)
brep_10 = Brep(transform_12)  # disabled

# ---- group: Robot Simulation (continued)
extrusion_brep = Brep(brep_10)  # disabled

# ----
preview_4 = CustomPreview(Geometry=extrusion_brep, Shader=swatch_2)  # disabled

# ==== cluster PenHolderMesh
number = ClusterInput()
number_2 = ClusterInput()
number_3 = ClusterInput()
number_4 = Number(number)
number_5 = Number(number_2)
number_6 = Number(number_3)
subtraction = Subtraction(A=number_4, B=number_5)
unit_z = UnitZ(Factor=subtraction)
unit_z_2 = UnitZ(Factor=number_4)
circle = Circle(Plane=PlaneXY(0, 0, 0), Radius=number_6)
extrude = Extrude(Base=circle, Direction=unit_z)
construct_point = ConstructPoint(XCoordinate=0, YCoordinate=0, ZCoordinate=unit_z_2)
move = Move(Geometry=circle, Motion=unit_z)  # -> Geometry, Transform
extrude_point = ExtrudePoint(Base=move.Geometry, Point=construct_point)
merge = Merge(Data1=extrude_point, Data2=extrude)
mesh_brep = MeshBrep(
    Brep=merge,
    Settings={GridMaxCount=0, GridMinCount=16, JaggedSeams=False, MaxEdgeLength=0, MinEdgeLength=0.0001, MinTolerance=0, Refine=True, RefineAngle=0, RelativeTolerance=0.65, SimplePlanes=True, Tolerance=0})
brep = Brep([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])
mesh = Mesh(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)
merge_2 = Merge(Data1=mesh, Data2=mesh_brep)
mesh_join = MeshJoin(Meshes=merge_2)
mesh_2 = Mesh(mesh_join)
mesh_3 = ClusterOutput(mesh_2)

# ==== cluster PlaneAxisViewer
plane = ClusterInput()
panel = Panel("""Red
Green
Blue""")
length = ClusterInput()  # Size of the vector lines to display
plane_2 = Plane(graft(plane))
colour = Colour(panel)
deconstruct_plane = DeconstructPlane(Plane=plane_2)  # -> Origin, XAxis, YAxis, ZAxis
merge = Merge(Data1=deconstruct_plane.XAxis, Data2=deconstruct_plane.YAxis, Data3=deconstruct_plane.ZAxis)
multiplication = Multiplication(A=length, B=Slider(1.14, range=1..2))
amplitude = Amplitude(Vector=merge, Amplitude=length)
amplitude_2 = Amplitude(Vector=merge, Amplitude=multiplication)
move = Move(Geometry=deconstruct_plane.Origin, Motion=amplitude_2)  # -> Geometry, Transform
panel_2 = Panel("""X
Y
Z""")
text_tag = TextTag(Location=move.Geometry, Text=panel_2, Colour=colour)
vector_display_ex = VectorDisplayEx(Point=deconstruct_plane.Origin, Vector=amplitude, Colour=colour, Width=Slider(3.9, range=0..10))
