# Grasshopper definition Drafted cylinder test 01 [May-23 '19, 1249].gh (Grasshopper 1.0.7)
# plug-ins: Robots, Human, Agent

offset = Panel("0")
diameters = Panel("""126
141-9.2*2
116
116
110""")
heights = Panel("""0
20
180
183
183""")
subtraction = Subtraction(A=heights, B=offset)
number = Number(subtraction)
number_2 = Number(diameters)

# ---- group: What ??
number_slider = Slider(3, range=0..10)
division = Division(A="360", B=number_slider)
series = Series(Start=0, Step=division, Count=number_slider)

# ----
radians = Radians(Degrees=series)
yz_plane = YZPlane(Origin=Point(0, 0, 0))
rotate_3d = Rotate3D(Geometry=yz_plane, Angle=radians, Center=Point(0, 0, 0), Axis=Vector(0, 0, 1))  # -> Geometry, Transform

plane = Plane(rotate_3d.Geometry)

number_slider_2 = Slider(13.842, range=0..20)  # disabled

# ---- group: Robot Simulation
simulation_control = ControlKnob(Decimals=6, Limit=True, Maximum=1, Minimum=0, Range=0.1, Value=0.23769)
trail_length = Slider(6847, range=0..10000)
number_3 = Number(Slider(0.640954, range=0..1))

# ----
number_4 = Number(number)
number_5 = Number(number_2)

point = ConstructPoint(XCoordinate=0, YCoordinate=0, ZCoordinate=number_4)
division_2 = Division(A=number_5, B=2)
loft_options = LoftOptions(Closed=False, Adjust=False, Rebuild=0, Refit=0, Type=3)
circle = Circle(Plane=point, Radius=division_2)
loft = Loft(Curves=circle, Options=loft_options)
fillet_edge = FilletEdge(Shape=loft, Blend=0, Metric=0, Edges=Slider(8, range=0..10), Radii=Slider(2.941, range=0..10))
last = Panel("-1")
list_item = ListItem(List=number_4, Index=last, Wrap=True)

brep = Brep(loft)
list_item_2 = ListItem(List=circle, Index=last, Wrap=True)
boundary_surfaces = BoundarySurfaces(Edges=list_item_2)
merge = Merge(Data1=fillet_edge, Data2=boundary_surfaces)
brep_join = BrepJoin(Breps=merge)  # -> Breps, Closed

brep_2 = Brep(brep_join.Breps)
height = Number(list_item)

panel = Panel("20")  # disabled
panel_2 = Panel("0")  # disabled
number_slider_3 = Slider(20, range=0..20)  # disabled
brep_3 = Brep(brep_2)  # disabled
vector_xyz = VectorXYZ(XComponent=panel, YComponent=panel, ZComponent=panel_2)  # -> Vector, Length; disabled
number_slider_4 = Slider(-1, range=-1..1000)  # disabled
cap_holes = CapHoles(Brep=brep_3)  # disabled
cylinder = Cylinder(Base=PlaneXY(0, 0, 0), Radius=number_slider_3, Length=number_slider_3)  # disabled
panel_3 = Panel("1")  # disabled
panel_4 = Panel("1000")  # disabled
construct_particle = ConstructParticle(
    UpDirection=Vector(0, 0, -12),
    Acceleration=vector_xyz.Vector,
    Lifespan=number_slider_4,
    Mass=1,
    BodySize=panel_3,
    HistoryLength=panel_4)  # disabled
brep_4 = Brep(cap_holes)  # disabled
surface = Surface(cylinder)  # disabled
polysurface_environment = PolysurfaceEnvironment(Brep=brep_3, BorderExtrutionDirection=Vector(0, 0, 0))  # -> Environment, BorderWalls; disabled
number_slider_5 = Slider(0.956, range=0..1)  # disabled
panel_5 = Panel("20")  # disabled
construct_point = ConstructPoint(XCoordinate=0, YCoordinate=0, ZCoordinate=height)  # disabled
panel_6 = Panel("1")  # disabled
panel_7 = Panel("10")  # disabled
construct_agent = ConstructAgent(ParticleQueleaSettings=construct_particle, MaxSpeed=panel_5, MaxForce=number_slider_5, VisionRadius=5, VisionAngle=360)  # disabled
xy_plane = XYPlane(Origin=Point(0, 0, 0))  # disabled
xz_plane = XZPlane(Origin=Point(0, 0, 0))  # disabled
point_emitter = PointEmitter(
    ContinuousFlow=False,
    CreationRate=panel_7,
    NumberOfQuelea=panel_6,
    MinimumInitialVelocity=Vector(-0.1, -0.1, -0.1),
    MaximumInitialVelocity=Vector(0.1, 0.1, 0.1),
    Point=construct_point)  # disabled
line_sdl = LineSDL(Start=xy_plane, Direction=Vector(0, 0, 1), Length=1)  # disabled
brep_plane = BrepPlane(Brep=brep_3, Plane=xz_plane)  # -> Curves, Points; disabled
yz_plane_2 = YZPlane(Origin=Point(0, 0, 0))  # disabled
brep_environment = BrepEnvironment(Brep=cap_holes)  # disabled
curve_plane = CurvePlane(Curve=brep_plane.Curves, Plane=yz_plane_2)  # -> Points, ParamsC, ParamsP; disabled
timer = Timer(TimerInterval=20, Target=[engine, system])  # disabled
number_slider_6 = Slider(3.733, range=0..20)  # disabled
number_slider_7 = Slider(0.174, range=0..10)  # disabled
system = System(QueleaSettings=construct_agent, Emitters=point_emitter, Environment=brep_environment)  # -> System, Quelea, QueleaNetwork; disabled
boolean_toggle = BooleanToggle(True)  # disabled
button = Button()  # disabled
shatter = Shatter(Curve=brep_plane.Curves, Parameters=curve_plane.ParamsC)  # disabled
list_item_3 = ListItem(List=shatter, Index=0, Wrap=True)  # disabled
panel_8 = Panel("2*pi")  # disabled
deconstruct_particle = DeconstructParticle(ParticleQuelea=system.Quelea)  # -> Position, Velocity, Acceleration, Lifespan, SurfacePosition, SurfaceVelocity, SurfaceAcceleration; disabled
wander_force = WanderForce(Apply=True, WeightMultiplier=0.5, AgentQuelea=system.Quelea, Strength=number_slider_6, Rate=number_slider_7)  # -> Force, DesiredVelocity, Sphere, TargetPoint; disabled
engine = Engine(Reset=button, System=system.System)  # disabled
get_particle_position_history = GetParticlePositionHistory(ParticleQuelea=system.Quelea)  # disabled
bounce_contain_behavior = BounceContainBehavior(Apply=True, ParticleQuelea=system.Quelea, Environment=brep_environment)  # disabled
revolution = Revolution(Curve=list_item_3, Axis=line_sdl, Domain=panel_8)  # disabled
interpolate = Interpolate(Vertices=get_particle_position_history, Degree=3, Periodic=False, KnotStyle=1)  # -> Curve, Length, Domain; disabled
polyline = PolyLine(Vertices=get_particle_position_history, Closed=False)  # disabled
point_2 = Point(deconstruct_particle.Position)  # disabled
seek_force = SeekForce(Apply=True, WeightMultiplier=1, TargetPoint=Point(0, 0, 0))  # -> Force, DesiredVelocity; disabled
surface_environment = SurfaceEnvironment(Surface=revolution, Wrap=False)  # -> Environment, _2DReferenceSurface; disabled
polysurface_environment_2 = PolysurfaceEnvironment(Brep=revolution, BorderExtrutionDirection=Vector(0, 0, 0))  # -> Environment, BorderWalls; disabled
surface_2 = Surface(revolution)  # disabled
plane_normal = PlaneNormal(Origin=point_2, ZAxis=deconstruct_particle.Velocity)  # disabled
data_recorder = DataRecorder(point_2, DataLimit=-10, RecordData=False)  # disabled

height_2 = Number(height)
vector_xyz_2 = VectorXYZ(XComponent=0, YComponent=0, ZComponent=height_2)  # -> Vector, Length
circle_2 = Circle(Plane=vector_xyz_2.Vector, Radius=Slider(36.934, range=0..100))
curve = Curve(circle_2)

# ---- group: Upload to Robot
robot_ip_adress = Panel("192.168.137.2")
upload = Button()
pause = Button()
play = Button()
boolean = Boolean(play)
boolean_2 = Boolean(upload)
boolean_3 = Boolean(pause)

# ---- group: Lower boundary
lowest_point = Slider(100, range=0..100)
brep_5 = Brep(brep_2)
number_6 = Number(lowest_point)

construct_point_2 = ConstructPoint(XCoordinate=0, YCoordinate=0, ZCoordinate=number_6)
xy_plane_2 = XYPlane(Origin=construct_point_2)
brep_plane_2 = BrepPlane(Brep=brep_5, Plane=xy_plane_2)  # -> Curves, Points

curve_2 = Curve(brep_plane_2.Curves)

# ----
number_7 = Number(height)
brep_6 = Brep(brep_2)

subtraction_2 = Subtraction(A=number_7, B=0.01)
number_slider_8 = Slider(7, range=1..30)
construct_domain = ConstructDomain(DomainStart=Slider(28.045, range=0..40), DomainEnd=subtraction_2)
range = Range(Domain=construct_domain, Steps=number_slider_8)
construct_point_3 = ConstructPoint(XCoordinate=0, YCoordinate=0, ZCoordinate=range)
xy_plane_3 = XYPlane(Origin=construct_point_3)
brep_plane_3 = BrepPlane(Brep=brep_6, Plane=xy_plane_3)  # -> Curves, Points

curve_3 = Curve(brep_plane_3.Curves)

number_slider_9 = Slider(11, range=1..100)  # disabled
number_slider_10 = Slider(9, range=0..10)  # disabled
divide_curve = DivideCurve(Curve=curve_3, Count=number_slider_9, Kinks=False)  # -> Points, Tangents, Parameters; disabled
addition = Addition(A=number_slider_8, B=1)  # disabled
number_slider_11 = Slider(1, range=0..1)  # disabled
series_2 = Series(Start=0, Step=number_slider_10, Count=addition)  # disabled
point_3 = Point(flatten(divide_curve.Points))  # disabled
point_list = PointList(Points=point_3)  # disabled
shift_list = ShiftList(List=divide_curve.Points, Shift=graft(series_2), Wrap=True)  # disabled
jitter = Jitter(List=point_3, Jitter=number_slider_11, Seed=2)  # -> Values, Indices; disabled
number_slider_12 = Slider(3, range=1..5)  # disabled
number_slider_13 = Slider(16.517, range=0..20)  # disabled
point_4 = Point(flatten(shift_list))  # disabled
flip_matrix = FlipMatrix(Data=shift_list)  # disabled
point_5 = Point(jitter.Values)  # disabled
number_slider_14 = Slider(611, range=0..1000)  # disabled
interpolate_2 = Interpolate(Vertices=flip_matrix, Degree=3, Periodic=False, KnotStyle=1)  # -> Curve, Length, Domain; disabled
polyline_2 = PolyLine(Vertices=flip_matrix, Closed=False)  # disabled
point_list_2 = PointList(Points=point_5, Size=number_slider_13)  # disabled
interpolate_3 = Interpolate(Vertices=point_5, Degree=number_slider_12, Periodic=False, KnotStyle=0)  # -> Curve, Length, Domain; disabled
point_order = PointOrder(Points=point_5)  # disabled
curve_4 = Curve(flatten(interpolate_2.Curve))  # disabled
divide_curve_2 = DivideCurve(Curve=interpolate_3.Curve, Count=number_slider_14, Kinks=False)  # -> Points, Tangents, Parameters; disabled
end_points = EndPoints(Curve=curve_4)  # -> Start, End; disabled
brep_7 = Brep(brep_2)  # disabled
brep_closest_point = BrepClosestPoint(Point=divide_curve_2.Points, Brep=brep_7)  # -> Point, Normal, Distance; disabled
shift_list_2 = ShiftList(List=end_points.End, Shift=1, Wrap=True)  # disabled
line = Line(StartPoint=end_points.Start, EndPoint=shift_list_2)  # disabled
surface_closest_point = SurfaceClosestPoint(Point=brep_closest_point.Point, Surface=reparameterize(brep_7))  # -> Point, UVPoint, Distance; disabled
pull_point = PullPoint(Point=divide_curve_2.Points, Geometry=brep_7, ClosestOnly=False)  # -> flatten(ClosestPoint), Distance; disabled
join_curves = JoinCurves(Curves=[line, curve_4], Preserve=False)  # -> flatten(Curves); disabled
pull_curve = PullCurve(Curve=polyline_2, Surface=brep_7, UseTasks=True)  # disabled
point_6 = Point(surface_closest_point.Point)  # disabled
curve_on_surface = CurveOnSurface(Surface=brep_7, UVCoordinates=surface_closest_point.UVPoint, Closed=False)  # -> Curve, Length, Domain; disabled
project = Project(Curve=flatten(polyline_2), Brep=brep_2, Direction=Vector(0, 0, 1))  # disabled
interpolate_4 = Interpolate(Vertices=pull_point.ClosestPoint, Degree=3, Periodic=False, KnotStyle=1)  # -> Curve, Length, Domain; disabled
evaluate_surface = EvaluateSurface()  # -> Point, Normal, UDirection, VDirection, Frame; disabled
project_point = ProjectPoint(Direction=Vector(0, 0, -1))  # -> Point, Index; disabled
project_2 = Project(Curve=interpolate_4.Curve, Brep=brep_2, Direction=Vector(0, 0, 1))  # disabled

curve_5 = Curve(curve_2)

divide_curve_3 = DivideCurve(Curve=curve_5, Count=10, Kinks=False)  # -> Points, Tangents, Parameters
xy_plane_4 = XYPlane(Origin=Point(0, 0, 0))
line_2 = Line(StartPoint=xy_plane_4, EndPoint=divide_curve_3.Points)
sphere_size = Slider(525.355, range=0..1000)
extend_curve = ExtendCurve(Curve=line_2, Type=0, Start="0", End=Slider(659.077, range=0..1000))
loft_options_2 = LoftOptions(Closed=True, Adjust=False, Rebuild=0, Refit=0, Type=0)
sphere = Sphere(Base=PlaneXY(0, 0, 0), Radius=sphere_size)
loft_2 = Loft(Curves=extend_curve, Options=loft_options_2)
split_brep = SplitBrep(Brep=sphere, Cutter=loft_2)
list_item_4 = ListItem(List=split_brep, Index=0, Wrap=True)  # -> Item, Item1

surface_3 = Surface(list_item_4.Item)
surface_4 = Surface(list_item_4.Item1)

brep_8 = Brep(surface_3)
plane_2 = Plane(plane)
radians_2 = Radians(Degrees=Slider(37.406, range=0..720))

brep_plane_4 = BrepPlane(Brep=brep_8, Plane=plane_2)  # -> Curves, Points
divide_curve_4 = DivideCurve(Curve=brep_plane_4.Curves, Count=10, Kinks=False)  # -> Points, Tangents, Parameters
point_7 = Point(flatten(divide_curve_4.Points))
interpolate_5 = Interpolate(Vertices=point_7, Degree=3, Periodic=True, KnotStyle=1)  # -> Curve, Length, Domain

rotate = Rotate(Geometry=interpolate_5.Curve, Angle=radians_2, Plane=PlaneXY(0, 0, 0))  # -> Geometry, Transform
curve_6 = Curve(rotate.Geometry)

brep_9 = Brep(brep_2)
curve_7 = Curve(curve_6)

divide_length = DivideLength(Curve=curve_7, Length=Slider(65.6, range=10..100))  # -> Points, Tangents, Parameters
xy_plane_5 = XYPlane(Origin=Point(0, 0, 0))
loft_options_3 = LoftOptions(Closed=True, Adjust=False, Rebuild=0, Refit=0, Type=0)
line_3 = Line(StartPoint=xy_plane_5, EndPoint=divide_length.Points)
loft_3 = Loft(Curves=line_3, Options=loft_options_3)
brep_brep = BrepBrep(BrepA=brep_9, BrepB=loft_3)  # -> Curves, Points

curve_8 = Curve(brep_brep.Curves)

# ---- group: Lower boundary
lowest_point_2 = Slider(151.854, range=0..200)
brep_10 = Brep(brep_2)
number_8 = Number(lowest_point_2)
radians_3 = Radians(Degrees=Slider(37.406, range=0..720))

construct_point_4 = ConstructPoint(XCoordinate=0, YCoordinate=0, ZCoordinate=number_8)
xy_plane_6 = XYPlane(Origin=construct_point_4)
brep_plane_5 = BrepPlane(Brep=brep_10, Plane=xy_plane_6)  # -> Curves, Points

rotate_2 = Rotate(Geometry=brep_plane_5.Curves, Angle=radians_3, Plane=PlaneXY(0, 0, 0))  # -> Geometry, Transform
curve_9 = Curve(rotate_2.Geometry)

# ----
stream_filter = StreamFilter(Gate=Slider(2, range=0..5), Stream0=curve_8, Stream1=curve_9, Stream2=curve)

brep_11 = Brep(brep_2)
curve_10 = Curve(stream_filter)

divide_length_2 = DivideLength(Curve=curve_10, Length=Slider(3.594, range=1..10))  # -> Points, Tangents, Parameters
brep_closest_point_2 = BrepClosestPoint(Point=divide_length_2.Points, Brep=brep_11)  # -> Point, Normal, Distance
unit_z = UnitZ(Factor=1)
plane_normal_2 = PlaneNormal(Origin=brep_closest_point_2.Point, ZAxis=brep_closest_point_2.Normal)
align_plane = AlignPlane(Plane=plane_normal_2, Direction=unit_z)  # -> Plane, Angle
flip_plane = FlipPlane(Plane=align_plane.Plane, ReverseX=False, ReverseY=False, SwapAxes=True)

plane_3 = Plane(flip_plane)

# ---- group: Create Form TCP and Mesh
brep_12 = Brep(brep_2)
number_9 = Number(height)

pen_sharpness = Slider(15.94, range=0..50)
pen_thickness = Slider(5.3, range=0..100)
cap_holes_2 = CapHoles(Brep=brep_12)
point_8 = ConstructPoint(XCoordinate=0, YCoordinate=0, ZCoordinate=number_9)
xy_plane_7 = XYPlane(Origin=point_8)
number_10 = Number(pen_sharpness)
number_11 = Number(pen_thickness)
mesh = Mesh(cap_holes_2)
plane_4 = Plane(xy_plane_7)
pen_holder_mesh = PenHolderMesh(number_3=number_11, number=number_9, number_2=number_10)
create_tool = CreateTool(Name="DefaultGHTool", TCP=plane_4, Weight=0, Mesh=mesh)  # -> Tool, TCP

tool_parameter = ToolParameter(create_tool.Tool)

# ----
number_slider_15 = Slider(366.9, range=0..1000)

construct_point_5 = ConstructPoint(XCoordinate=number_slider_15, YCoordinate=number_slider_15, ZCoordinate=number_slider_15)
xy_plane_8 = XYPlane(Origin=construct_point_5)

plane_5 = Plane(xy_plane_8)

number_slider_16 = Slider(69.678, range=0..100)
unit_z_2 = UnitZ(Factor=number_slider_16)
move = Move(Geometry=plane_5, Motion=unit_z_2)  # -> Geometry, Transform
cone = Cone(Base=move.Geometry, Radius=Slider(25.219, range=0..100), Length=expr("-x", number_slider_16))  # -> Cone, Tip
brep_13 = Brep(cone.Cone)

extruder_tip = Brep(brep_13)

plane_6 = Plane(plane_5)
plane_7 = Plane(plane_4)
plane_8 = Plane(plane_3)
orient = Orient(Geometry=plane_7, Source=plane_8, Target=plane_6)  # -> Geometry, Transform
transform = Transform(orient.Transform)
plane_9 = Plane(orient.Geometry)

# ---- group: Create Robot Program
list = ValueList({"Bartlett-IRB120", "Bartlett-IRB1600", "Bartlett-KR6", "Bartlett-KR60", "Bartlett-UR10", "BURG Halle-UR5", "BURG Halle-UR5 on table", "KULeuven-IRB120", "KULeuven-UR5", "KULeuven-UR10"}, selected="BURG Halle-UR5")
list_2 = FlagFields({"Shoulder": 1, "Elbow": 2, "Wrist": 4}, selected="Wrist")
list_3 = ValueList({"Joint", "Linear"}, selected="Linear")
plane_10 = Plane(plane_9)
tool_parameter_2 = ToolParameter(tool_parameter)
zone_soft_radius = Number("0")
speed = Number(Slider(100, range=0..100))

load_robot_system = LoadRobotSystem(Name=list, Base=PlaneXY(0, 0, 0))
create_target = CreateTarget(
    Plane=flatten(plane_10),
    RobConf=list_2,
    Motion=list_3,
    Tool=tool_parameter_2,
    Speed=speed,
    Zone=zone_soft_radius,
    IsCartesian=True)
create_program = CreateProgram(Name="DefaultProgram", RobotSystem=load_robot_system, Targets1=create_target, StepSize=Slider(0.25, range=0..1))  # -> Program, Code, Duration, Warnings, Errors

program_parameter = ProgramParameter(create_program.Program)
number_12 = Number(create_program.Duration)
text = Text(create_program.Warnings)
text_2 = Text(create_program.Code)
text_3 = Text(create_program.Errors)

# ---- group: Program Code and Errors
program = Panel(program_parameter)
warnings = Panel(text)
errors = Panel(text_3)
program_code = Panel(text_2)

# ----
boolean_4 = Boolean(boolean_3)
ip_adress = Text(robot_ip_adress)
boolean_5 = Boolean(boolean_2)
boolean_6 = Boolean(boolean)
remote_connection = RemoteConnection(Program=program_parameter, IP=ip_adress, Upload=boolean_5, Play=boolean_6, Pause=boolean_4)  # disabled
text_4 = Text(remote_connection)
data_recorder_2 = DataRecorder(text_4, DataLimit=-10, RecordData=True)

# ---- group: Upload to Robot (continued)
text_5 = Text(data_recorder_2)
log = Panel(text_5)

# ---- group: Length of the program
list_length = ListLength(List=text_2)
commands = Panel(list_length)

# ---- group: Robot Simulation
number_13 = Number(trail_length)
number_14 = Number(number_3)

program_simulation = ProgramSimulation(Program=program_parameter, Time=number_14, Normalized=True)  # -> SystemMeshes, JointRotations, Plane, Index, Time, Program, Errors
check_collisions = CheckCollisions(
    Program=program_simulation.Program,
    FirstSet=7,
    SecondSet=4,
    EnvironmentPlane=-1,
    LinearStepSize=100,
    AngularStepSize=0.7853981634)  # -> CollisionFound, TargetIndex, CollidedMeshes
simple_trail = SimpleTrail(Program=program_simulation.Program, Length=number_13, MechanicalGroup=0)
split_list = SplitList(List=program_simulation.SystemMeshes, Index=7)  # -> ListA, ListB

colliding_meshes_mesh = Mesh(check_collisions.CollidedMeshes)
collisions = Panel(check_collisions.CollisionFound)
robot_mesh = Mesh(split_list.ListA)
tool_mesh = Mesh(split_list.ListB)
curve_11 = Curve(simple_trail)
integer = Integer(program_simulation.Index)
plane_11 = Plane(program_simulation.Plane)
number_15 = Number(program_simulation.JointRotations)

# ----
number_16 = Number(number_15)
degrees = Degrees(Radians=number_16)
axes_positions = Panel(degrees)

# ---- group: Robot Simulation (continued)
tool_mesh_2 = Mesh(tool_mesh)
simulation_robot_trail = Curve(curve_11)
simulatied_robot_mesh = Mesh(robot_mesh)

# ----
preview = CustomPreview(Geometry=simulatied_robot_mesh, Shader=ColourSwatch(SwatchColor=RGB(158, 158, 158)))
preview_2 = CustomPreview(Geometry=tool_mesh_2, Shader=ColourSwatch(SwatchColor=RGBA(0, 178, 255, 173)))

plane_12 = Plane(plane_4)
plane_13 = Plane(plane_11)

list_item_5 = ListItem(List=plane_13, Index=-1, Wrap=True)
orient_2 = Orient(Source=plane_12, Target=list_item_5)  # -> Geometry, Transform

transform_2 = Transform(orient_2.Transform)

transform_3 = Transform(transform_2)
curve_12 = Curve(stream_filter)
transform_4 = Transform(Geometry=curve_12, Transform=transform_3)
curve_13 = Curve(transform_4)

# ---- group: Robot Simulation (continued)
curve_in_position = Curve(curve_13)

# ----
preview_3 = CustomPreview(Geometry=curve_in_position, Shader=ColourSwatch(SwatchColor=RGBA(255, 0, 0, 108)))

point_9 = Point(plane_3)
simulation_index = Integer(integer)
transform_5 = Transform(transform_2)

split_list_2 = SplitList(List=point_9, Index=simulation_index)  # -> ListA, ListB
point_10 = Point(split_list_2.ListA)
interpolate_6 = Interpolate(Vertices=point_10, Degree=3, Periodic=False, KnotStyle=1)  # -> Curve, Length, Domain
pipe = Pipe(Curve=interpolate_6.Curve, Radius=Slider(1.93, range=0..10), Caps=2)
transform_6 = Transform(Geometry=pipe, Transform=transform_5)

custom_preview_lineweights = CustomPreviewLineweights(
    Geometry=transform_6,
    Shader={diffuse=RGB(255, 105, 180), emission=RGB(76, 32, 54), shine=0.5, specular=RGB(255, 255, 255), transparency=0},
    Thickness=number_slider_2,
    Absolute=False)  # disabled

brep_14 = Brep(transform_6)

# ---- group: Robot Simulation (continued)
extrusion_brep = Brep(brep_14)

# ----
preview_4 = CustomPreview(Geometry=extrusion_brep, Shader=ColourSwatch(SwatchColor=RGB(255, 31, 31)))

# ==== cluster PenHolderMesh
number = ClusterInput()
number_2 = ClusterInput()
number_3 = ClusterInput()
number_4 = Number(number)
number_5 = Number(number_2)
number_6 = Number(number_3)
subtraction = Subtraction(A=number_4, B=number_5)
unit_z = UnitZ(Factor=subtraction)
unit_z_2 = UnitZ(Factor=number_4)
circle = Circle(Plane=PlaneXY(0, 0, 0), Radius=number_6)
extrude = Extrude(Base=circle, Direction=unit_z)
construct_point = ConstructPoint(XCoordinate=0, YCoordinate=0, ZCoordinate=unit_z_2)
move = Move(Geometry=circle, Motion=unit_z)  # -> Geometry, Transform
extrude_point = ExtrudePoint(Base=move.Geometry, Point=construct_point)
merge = Merge(Data1=extrude_point, Data2=extrude)
mesh_brep = MeshBrep(
    Brep=merge,
    Settings={GridMaxCount=0, GridMinCount=16, JaggedSeams=False, MaxEdgeLength=0, MinEdgeLength=0.0001, MinTolerance=0, Refine=True, RefineAngle=0, RelativeTolerance=0.65, SimplePlanes=True, Tolerance=0})
brep = Brep([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])
mesh = Mesh(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)
merge_2 = Merge(Data1=mesh, Data2=mesh_brep)
mesh_join = MeshJoin(Meshes=merge_2)
mesh_2 = Mesh(mesh_join)
mesh_3 = ClusterOutput(mesh_2)
