# Grasshopper definition Surface Winding 001 [May-26 '19, 1536].gh (Grasshopper 1.0.7)
# plug-ins: Robots, Human

diameters = Panel("""135
130
122
121
110""")
offset = Panel("0")
heights = Panel("""0
20
180
183
183""")
subtraction = Subtraction(A=heights, B=offset)
number = Number(subtraction)
number_2 = Number(diameters)
number_slider = Slider(1, range=0..1)
sphere_size = Slider(525.355, range=0..1000)
sphere_radius = Number(sphere_size)

# ---- group: What ??
number_slider_2 = Slider(3, range=0..10)
division = Division(A="360", B=number_slider_2)
series = Series(Start=0, Step=division, Count=number_slider_2)

# ----
radians = Radians(Degrees=series)
yz_plane = YZPlane(Origin=Point(0, 0, 0))
rotate_3d = Rotate3D(Geometry=yz_plane, Angle=radians, Center=Point(0, 0, 0), Axis=Vector(0, 0, 1))  # -> Geometry, Transform

xz_plane = XZPlane(Origin=Point(0, 0, 0))

plane = Plane(rotate_3d.Geometry)

sphere_radius_2 = Number(sphere_radius)
brep_curve = BrepCurve()  # -> Curves, Points
integer = Integer(Slider(38, range=1..200))
integer_2 = Integer(Slider(104, range=1..200))
division_2 = Division(A=sphere_radius_2, B=integer)

# ---- group: Create curve on projection sphere
xz_plane_2 = XZPlane(Origin=Point(0, 0, 0))
number_slider_3 = Slider(245.485, range=0..720)

# ----
radial = Radial(Plane=PlaneXY(0, 0, 0), Size=division_2, ExtentR=integer, ExtentP=integer_2)  # -> Cells, Points
point = Point(radial.Points)
cull_duplicates = CullDuplicates(Points=point, Tolerance=0.1, CullMode=3)  # -> Points, Indices, Valence
xy_plane = XYPlane(Origin=Point(0, 0, 0))
line_sdl = LineSDL(Start=cull_duplicates.Points, Direction=Vector(0, 0, 1), Length=expr("x+10", sphere_radius_2))
line_sdl_2 = LineSDL(Start=xy_plane, Direction=Vector(0, 0, 1), Length=expr("x+10", sphere_radius_2))
divide_length = DivideLength()  # -> Points, Tangents, Parameters
number_slider_4 = Slider(122.5, range=-1000..1000)
number_slider_5 = Slider(13.842, range=0..20)  # disabled

# ---- group: Robot Simulation
simulation_control = ControlKnob(Decimals=6, Limit=True, Maximum=1, Minimum=0, Range=0.1, Value=0)
trail_length = Slider(6847, range=0..10000)
number_3 = Number(simulation_control)

# ----
number_4 = Number(number)
number_5 = Number(number_2)

point_2 = ConstructPoint(XCoordinate=0, YCoordinate=0, ZCoordinate=number_4)
division_3 = Division(A=number_5, B=2)
loft_options = LoftOptions(Closed=False, Adjust=False, Rebuild=0, Refit=0, Type=3)
circle = Circle(Plane=point_2, Radius=division_3)
loft = Loft(Curves=circle, Options=loft_options)
fillet_edge = FilletEdge(Shape=loft, Blend=0, Metric=0, Edges=Slider(8, range=0..10), Radii=Slider(2.941, range=0..10))
last = Panel("-1")
list_item = ListItem(List=number_4, Index=last, Wrap=True)

brep = Brep(loft)
list_item_2 = ListItem(List=circle, Index=last, Wrap=True)
boundary_surfaces = BoundarySurfaces(Edges=list_item_2)
merge = Merge(Data1=fillet_edge, Data2=boundary_surfaces)
brep_join = BrepJoin(Breps=merge)  # -> Breps, Closed

brep_2 = Brep(brep_join.Breps)
height = Number(list_item)

height_2 = Number(height)
vector_xyz = VectorXYZ(XComponent=0, YComponent=0, ZComponent=height_2)  # -> Vector, Length
circle_2 = Circle(Plane=vector_xyz.Vector, Radius=Slider(36.934, range=0..100))
curve = Curve(circle_2)

brep_3 = Brep(brep_2)
number_6 = Number(height)
addition = Addition(A=number_slider_4, B=number_6)

# ---- group: Upload to Robot
robot_ip_adress = Panel("192.168.178.22")
upload = Button()
pause = Button()
play = Button()
boolean = Boolean(play)
boolean_2 = Boolean(upload)
boolean_3 = Boolean(pause)

# ---- group: Lower boundary
lowest_point = Slider(57.606, range=0..200)
brep_4 = Brep(brep_2)
number_7 = Number(lowest_point)

construct_point = ConstructPoint(XCoordinate=0, YCoordinate=0, ZCoordinate=number_7)
xy_plane_2 = XYPlane(Origin=construct_point)
brep_plane = BrepPlane(Brep=brep_4, Plane=xy_plane_2)  # -> Curves, Points

plane_2 = Plane(xy_plane_2)
curve_2 = Curve(brep_plane.Curves)

# ----
number_8 = Number(height)
brep_5 = Brep(brep_2)

subtraction_2 = Subtraction(A=number_8, B=0.01)
construct_domain = ConstructDomain(DomainStart=Slider(28.045, range=0..40), DomainEnd=subtraction_2)
range = Range(Domain=construct_domain, Steps=Slider(7, range=1..30))
construct_point_2 = ConstructPoint(XCoordinate=0, YCoordinate=0, ZCoordinate=range)
xy_plane_3 = XYPlane(Origin=construct_point_2)
brep_plane_2 = BrepPlane(Brep=brep_5, Plane=xy_plane_3)  # -> Curves, Points

curve_3 = Curve(brep_plane_2.Curves)

# ---- group: Projection sphere
sphere_radius_3 = Number(sphere_radius)
plane_3 = Plane(plane_2)
curve_4 = Curve(curve_2)

divide_curve = DivideCurve(Curve=curve_4, Count=10, Kinks=False)  # -> Points, Tangents, Parameters
xy_plane_4 = XYPlane(Origin=plane_3)
line = Line(StartPoint=xy_plane_4, EndPoint=divide_curve.Points)
extend_curve = ExtendCurve(Curve=line, Type=0, Start="0", End=Slider(659.077, range=0..1000))
loft_options_2 = LoftOptions(Closed=True, Adjust=False, Rebuild=0, Refit=0, Type=0)
sphere = Sphere(Base=PlaneXY(0, 0, 0), Radius=sphere_radius_3)
loft_2 = Loft(Curves=extend_curve, Options=loft_options_2)
split_brep = SplitBrep(Brep=sphere, Cutter=loft_2)
list_item_3 = ListItem(List=split_brep, Index=0, Wrap=True)  # -> Item, Item1

surface = Surface(list_item_3.Item)
surface_2 = Surface(list_item_3.Item1)

# ----
brep_6 = Brep(surface)
brep_curve_2 = BrepCurve(Brep=brep_6, Curve=line_sdl)  # -> Curves, Points
brep_closest_point = BrepClosestPoint(Point=brep_curve_2.Points, Brep=brep_6)  # -> Point, Normal, Distance
curve_closest_point = CurveClosestPoint(Point=brep_closest_point.Point, Curve=line_sdl_2)  # -> Point, Parameter, Distance
plane_normal = PlaneNormal(Origin=brep_closest_point.Point, ZAxis=brep_closest_point.Normal)
vector_2pt = Vector2Pt(PointA=brep_closest_point.Point, PointB=curve_closest_point.Point, Unitize=False)  # -> Vector, Length
align_plane = AlignPlane(Plane=plane_normal, Direction=vector_2pt.Vector)  # -> Plane, Angle

number_9 = Number(Slider(168.732, range=0..720))
brep_7 = Brep(surface)
plane_4 = Plane(plane)
radians_2 = Radians(Degrees=number_9)

# ---- group: Create Interpolation Zone
number_slider_6 = Slider(1629.424, range=0..3000)
number_slider_7 = Slider(47.916, range=0..500)
brep_8 = Brep(surface)

unit_z = UnitZ(Factor=number_slider_6)
circle_3 = Circle(Plane=PlaneXY(0, 0, 0), Radius=number_slider_7)
extrude = Extrude(Base=circle_3, Direction=unit_z)
split_brep_2 = SplitBrep(Brep=brep_8, Cutter=extrude)
cap_holes = CapHoles(Brep=extrude)
list_item_4 = ListItem(List=split_brep_2, Index=0, Wrap=True)  # -> Item, Item1

interpolation_zone = Brep(list_item_4.Item)
brep_9 = Brep(cap_holes)
normal_zone = Brep(list_item_4.Item1)
brep_10 = Brep(split_brep_2)

# ----
cap_holes_2 = CapHoles(Brep=extrude)

brep_plane_3 = BrepPlane(Brep=brep_7, Plane=plane_4)  # -> Curves, Points
divide_curve_2 = DivideCurve(Curve=brep_plane_3.Curves, Count=10, Kinks=False)  # -> Points, Tangents, Parameters

brep_11 = Brep(surface)
plane_5 = Plane(xz_plane)
radians_3 = Radians(Degrees=Slider(245.485, range=0..720))

brep_plane_4 = BrepPlane(Brep=brep_11, Plane=plane_5)  # -> Curves, Points
divide_curve_3 = DivideCurve(Curve=brep_plane_4.Curves, Count=10, Kinks=False)  # -> Points, Tangents, Parameters
boolean_toggle = BooleanToggle(False)
point_3 = Point(flatten(divide_curve_3.Points))
interpolate = Interpolate(Vertices=point_3, Degree=3, Periodic=boolean_toggle, KnotStyle=1)  # -> Curve, Length, Domain

rotate = Rotate(Geometry=interpolate.Curve, Angle=radians_3, Plane=PlaneXY(0, 0, 0))  # -> Geometry, Transform
curve_5 = Curve(rotate.Geometry)

panel = Panel("""0
-1""")
list_item_5 = ListItem(List=divide_curve_2.Points, Index=panel, Wrap=True)
cull_index = CullIndex(List=divide_curve_2.Points, Indices=panel, Wrap=True)
construct_point_3 = ConstructPoint(XCoordinate=0, YCoordinate=0, ZCoordinate=height)
xy_plane_5 = XYPlane(Origin=construct_point_3)

point_4 = Point(flatten(cull_index))
interpolate_2 = Interpolate(Vertices=point_4, Degree=3, Periodic=True, KnotStyle=1)  # -> Curve, Length, Domain

rotate_2 = Rotate(Geometry=interpolate_2.Curve, Angle=radians_2, Plane=PlaneXY(0, 0, 0))  # -> Geometry, Transform
curve_6 = Curve(rotate_2.Geometry)

curve_7 = Curve(curve_6)
brep_12 = Brep(brep_2)

divide_length_2 = DivideLength(Curve=curve_7, Length=Slider(65.6, range=10..100))  # -> Points, Tangents, Parameters
xy_plane_6 = XYPlane(Origin=Point(0, 0, 0))
loft_options_3 = LoftOptions(Closed=True, Adjust=False, Rebuild=0, Refit=0, Type=0)
line_2 = Line(StartPoint=xy_plane_6, EndPoint=divide_length_2.Points)
loft_3 = Loft(Curves=line_2, Options=loft_options_3)
brep_brep = BrepBrep(BrepA=brep_12, BrepB=loft_3)  # -> Curves, Points

curve_8 = Curve(brep_brep.Curves)

# ---- group: Create curve on projection sphere
brep_13 = Brep(surface)
plane_6 = Plane(xz_plane_2)
radians_4 = Radians(Degrees=number_slider_3)

brep_plane_5 = BrepPlane(Brep=brep_13, Plane=plane_6)  # -> Curves, Points
divide_curve_4 = DivideCurve(Curve=brep_plane_5.Curves, Count=10, Kinks=False)  # -> Points, Tangents, Parameters
point_5 = Point(flatten(divide_curve_4.Points))
interpolate_3 = Interpolate(Vertices=point_5, Degree=3, Periodic=Toggle(False), KnotStyle=1)  # -> Curve, Length, Domain

rotate_3 = Rotate(Geometry=interpolate_3.Curve, Angle=radians_4, Plane=PlaneXY(0, 0, 0))  # -> Geometry, Transform
curve_9 = Curve(rotate_3.Geometry)

# ----
curve_10 = Curve(curve_9)
multiple_curves = MultipleCurves(Curves=curve_10)  # -> Points, IndexA, IndexB, ParamA, ParamB
trim_with_brep = TrimWithBrep(Curve=curve_10, Brep=cap_holes_2)  # -> Inside, Outside
split_with_brep = SplitWithBrep(Curve=curve_10, Brep=extrude)  # -> Curve, Points

curve_11 = Curve(curve_5)
brep_14 = Brep(brep_2)

divide_length_3 = DivideLength(Curve=curve_11, Length=Slider(65.6, range=10..100))  # -> Points, Tangents, Parameters
xy_plane_7 = XYPlane(Origin=Point(0, 0, 0))
loft_options_4 = LoftOptions(Closed=boolean_toggle, Adjust=False, Rebuild=0, Refit=0, Type=0)
line_3 = Line(StartPoint=xy_plane_7, EndPoint=divide_length_3.Points)
loft_4 = Loft(Curves=line_3, Options=loft_options_4)
brep_brep_2 = BrepBrep(BrepA=brep_14, BrepB=loft_4)  # -> Curves, Points

curve_12 = Curve(brep_brep_2.Curves)

# ---- group: Lower boundary
lowest_point_2 = Slider(151.854, range=0..200)
brep_15 = Brep(brep_2)
number_10 = Number(lowest_point_2)
radians_5 = Radians(Degrees=Slider(37.406, range=0..720))

construct_point_4 = ConstructPoint(XCoordinate=0, YCoordinate=0, ZCoordinate=number_10)
xy_plane_8 = XYPlane(Origin=construct_point_4)
brep_plane_6 = BrepPlane(Brep=brep_15, Plane=xy_plane_8)  # -> Curves, Points

rotate_4 = Rotate(Geometry=brep_plane_6.Curves, Angle=radians_5, Plane=PlaneXY(0, 0, 0))  # -> Geometry, Transform
curve_13 = Curve(rotate_4.Geometry)

# ----
curve_14 = Curve(curve_9)
brep_16 = Brep(brep_2)

divide_length_4 = DivideLength(Curve=curve_14, Length=Slider(65.6, range=10..100))  # -> Points, Tangents, Parameters
loft_options_5 = LoftOptions(Closed=False, Adjust=False, Rebuild=0, Refit=0, Type=0)
line_4 = Line(StartPoint=plane_2, EndPoint=divide_length_4.Points)
loft_5 = Loft(Curves=line_4, Options=loft_options_5)
brep_brep_3 = BrepBrep(BrepA=brep_16, BrepB=loft_5)  # -> Curves, Points

curve_15 = Curve(brep_brep_3.Curves)

stream_filter = StreamFilter(Gate=Slider(3, range=0..3), Stream0=curve, Stream1=curve_13, Stream2=curve_12, Stream3=curve_8)

# ---- group: Divide Curve
distance_between_planes = Slider(5.171, range=0..10)
curve_16 = Curve(reparameterize(curve_15))

length = Length(Curve=curve_16)
division_4 = Division(A=length, B=distance_between_planes)
divide_curve_5 = DivideCurve(Curve=curve_16, Count=division_4, Kinks=False)  # -> Points, Tangents, Parameters

point_6 = Point(divide_curve_5.Points)

# ----
curve_17 = Curve(stream_filter)
brep_17 = Brep(brep_2)

divide_length_5 = DivideLength(Curve=curve_17, Length=Slider(3.594, range=1..10))  # -> Points, Tangents, Parameters
brep_closest_point_2 = BrepClosestPoint(Point=divide_length_5.Points, Brep=brep_17)  # -> Point, Normal, Distance
unit_z_2 = UnitZ(Factor=1)
plane_normal_2 = PlaneNormal(Origin=brep_closest_point_2.Point, ZAxis=brep_closest_point_2.Normal)
align_plane_2 = AlignPlane(Plane=plane_normal_2, Direction=unit_z_2)  # -> Plane, Angle
flip_plane = FlipPlane(Plane=align_plane_2.Plane, ReverseX=False, ReverseY=False, SwapAxes=True)

plane_7 = Plane(flip_plane)

list_item_6 = ListItem(List=plane_7, Index=Slider(0, range=0..200), Wrap=True)
plane_8 = Plane(plane_7)

# ---- group: Create Planes on Projection Sphere
plane_9 = Plane(plane_2)
point_7 = Point(point_6)
brep_18 = Brep(surface)

vector_2pt_2 = Vector2Pt(PointA=plane_9, PointB=point_7, Unitize=False)  # -> Vector, Length
project_point = ProjectPoint(Point=point_7, Direction=vector_2pt_2.Vector, Geometry=brep_18)  # -> Point, Index
brep_closest_point_3 = BrepClosestPoint(Point=project_point.Point, Brep=brep_18)  # -> Point, Normal, Distance
plane_normal_3 = PlaneNormal(Origin=brep_closest_point_3.Point, ZAxis=brep_closest_point_3.Normal)

plane_10 = Plane(plane_normal_3)

# ---- group: Align Planes on Projection Sphere
sphere_radius_4 = Number(sphere_radius)
plane_11 = Plane(plane_10)

xy_plane_9 = XYPlane(Origin=Point(0, 0, 0))
line_sdl_3 = LineSDL(Start=xy_plane_9, Direction=Vector(0, 0, 1), Length=expr("x+10", sphere_radius_4))
curve_closest_point_2 = CurveClosestPoint(Point=plane_11, Curve=line_sdl_3)  # -> Point, Parameter, Distance
vector_2pt_3 = Vector2Pt(PointA=plane_11, PointB=curve_closest_point_2.Point, Unitize=False)  # -> Vector, Length
align_plane_3 = AlignPlane(Plane=plane_11, Direction=vector_2pt_3.Vector)  # -> Plane, Angle

plane_12 = Plane(align_plane_3.Plane)

# ----
plane_13 = Plane(plane_12)
brep_19 = Brep(brep_9)

point_in_brep = PointInBrep(Brep=brep_19, Point=plane_13, Strict=False)
boolean_4 = Boolean(point_in_brep)
list_length = ListLength(List=boolean_4)
shift_list = ShiftList(List=boolean_4, Shift=1, Wrap=True)
equality = Equality(FirstNumber=boolean_4, SecondNumber=shift_list)  # -> Equality, Inequality
series_2 = Series(Start=0, Step=1, Count=list_length)
subtraction_3 = Subtraction(A=list_length, B=1)
panel_2 = Panel(subtraction_3)
cull_pattern = CullPattern(List=series_2, CullPattern=equality.Inequality)
first_index = Panel("0")
merge_2 = Merge(Data1=flatten(first_index), Data2=flatten(cull_pattern))
merge_3 = Merge(Data1=flatten(cull_pattern), Data2=flatten(panel_2))
construct_domain_2 = ConstructDomain(DomainStart=merge_2, DomainEnd=merge_3)
sub_list = SubList(List=boolean_4, Domain=construct_domain_2, Wrap=True)  # -> List, Index
sub_list_2 = SubList(List=plane_13, Domain=construct_domain_2, Wrap=True)  # -> List, Index
_2nd_index = Panel("1")
list_item_7 = ListItem(List=sub_list.List, Index=_2nd_index, Wrap=True)
cull_pattern_2 = CullPattern(List=sub_list_2.List, CullPattern=list_item_7)
clean_tree = CleanTree(RemoveNulls=True, RemoveInvalid=True, RemoveEmpty=True, Tree=cull_pattern_2)

domain_of_indices_to_split_the_list_of_p = Domain(construct_domain_2)  # "Domain of indices to split the list of planes"
projection_sphere_planes_to_interpolate = Plane(clean_tree)
boolean_if_branch_will_be_interpolated = Boolean(list_item_7)
projection_sphere_planes = Plane(sub_list_2.List)

# ---- group: Consecutively rotate interpolation planes
plane_14 = Plane(projection_sphere_planes_to_interpolate)

first_and_last_index = Panel("""0
-1""")
first_index_2 = Panel("0")
list_length_2 = ListLength(List=plane_14)
list_item_8 = ListItem(List=plane_14, Index=first_index_2, Wrap=True)  # -> Item1, Item
list_item_9 = ListItem(List=plane_14, Index=first_and_last_index, Wrap=True)
subtraction_4 = Subtraction(A=list_length_2, B="1")
vector_2pt_4 = Vector2Pt(PointA=list_item_8.Item, PointB=list_item_8.Item1, Unitize=False)  # -> Vector, Length
deconstruct_plane = DeconstructPlane(Plane=list_item_9)  # -> Origin, XAxis, YAxis, ZAxis
xy_plane_10 = XYPlane(Origin=Point(0, 0, 0))
list_item_10 = ListItem(List=deconstruct_plane.XAxis, Index=0, Wrap=True)  # -> Item, Item1
align_plane_4 = AlignPlane(Plane=plane_14, Direction=vector_2pt_4.Vector)  # -> Plane, Angle
angle = Angle(VectorA=list_item_10.Item, VectorB=list_item_10.Item1, Plane=xy_plane_10)  # -> Angle, Reflex
construct_domain_3 = ConstructDomain(DomainStart="0", DomainEnd=angle.Angle)
range_2 = Range(Domain=construct_domain_3, Steps=subtraction_4)
rotate_plane = RotatePlane(Plane=align_plane_4.Plane, Angle=range_2)

plane_15 = Plane(rotate_plane)

# ---- group: Replace the original planes in the interpolation zone with interpolated ones
projection_sphere_planes_2 = Plane(projection_sphere_planes)
boolean_if_branch_will_be_interpolated_2 = Boolean(boolean_if_branch_will_be_interpolated)
plane_16 = Plane(plane_15)

cull_pattern_3 = CullPattern(List=projection_sphere_planes_2, CullPattern=invert(boolean_if_branch_will_be_interpolated_2))
clean_tree_2 = CleanTree(RemoveNulls=True, RemoveInvalid=True, RemoveEmpty=True, Tree=cull_pattern_3)
trim_tree = TrimTree(Tree=plane_16, Depth=1)
merge_4 = Merge(Data1=trim_tree, Data2=clean_tree_2)

plane_17 = Plane(merge_4)

# ---- group: Create planes on form brep
# Comment: Creates Planes on the form Brep and also orders them by weather or not they will be interpolated
domain_of_indices_to_split_the_list_of_p_2 = Domain(domain_of_indices_to_split_the_list_of_p)  # "Domain of indices to split the list of planes"
brep_20 = Brep(brep_3)
point_8 = Point(point_6)

brep_closest_point_4 = BrepClosestPoint(Point=point_8, Brep=brep_20)  # -> Point, Normal, Distance
plane_normal_4 = PlaneNormal(Origin=brep_closest_point_4.Point, ZAxis=brep_closest_point_4.Normal)
sub_list_3 = SubList(List=plane_normal_4, Domain=domain_of_indices_to_split_the_list_of_p_2, Wrap=True)  # -> List, Index

plane_18 = Plane(sub_list_3.List)

# ---- group: Align planes on form brep with those on the projection sphere
plane_19 = Plane(plane_17)
plane_20 = Plane(plane_18)

align_planes = AlignPlanes(Planes=graft(plane_20), Master=graft(plane_19))
cull_duplicates_2 = CullDuplicates(Points=flatten(align_planes), Tolerance=0.1, CullMode=1)  # -> Points, Indices, Valence
reverse_x = BooleanToggle(True)
reverse_y = BooleanToggle(True)
swap_axes = BooleanToggle(True)
list_item_11 = ListItem(List=flatten(align_planes), Index=cull_duplicates_2.Indices, Wrap=True)
flip_plane_2 = FlipPlane(Plane=list_item_11, ReverseX=reverse_x, ReverseY=reverse_y, SwapAxes=swap_axes)

plane_21 = Plane(flip_plane_2)

# ---- group: Create Form TCP and Mesh
brep_21 = Brep(brep_2)
number_11 = Number(height)

pen_sharpness = Slider(15.94, range=0..50)
pen_thickness = Slider(5.3, range=0..100)
cap_holes_3 = CapHoles(Brep=brep_21)
point_9 = ConstructPoint(XCoordinate=0, YCoordinate=0, ZCoordinate=number_11)
xy_plane_11 = XYPlane(Origin=point_9)
number_12 = Number(pen_sharpness)
number_13 = Number(pen_thickness)
plane_22 = Plane(xy_plane_11)
mesh = Mesh(cap_holes_3)
pen_holder_mesh = PenHolderMesh(number_3=number_13, number=number_11, number_2=number_12)
create_tool = CreateTool(Name="DefaultGHTool", TCP=plane_22, Weight=0, Mesh=mesh)  # -> Tool, TCP

tool_parameter = ToolParameter(create_tool.Tool)
tcp_plane = Plane(plane_22)

# ---- group: Extruder nozzle position
number_slider_8 = Slider(19.5, range=-1000..1000)

construct_point_5 = ConstructPoint(XCoordinate=number_slider_8, YCoordinate=Slider(612.8, range=0..1000), ZCoordinate=number_slider_4)
xy_plane_12 = XYPlane(Origin=construct_point_5)

plane_23 = Plane(xy_plane_12)

# ---- group: Extruder position visualisation
number_slider_9 = Slider(69.678, range=0..100)
unit_z_3 = UnitZ(Factor=number_slider_9)
move = Move(Geometry=plane_23, Motion=unit_z_3)  # -> Geometry, Transform
cone = Cone(Base=move.Geometry, Radius=Slider(25.219, range=0..100), Length=expr("-x", number_slider_9))  # -> Cone, Tip
brep_22 = Brep(cone.Cone)

# ----
extruder_tip = Brep(brep_22)

# ---- group: Convert planes to TCP position
plane_24 = Plane(tcp_plane)
plane_25 = Plane(plane_21)
plane_26 = Plane(plane_23)
orient = Orient(Geometry=plane_24, Source=plane_25, Target=plane_26)  # -> Geometry, Transform
plane_27 = Plane(orient.Geometry)
transform = Transform(orient.Transform)

# ----
curve_18 = Curve(curve_15)
brep_23 = Brep(brep_2)

divide_length_6 = DivideLength(Curve=curve_18, Length=Slider(3.594, range=1..10))  # -> Points, Tangents, Parameters
brep_closest_point_5 = BrepClosestPoint(Point=divide_length_6.Points, Brep=brep_23)  # -> Point, Normal, Distance
unit_z_4 = UnitZ(Factor=1)
plane_normal_5 = PlaneNormal(Origin=brep_closest_point_5.Point, ZAxis=brep_closest_point_5.Normal)
align_plane_5 = AlignPlane(Plane=plane_normal_5, Direction=unit_z_4)  # -> Plane, Angle
flip_plane_3 = FlipPlane(Plane=align_plane_5.Plane, ReverseX=False, ReverseY=False, SwapAxes=True)

plane_28 = Plane(flip_plane_3)

number_slider_10 = Slider(65.6, range=10..100)
curve_19 = Curve(trim_with_brep.Outside)
curve_20 = Curve(trim_with_brep.Inside)
merge_5 = Merge(Data1=curve_20, Data2=curve_19)
curve_21 = Curve(merge_5)
brep_24 = Brep(brep_2)
length_2 = Length(Curve=curve_21)
division_5 = Division(A=length_2, B=number_slider_10)

divide_length_7 = DivideLength(Curve=reparameterize(curve_21), Length=number_slider_10)  # -> Points, Tangents, Parameters
xy_plane_13 = XYPlane(Origin=Point(0, 0, 0))
divide_curve_6 = DivideCurve(Curve=curve_21, Count=division_5, Kinks=False)  # -> Points, Tangents, Parameters
loft_options_6 = LoftOptions(Closed=False, Adjust=False, Rebuild=0, Refit=0, Type=0)
line_5 = Line(StartPoint=xy_plane_13, EndPoint=divide_curve_6.Points)
shatter = Shatter(Curve=reparameterize(graft(curve_21)), Parameters=divide_length_7.Parameters)
loft_6 = Loft(Curves=line_5, Options=loft_options_6)
end_points = EndPoints(Curve=shatter)  # -> Start, End
brep_brep_4 = BrepBrep(BrepA=brep_24, BrepB=loft_6)  # -> Curves, Points

curve_22 = Curve(brep_brep_4.Curves)

# ---- group: Create Robot Program
list = ValueList({"Bartlett-IRB120", "Bartlett-IRB1600", "Bartlett-KR6", "Bartlett-KR60", "Bartlett-UR10", "BURG Halle-UR5", "BURG Halle-UR5 on table", "KULeuven-IRB120", "KULeuven-UR5", "KULeuven-UR10"}, selected="BURG Halle-UR5")
list_2 = FlagFields({"Shoulder": 1, "Elbow": 2, "Wrist": 4}, selected=["Shoulder", "Wrist"])
list_3 = ValueList({"Joint", "Linear"}, selected="Linear")
plane_29 = Plane(plane_27)
tool_parameter_2 = ToolParameter(tool_parameter)
zone_soft_radius = Number("5")
speed = Number(Slider(71, range=0..100))

load_robot_system = LoadRobotSystem(Name=list, Base=PlaneXY(0, 0, 0))
create_target = CreateTarget(
    Plane=flatten(plane_29),
    RobConf=list_2,
    Motion=list_3,
    Tool=tool_parameter_2,
    Speed=speed,
    Zone=zone_soft_radius,
    IsCartesian=True)
create_program = CreateProgram(Name="DefaultProgram", RobotSystem=load_robot_system, Targets1=create_target, StepSize=Slider(0.25, range=0..1))  # -> Program, Code, Duration, Warnings, Errors

program_parameter = ProgramParameter(create_program.Program)
text = Text(create_program.Code)
number_14 = Number(create_program.Duration)
text_2 = Text(create_program.Warnings)
text_3 = Text(create_program.Errors)

# ---- group: Program Code and Errors
program = Panel(program_parameter)
warnings = Panel(text_2)
errors = Panel(text_3)
program_code = Panel(text)

# ----
boolean_5 = Boolean(boolean_3)
ip_adress = Text(robot_ip_adress)
boolean_6 = Boolean(boolean_2)
boolean_7 = Boolean(boolean)
remote_connection = RemoteConnection(Program=program_parameter, IP=ip_adress, Upload=boolean_6, Play=boolean_7, Pause=boolean_5)
text_4 = Text(remote_connection)
data_recorder = DataRecorder(text_4, DataLimit=-10, RecordData=True)

# ---- group: Upload to Robot (continued)
text_5 = Text(data_recorder)
log = Panel(text_5)

# ---- group: Length of the program
list_length_3 = ListLength(List=text)
commands = Panel(list_length_3)

# ---- group: Robot Simulation
number_15 = Number(trail_length)
number_16 = Number(number_3)

program_simulation = ProgramSimulation(Program=program_parameter, Time=number_16, Normalized=True)  # -> SystemMeshes, JointRotations, Plane, Index, Time, Program, Errors
check_collisions = CheckCollisions(
    Program=program_simulation.Program,
    FirstSet=7,
    SecondSet=4,
    EnvironmentPlane=-1,
    LinearStepSize=100,
    AngularStepSize=0.7853981634)  # -> CollisionFound, TargetIndex, CollidedMeshes
simple_trail = SimpleTrail(Program=program_simulation.Program, Length=number_15, MechanicalGroup=0)
split_list = SplitList(List=program_simulation.SystemMeshes, Index=7)  # -> ListA, ListB

colliding_meshes_mesh = Mesh(check_collisions.CollidedMeshes)
collisions = Panel(check_collisions.CollisionFound)
robot_mesh = Mesh(split_list.ListA)
tool_mesh = Mesh(split_list.ListB)
curve_23 = Curve(simple_trail)
plane_30 = Plane(program_simulation.Plane)
integer_3 = Integer(program_simulation.Index)
number_17 = Number(program_simulation.JointRotations)

# ----
number_18 = Number(number_17)
degrees = Degrees(Radians=number_18)
axes_positions = Panel(degrees)

# ---- group: Robot Simulation (continued)
tool_mesh_2 = Mesh(tool_mesh)
simulatied_robot_mesh = Mesh(robot_mesh)
simulation_robot_trail = Curve(curve_23)

# ----
preview = CustomPreview(Geometry=simulatied_robot_mesh, Shader=ColourSwatch(SwatchColor=RGB(158, 158, 158)))
preview_2 = CustomPreview(Geometry=tool_mesh_2, Shader=ColourSwatch(SwatchColor=RGBA(0, 178, 255, 173)))

plane_31 = Plane(plane_30)
plane_32 = Plane(tcp_plane)

list_item_12 = ListItem(List=plane_31, Index=-1, Wrap=True)
orient_2 = Orient(Source=plane_32, Target=list_item_12)  # -> Geometry, Transform

transform_2 = Transform(orient_2.Transform)

# ---- group: Move Curve according to TCP position
transform_3 = Transform(transform_2)
curve_24 = Curve(curve_15)
transform_4 = Transform(Geometry=curve_24, Transform=transform_3)
curve_25 = Curve(transform_4)

# ---- group: Robot Simulation (continued)
curve_in_position = Curve(curve_25)

# ----
preview_3 = CustomPreview(Geometry=curve_in_position, Shader=ColourSwatch(SwatchColor=RGBA(255, 0, 0, 108)))

# ---- group: Create extrusion simulation
simulation_index = Integer(integer_3)
point_10 = Point(point_6)
transform_5 = Transform(transform_2)

split_list_2 = SplitList(List=point_10, Index=simulation_index)  # -> ListA, ListB
point_11 = Point(split_list_2.ListA)
interpolate_4 = Interpolate(Vertices=point_11, Degree=3, Periodic=False, KnotStyle=1)  # -> Curve, Length, Domain
pipe = Pipe(Curve=interpolate_4.Curve, Radius=Slider(1.93, range=0..10), Caps=2)
transform_6 = Transform(Geometry=pipe, Transform=transform_5)

# ----
custom_preview_lineweights = CustomPreviewLineweights(
    Geometry=transform_6,
    Shader={diffuse=RGB(255, 105, 180), emission=RGB(76, 32, 54), shine=0.5, specular=RGB(255, 255, 255), transparency=0},
    Thickness=number_slider_5,
    Absolute=False)  # disabled

# ---- group: Create extrusion simulation (continued)
brep_25 = Brep(transform_6)

# ---- group: Robot Simulation (continued)
extrusion_brep = Brep(brep_25)

# ----
preview_4 = CustomPreview(Geometry=extrusion_brep, Shader=ColourSwatch(SwatchColor=RGB(255, 31, 31)))

# ==== cluster PenHolderMesh
number = ClusterInput()
number_2 = ClusterInput()
number_3 = ClusterInput()
number_4 = Number(number)
number_5 = Number(number_2)
number_6 = Number(number_3)
subtraction = Subtraction(A=number_4, B=number_5)
unit_z = UnitZ(Factor=subtraction)
unit_z_2 = UnitZ(Factor=number_4)
circle = Circle(Plane=PlaneXY(0, 0, 0), Radius=number_6)
extrude = Extrude(Base=circle, Direction=unit_z)
construct_point = ConstructPoint(XCoordinate=0, YCoordinate=0, ZCoordinate=unit_z_2)
move = Move(Geometry=circle, Motion=unit_z)  # -> Geometry, Transform
extrude_point = ExtrudePoint(Base=move.Geometry, Point=construct_point)
merge = Merge(Data1=extrude_point, Data2=extrude)
mesh_brep = MeshBrep(
    Brep=merge,
    Settings={GridMaxCount=0, GridMinCount=16, JaggedSeams=False, MaxEdgeLength=0, MinEdgeLength=0.0001, MinTolerance=0, Refine=True, RefineAngle=0, RelativeTolerance=0.65, SimplePlanes=True, Tolerance=0})
brep = Brep([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])
mesh = Mesh(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)
merge_2 = Merge(Data1=mesh, Data2=mesh_brep)
mesh_join = MeshJoin(Meshes=merge_2)
mesh_2 = Mesh(mesh_join)
mesh_3 = ClusterOutput(mesh_2)
