# Grasshopper definition Surface Winding 001 [May-26 '19, 2325].gh (Grasshopper 1.0.7)
# plug-ins: Robots, Human

diameters = Panel("""135
130
122
121
110""")
offset = Panel("0")
heights = Panel("""0
20
180
183
183""")
subtraction = Subtraction(A=heights, B=offset)
number = Number(subtraction)
number_2 = Number(diameters)
number_slider = Slider(0.253332, range=0..1)
sphere_size = Slider(525.355, range=0..1000)
sphere_radius = Number(sphere_size)

# ---- group: What ??
number_slider_2 = Slider(3, range=0..10)
division = Division(A="360", B=number_slider_2)
series = Series(Start=0, Step=division, Count=number_slider_2)

# ----
radians = Radians(Degrees=series)
yz_plane = YZPlane(Origin=Point(0, 0, 0))
rotate_3d = Rotate3D(Geometry=yz_plane, Angle=radians, Center=Point(0, 0, 0), Axis=Vector(0, 0, 1))  # -> Geometry, Transform

plane = Plane(rotate_3d.Geometry)

panel = Panel("""0
-1""")
distance_between_hops = Slider(49.62, range=0..100)
panel_2 = Panel(Slider(21.093, range=0..100))
plane_hopping_offset_number = Number(panel_2)

# ---- group: Robot Simulation
simulation_control = ControlKnob(Decimals=6, Limit=True, Maximum=1, Minimum=0, Range=0.1, Value=1)
trail_length = Slider(6847, range=0..10000)
number_3 = Number(simulation_control)

# ----
number_4 = Number(number)
number_5 = Number(number_2)

point = ConstructPoint(XCoordinate=0, YCoordinate=0, ZCoordinate=number_4)
division_2 = Division(A=number_5, B=2)
loft_options = LoftOptions(Closed=False, Adjust=False, Rebuild=0, Refit=0, Type=3)
circle = Circle(Plane=point, Radius=division_2)
loft = Loft(Curves=circle, Options=loft_options)
fillet_edge = FilletEdge(Shape=loft, Blend=0, Metric=0, Edges=Slider(8, range=0..10), Radii=Slider(2.941, range=0..10))
last = Panel("-1")
list_item = ListItem(List=number_4, Index=last, Wrap=True)

list_item_2 = ListItem(List=circle, Index=last, Wrap=True)
boundary_surfaces = BoundarySurfaces(Edges=list_item_2)
merge = Merge(Data1=fillet_edge, Data2=boundary_surfaces)
brep_join = BrepJoin(Breps=merge)  # -> Breps, Closed

brep = Brep(brep_join.Breps)
height = Number(list_item)

# ---- group: Upload to Robot
robot_ip_adress = Panel("192.168.178.22")
upload = Button()
pause = Button()
play = Button()
boolean = Boolean(play)
boolean_2 = Boolean(upload)
boolean_3 = Boolean(pause)

# ---- group: Lower boundary
lowest_point = Slider(57.606, range=0..200)
brep_2 = Brep(brep)
number_6 = Number(lowest_point)

construct_point = ConstructPoint(XCoordinate=0, YCoordinate=0, ZCoordinate=number_6)
xy_plane = XYPlane(Origin=construct_point)
brep_plane = BrepPlane(Brep=brep_2, Plane=xy_plane)  # -> Curves, Points

plane_2 = Plane(xy_plane)
curve = Curve(brep_plane.Curves)

# ----
number_7 = Number(height)
brep_3 = Brep(brep)

subtraction_2 = Subtraction(A=number_7, B=0.01)
construct_domain = ConstructDomain(DomainStart=Slider(28.045, range=0..40), DomainEnd=subtraction_2)
range = Range(Domain=construct_domain, Steps=Slider(7, range=1..30))
construct_point_2 = ConstructPoint(XCoordinate=0, YCoordinate=0, ZCoordinate=range)
xy_plane_2 = XYPlane(Origin=construct_point_2)
brep_plane_2 = BrepPlane(Brep=brep_3, Plane=xy_plane_2)  # -> Curves, Points

curve_2 = Curve(brep_plane_2.Curves)

# ---- group: Projection sphere
sphere_radius_2 = Number(sphere_radius)
plane_3 = Plane(plane_2)
curve_3 = Curve(curve)

divide_curve = DivideCurve(Curve=curve_3, Count=10, Kinks=False)  # -> Points, Tangents, Parameters
xy_plane_3 = XYPlane(Origin=plane_3)
line = Line(StartPoint=xy_plane_3, EndPoint=divide_curve.Points)
extend_curve = ExtendCurve(Curve=line, Type=0, Start="0", End=Slider(659.077, range=0..1000))
loft_options_2 = LoftOptions(Closed=True, Adjust=False, Rebuild=0, Refit=0, Type=0)
sphere = Sphere(Base=PlaneXY(0, 0, 0), Radius=sphere_radius_2)
loft_2 = Loft(Curves=extend_curve, Options=loft_options_2)
split_brep = SplitBrep(Brep=sphere, Cutter=loft_2)
list_item_3 = ListItem(List=split_brep, Index=0, Wrap=True)  # -> Item, Item1

surface = Surface(list_item_3.Item)
surface_2 = Surface(list_item_3.Item1)

# ----
brep_4 = Brep(brep)

brep_5 = Brep(brep)
number_slider_3 = Slider(65.6, range=10..100)

# ---- group: Create Interpolation Zone
number_slider_4 = Slider(1629.424, range=0..3000)
number_slider_5 = Slider(158.641, range=0..500)
brep_6 = Brep(surface)

unit_z = UnitZ(Factor=number_slider_4)
circle_2 = Circle(Plane=PlaneXY(0, 0, 0), Radius=number_slider_5)
extrude = Extrude(Base=circle_2, Direction=unit_z)
split_brep_2 = SplitBrep(Brep=brep_6, Cutter=extrude)
cap_holes = CapHoles(Brep=extrude)
list_item_4 = ListItem(List=split_brep_2, Index=0, Wrap=True)  # -> Item, Item1

normal_zone = Brep(list_item_4.Item1)
interpolation_zone = Brep(list_item_4.Item)
brep_7 = Brep(cap_holes)
brep_8 = Brep(split_brep_2)

# ----
cap_holes_2 = CapHoles(Brep=brep_7)

number_8 = Number(Slider(168.732, range=0..720))
brep_9 = Brep(surface)
plane_4 = Plane(plane)
radians_2 = Radians(Degrees=number_8)

brep_plane_3 = BrepPlane(Brep=brep_9, Plane=plane_4)  # -> Curves, Points
divide_curve_2 = DivideCurve(Curve=brep_plane_3.Curves, Count=10, Kinks=False)  # -> Points, Tangents, Parameters

list_item_5 = ListItem(List=divide_curve_2.Points, Index=panel, Wrap=True)
cull_index = CullIndex(List=divide_curve_2.Points, Indices=panel, Wrap=True)

point_2 = Point(flatten(cull_index))
interpolate = Interpolate(Vertices=point_2, Degree=3, Periodic=True, KnotStyle=1)  # -> Curve, Length, Domain

rotate = Rotate(Geometry=interpolate.Curve, Angle=radians_2, Plane=PlaneXY(0, 0, 0))  # -> Geometry, Transform
curve_4 = Curve(rotate.Geometry)

xz_plane = XZPlane(Origin=Point(0, 0, 0))
number_9 = Number(Slider(245.485, range=0..720))
brep_10 = Brep(surface)
plane_5 = Plane(xz_plane)
curve_5 = Curve(curve_4)

curve_6 = Curve(curve_5)
trim_with_brep = TrimWithBrep(Curve=curve_6, Brep=cap_holes_2)  # -> Inside, Outside

brep_plane_4 = BrepPlane(Brep=brep_10, Plane=plane_5)  # -> Curves, Points
divide_curve_3 = DivideCurve(Curve=brep_plane_4.Curves, Count=10, Kinks=False)  # -> Points, Tangents, Parameters
point_3 = Point(flatten(divide_curve_3.Points))
interpolate_2 = Interpolate(Vertices=point_3, Degree=3, Periodic=Toggle(False), KnotStyle=1)  # -> Curve, Length, Domain
radians_3 = Radians(Degrees=number_9)
rotate_2 = Rotate(Geometry=interpolate_2.Curve, Angle=radians_3, Plane=PlaneXY(0, 0, 0))  # -> Geometry, Transform

curve_7 = Curve(trim_with_brep.Outside)
curve_8 = Curve(trim_with_brep.Inside)
merge_2 = Merge(Data1=curve_8, Data2=curve_7)
curve_9 = Curve(merge_2)
length = Length(Curve=curve_9)
division_3 = Division(A=length, B=number_slider_3)

divide_length = DivideLength(Curve=reparameterize(curve_9), Length=number_slider_3)  # -> Points, Tangents, Parameters
xy_plane_4 = XYPlane(Origin=Point(0, 0, 0))
divide_curve_4 = DivideCurve(Curve=curve_9, Count=division_3, Kinks=False)  # -> Points, Tangents, Parameters
loft_options_3 = LoftOptions(Closed=False, Adjust=False, Rebuild=0, Refit=0, Type=0)
line_2 = Line(StartPoint=xy_plane_4, EndPoint=divide_curve_4.Points)
shatter = Shatter(Curve=reparameterize(graft(curve_9)), Parameters=divide_length.Parameters)
loft_3 = Loft(Curves=line_2, Options=loft_options_3)
end_points = EndPoints(Curve=shatter)  # -> Start, End
brep_brep = BrepBrep(BrepA=brep_5, BrepB=loft_3)  # -> Curves, Points

curve_10 = Curve(brep_brep.Curves)

unit_z_2 = UnitZ(Factor=1)

curve_11 = Curve(curve_4)
brep_11 = Brep(brep)

divide_length_2 = DivideLength(Curve=curve_11, Length=Slider(65.6, range=10..100))  # -> Points, Tangents, Parameters
xy_plane_5 = XYPlane(Origin=Point(0, 0, 0))
loft_options_4 = LoftOptions(Closed=True, Adjust=False, Rebuild=0, Refit=0, Type=0)
line_3 = Line(StartPoint=xy_plane_5, EndPoint=divide_length_2.Points)
loft_4 = Loft(Curves=line_3, Options=loft_options_4)
brep_brep_2 = BrepBrep(BrepA=brep_11, BrepB=loft_4)  # -> Curves, Points

curve_12 = Curve(brep_brep_2.Curves)

curve_13 = Curve(curve_5)
brep_12 = Brep(brep)

divide_length_3 = DivideLength(Curve=curve_13, Length=Slider(15.6, range=10..100))  # -> Points, Tangents, Parameters
loft_options_5 = LoftOptions(Closed=False, Adjust=False, Rebuild=0, Refit=0, Type=0)
line_4 = Line(StartPoint=plane_2, EndPoint=divide_length_3.Points)
loft_5 = Loft(Curves=line_4, Options=loft_options_5)
brep_brep_3 = BrepBrep(BrepA=brep_12, BrepB=loft_5)  # -> Curves, Points

curve_14 = Curve(brep_brep_3.Curves)

curve_15 = Curve(curve_14)

divide_length_4 = DivideLength(Curve=curve_15, Length=Slider(3.594, range=1..10))  # -> Points, Tangents, Parameters
brep_closest_point = BrepClosestPoint(Point=divide_length_4.Points, Brep=brep_4)  # -> Point, Normal, Distance
plane_normal = PlaneNormal(Origin=brep_closest_point.Point, ZAxis=brep_closest_point.Normal)
align_plane = AlignPlane(Plane=plane_normal, Direction=unit_z_2)  # -> Plane, Angle
flip_plane = FlipPlane(Plane=align_plane.Plane, ReverseX=False, ReverseY=False, SwapAxes=True)

plane_6 = Plane(flip_plane)

# ---- group: Divide Curve
distance_between_planes = Slider(1.659, range=0..10)
curve_16 = Curve(reparameterize(curve_14))
number_10 = Number(distance_between_planes)

length_2 = Length(Curve=curve_16)
division_4 = Division(A=length_2, B=number_10)
divide_curve_5 = DivideCurve(Curve=curve_16, Count=division_4, Kinks=False)  # -> Points, Tangents, Parameters

curve_length = Number(length_2)
point_4 = Point(divide_curve_5.Points)

# ----
number_11 = Number(number_10)
number_12 = Number(curve_length)
division_5 = Division(A=distance_between_hops, B=number_11)
division_6 = Division(A=number_12, B=distance_between_hops)
range_2 = Range(Domain=Domain(0, 1), Steps=simplify(division_5))  # -> simplify(Range)
graph_mapper = GraphMapper(range_2, x0=0, x1=1, y0=0, y1=1, container_name="Bezier", cpx=[0, 0, 1, 1], cpy=[0, 0.5074869394, 0.532124877, 0])
multiplication = Multiplication(A=plane_hopping_offset_number, B=graph_mapper)  # -> flatten(Result)

# ---- group: Create Planes on Projection Sphere
lower_boundary_plane = Plane(plane_2)
projection_sphere_brep = Brep(surface)
point_5 = Point(point_4)

vector_2pt = Vector2Pt(PointA=lower_boundary_plane, PointB=point_5, Unitize=False)  # -> Vector, Length
line_sdl = LineSDL(Start=point_5, Direction=vector_2pt.Vector, Length=sphere_radius)
brep_curve = BrepCurve(Brep=projection_sphere_brep, Curve=line_sdl)  # -> Curves, flatten(Points)
project_point = ProjectPoint(Point=point_5, Direction=vector_2pt.Vector, Geometry=projection_sphere_brep)  # -> Point, Index; disabled
brep_closest_point_2 = BrepClosestPoint(Point=brep_curve.Points, Brep=projection_sphere_brep)  # -> Point, Normal, Distance
plane_normal_2 = PlaneNormal(Origin=brep_closest_point_2.Point, ZAxis=brep_closest_point_2.Normal)

plane_7 = Plane(plane_normal_2)

# ---- group: Align Planes on Projection Sphere
sphere_radius_3 = Number(sphere_radius)
plane_8 = Plane(plane_7)

xy_plane_6 = XYPlane(Origin=Point(0, 0, 0))
line_sdl_2 = LineSDL(Start=xy_plane_6, Direction=Vector(0, 0, 1), Length=expr("x+10", sphere_radius_3))
curve_closest_point = CurveClosestPoint(Point=plane_8, Curve=line_sdl_2)  # -> Point, Parameter, Distance
vector_2pt_2 = Vector2Pt(PointA=plane_8, PointB=curve_closest_point.Point, Unitize=False)  # -> Vector, Length
align_plane_2 = AlignPlane(Plane=plane_8, Direction=vector_2pt_2.Vector)  # -> Plane, Angle

plane_9 = Plane(align_plane_2.Plane)

# ----
interpolation_zone_brep = Brep(brep_7)
plane_10 = Plane(plane_9)

point_in_brep = PointInBrep(Brep=interpolation_zone_brep, Point=plane_10, Strict=False)
boolean_4 = Boolean(point_in_brep)
list_length = ListLength(List=boolean_4)
shift_list = ShiftList(List=boolean_4, Shift=1, Wrap=True)
equality = Equality(FirstNumber=boolean_4, SecondNumber=shift_list)  # -> Equality, Inequality
series_2 = Series(Start=0, Step=1, Count=list_length)
subtraction_3 = Subtraction(A=list_length, B=1)
panel_3 = Panel(subtraction_3)
cull_pattern = CullPattern(List=series_2, CullPattern=equality.Inequality)
first_index = Panel("0")
merge_3 = Merge(Data1=flatten(first_index), Data2=flatten(cull_pattern))
merge_4 = Merge(Data1=flatten(cull_pattern), Data2=flatten(panel_3))
construct_domain_2 = ConstructDomain(DomainStart=merge_3, DomainEnd=merge_4)
sub_list = SubList(List=boolean_4, Domain=construct_domain_2, Wrap=True)  # -> List, Index
sub_list_2 = SubList(List=plane_10, Domain=construct_domain_2, Wrap=True)  # -> List, Index
_2nd_index = Panel("1")
list_item_6 = ListItem(List=sub_list.List, Index=_2nd_index, Wrap=True)
cull_pattern_2 = CullPattern(List=sub_list_2.List, CullPattern=list_item_6)
clean_tree = CleanTree(RemoveNulls=True, RemoveInvalid=True, RemoveEmpty=True, Tree=cull_pattern_2)

domain_of_indices_to_split_the_list_of_p = Domain(construct_domain_2)  # "Domain of indices to split the list of planes"
projection_sphere_planes_to_interpolate = Plane(clean_tree)
boolean_if_branch_will_be_interpolated = Boolean(list_item_6)
projection_sphere_planes = Plane(sub_list_2.List)

# ---- group: Consecutively rotate interpolation planes
plane_11 = Plane(projection_sphere_planes_to_interpolate)

first_and_last_index = Panel("""0
-1""")
first_index_2 = Panel("0")
list_length_2 = ListLength(List=plane_11)
list_item_7 = ListItem(List=plane_11, Index=first_index_2, Wrap=True)  # -> Item1, Item
list_item_8 = ListItem(List=plane_11, Index=first_and_last_index, Wrap=True)
subtraction_4 = Subtraction(A=list_length_2, B="1")
vector_2pt_3 = Vector2Pt(PointA=list_item_7.Item, PointB=list_item_7.Item1, Unitize=False)  # -> Vector, Length
deconstruct_plane = DeconstructPlane(Plane=list_item_8)  # -> Origin, XAxis, YAxis, ZAxis
xy_plane_7 = XYPlane(Origin=Point(0, 0, 0))
list_item_9 = ListItem(List=deconstruct_plane.XAxis, Index=0, Wrap=True)  # -> Item, Item1
angle = Angle(VectorA=list_item_9.Item, VectorB=list_item_9.Item1, Plane=xy_plane_7)  # -> Angle, Reflex
align_plane_3 = AlignPlane(Plane=plane_11, Direction=vector_2pt_3.Vector)  # -> Plane, Angle
construct_domain_3 = ConstructDomain(DomainStart="0", DomainEnd=angle.Angle)
range_3 = Range(Domain=construct_domain_3, Steps=subtraction_4)
rotate_plane = RotatePlane(Plane=align_plane_3.Plane, Angle=range_3)

plane_12 = Plane(rotate_plane)

# ---- group: Replace the original planes in the interpolation zone with interpolated ones
boolean_if_branch_will_be_interpolated_2 = Boolean(boolean_if_branch_will_be_interpolated)
projection_sphere_planes_2 = Plane(projection_sphere_planes)
plane_13 = Plane(plane_12)

cull_pattern_3 = CullPattern(List=projection_sphere_planes_2, CullPattern=invert(boolean_if_branch_will_be_interpolated_2))
clean_tree_2 = CleanTree(RemoveNulls=True, RemoveInvalid=True, RemoveEmpty=True, Tree=cull_pattern_3)
trim_tree = TrimTree(Tree=plane_13, Depth=1)
merge_5 = Merge(Data1=trim_tree, Data2=clean_tree_2)

plane_14 = Plane(merge_5)

# ---- group: Create planes on form brep
# Comment: Creates Planes on the form Brep and also orders them by weather or not they will be interpolated
domain_of_indices_to_split_the_list_of_p_2 = Domain(domain_of_indices_to_split_the_list_of_p)  # "Domain of indices to split the list of planes"
mold_form_brep = Brep(brep)
point_6 = Point(point_4)

brep_closest_point_3 = BrepClosestPoint(Point=point_6, Brep=mold_form_brep)  # -> Point, Normal, Distance
plane_normal_3 = PlaneNormal(Origin=brep_closest_point_3.Point, ZAxis=brep_closest_point_3.Normal)
sub_list_3 = SubList(List=plane_normal_3, Domain=domain_of_indices_to_split_the_list_of_p_2, Wrap=True)  # -> List, Index

# ----
list_length_3 = ListLength(List=point_6)
division_7 = Division(A=list_length_3, B=division_5)

# ---- group: Create planes on form brep (continued)
plane_15 = Plane(sub_list_3.List)

# ----
duplicate_data = DuplicateData(Data=multiplication, Number=division_7, Order=True)
list_length_4 = ListLength(List=duplicate_data)
subtraction_5 = Subtraction(A=list_length_4, B=list_length_3)
series_3 = Series(Start=-1, Step=-1, Count=subtraction_5)
cull_index_2 = CullIndex(List=duplicate_data, Indices=series_3, Wrap=True)
multiplication_2 = Multiplication(A=cull_index_2, B=Slider(-1, range=-1..1))
amplitude = Amplitude(Vector=brep_closest_point_3.Normal, Amplitude=flatten(multiplication_2))
move = Move(Geometry=point_6, Motion=amplitude)  # -> Geometry, Transform
plane_normal_4 = PlaneNormal(Origin=move.Geometry, ZAxis=brep_closest_point_3.Normal)
sub_list_4 = SubList(List=plane_normal_4, Domain=domain_of_indices_to_split_the_list_of_p_2, Wrap=True)  # -> List, Index
plane_16 = Plane(sub_list_4.List)
polyline = PolyLine(Vertices=flatten(plane_16), Closed=True)

# ---- group: Align planes on form brep with those on the projection sphere
plane_17 = Plane(plane_14)
plane_18 = Plane(plane_16)

align_planes = AlignPlanes(Planes=graft(plane_18), Master=graft(plane_17))
cull_duplicates = CullDuplicates(Points=flatten(align_planes), Tolerance=0.1, CullMode=1)  # -> Points, Indices, Valence
list_item_10 = ListItem(List=flatten(align_planes), Index=cull_duplicates.Indices, Wrap=True)
reverse_x = BooleanToggle(True)
reverse_y = BooleanToggle(True)
swap_axes = BooleanToggle(True)
flip_plane_2 = FlipPlane(Plane=list_item_10, ReverseX=reverse_x, ReverseY=reverse_y, SwapAxes=swap_axes)

plane_19 = Plane(flip_plane_2)

# ---- group: Extruder nozzle position
number_slider_6 = Slider(19.5, range=-1000..1000)

construct_point_3 = ConstructPoint(XCoordinate=number_slider_6, YCoordinate=Slider(612.8, range=0..1000), ZCoordinate=Slider(122.5, range=-1000..1000))
xy_plane_8 = XYPlane(Origin=construct_point_3)

plane_20 = Plane(xy_plane_8)

# ---- group: Extruder position visualisation
number_slider_7 = Slider(69.678, range=0..100)
unit_z_3 = UnitZ(Factor=number_slider_7)
move_2 = Move(Geometry=plane_20, Motion=unit_z_3)  # -> Geometry, Transform
cone = Cone(Base=move_2.Geometry, Radius=Slider(25.219, range=0..100), Length=expr("-x", number_slider_7))  # -> Cone, Tip
brep_13 = Brep(cone.Cone)

# ----
extruder_tip = Brep(brep_13)

# ---- group: Create Form TCP and Mesh
mold_form_brep_2 = Brep(brep)
height_num = Number(height)

pen_sharpness = Slider(15.94, range=0..50)
pen_thickness = Slider(5.3, range=0..100)
cap_holes_3 = CapHoles(Brep=mold_form_brep_2)
point_7 = ConstructPoint(XCoordinate=0, YCoordinate=0, ZCoordinate=height_num)
xy_plane_9 = XYPlane(Origin=point_7)
number_13 = Number(pen_thickness)
number_14 = Number(pen_sharpness)
plane_21 = Plane(xy_plane_9)
mesh = Mesh(cap_holes_3)
pen_holder_mesh = PenHolderMesh(number_3=number_13, number=height_num, number_2=number_14)
create_tool = CreateTool(Name="DefaultGHTool", TCP=plane_21, Weight=0, Mesh=mesh)  # -> Tool, TCP

tool_parameter = ToolParameter(create_tool.Tool)
tcp_plane = Plane(plane_21)

# ---- group: Convert planes to TCP position
plane_22 = Plane(tcp_plane)
plane_23 = Plane(plane_19)
plane_24 = Plane(plane_20)
orient = Orient(Geometry=plane_22, Source=plane_23, Target=plane_24)  # -> Geometry, Transform
plane_25 = Plane(orient.Geometry)
transform = Transform(orient.Transform)

# ---- group: Create Robot Program
list = ValueList({"Bartlett-IRB120", "Bartlett-IRB1600", "Bartlett-KR6", "Bartlett-KR60", "Bartlett-UR10", "BURG Halle-UR5", "BURG Halle-UR5 on table", "KULeuven-IRB120", "KULeuven-UR5", "KULeuven-UR10"}, selected="BURG Halle-UR5")
list_2 = FlagFields({"Shoulder": 1, "Elbow": 2, "Wrist": 4}, selected=["Shoulder", "Wrist"])
list_3 = ValueList({"Joint", "Linear"}, selected="Linear")
plane_26 = Plane(plane_25)
tool_parameter_2 = ToolParameter(tool_parameter)
zone_soft_radius = Number("5")
speed = Number(Slider(71, range=0..100))

load_robot_system = LoadRobotSystem(Name=list, Base=PlaneXY(0, 0, 0))
create_target = CreateTarget(
    Plane=flatten(plane_26),
    RobConf=list_2,
    Motion=list_3,
    Tool=tool_parameter_2,
    Speed=speed,
    Zone=zone_soft_radius,
    IsCartesian=True)
create_program = CreateProgram(Name="DefaultProgram", RobotSystem=load_robot_system, Targets1=create_target, StepSize=Slider(0.25, range=0..1))  # -> Program, Code, Duration, Warnings, Errors

program_parameter = ProgramParameter(create_program.Program)
text = Text(create_program.Code)
number_15 = Number(create_program.Duration)
text_2 = Text(create_program.Warnings)
text_3 = Text(create_program.Errors)

# ---- group: Program Code and Errors
program = Panel(program_parameter)
warnings = Panel(text_2)
errors = Panel(text_3)
program_code = Panel(text)

# ----
ip_adress = Text(robot_ip_adress)
boolean_5 = Boolean(boolean_2)
boolean_6 = Boolean(boolean)
boolean_7 = Boolean(boolean_3)
remote_connection = RemoteConnection(Program=program_parameter, IP=ip_adress, Upload=boolean_5, Play=boolean_6, Pause=boolean_7)
text_4 = Text(remote_connection)
data_recorder = DataRecorder(text_4, DataLimit=-10, RecordData=True)

# ---- group: Upload to Robot (continued)
text_5 = Text(data_recorder)
log = Panel(text_5)

# ---- group: Length of the program
list_length_5 = ListLength(List=text)
commands = Panel(list_length_5)

# ---- group: Robot Simulation
number_16 = Number(trail_length)
number_17 = Number(number_3)

program_simulation = ProgramSimulation(Program=program_parameter, Time=number_17, Normalized=True)  # -> SystemMeshes, JointRotations, Plane, Index, Time, Program, Errors
check_collisions = CheckCollisions(
    Program=program_simulation.Program,
    FirstSet=7,
    SecondSet=4,
    EnvironmentPlane=-1,
    LinearStepSize=100,
    AngularStepSize=0.7853981634)  # -> CollisionFound, TargetIndex, CollidedMeshes
simple_trail = SimpleTrail(Program=program_simulation.Program, Length=number_16, MechanicalGroup=0)
split_list = SplitList(List=program_simulation.SystemMeshes, Index=7)  # -> ListA, ListB

colliding_meshes_mesh = Mesh(check_collisions.CollidedMeshes)
collisions = Panel(check_collisions.CollisionFound)
number_18 = Number(program_simulation.JointRotations)
plane_27 = Plane(program_simulation.Plane)
integer = Integer(program_simulation.Index)
curve_17 = Curve(simple_trail)
robot_mesh = Mesh(split_list.ListA)
tool_mesh = Mesh(split_list.ListB)

# ----
number_19 = Number(number_18)
degrees = Degrees(Radians=number_19)
axes_positions = Panel(degrees)

# ---- group: Robot Simulation (continued)
tool_mesh_2 = Mesh(tool_mesh)
simulatied_robot_mesh = Mesh(robot_mesh)
simulation_robot_trail = Curve(curve_17)

# ----
preview = CustomPreview(Geometry=simulatied_robot_mesh, Shader=ColourSwatch(SwatchColor=RGB(158, 158, 158)))
preview_2 = CustomPreview(Geometry=tool_mesh_2, Shader=ColourSwatch(SwatchColor=RGBA(0, 178, 255, 173)))

plane_28 = Plane(plane_27)
plane_29 = Plane(tcp_plane)

list_item_11 = ListItem(List=plane_28, Index=-1, Wrap=True)
orient_2 = Orient(Source=plane_29, Target=list_item_11)  # -> Geometry, Transform

transform_2 = Transform(orient_2.Transform)

# ---- group: Move Curve according to TCP position
transform_3 = Transform(transform_2)
curve_18 = Curve(polyline)
transform_4 = Transform(Geometry=curve_18, Transform=transform_3)
curve_19 = Curve(transform_4)

# ---- group: Robot Simulation (continued)
curve_in_position = Curve(curve_19)

# ----
preview_3 = CustomPreview(Geometry=curve_in_position, Shader=ColourSwatch(SwatchColor=RGBA(0, 221, 255, 31)))

# ---- group: Create extrusion simulation
simulation_index = Integer(integer)
point_8 = Point(flatten(plane_19))
transform_5 = Transform(transform_2)

split_list_2 = SplitList(List=point_8, Index=simulation_index)  # -> ListA, ListB
point_9 = Point(split_list_2.ListA)
cull_duplicates_2 = CullDuplicates(Points=point_9, Tolerance=Slider(5.268, range=0..10), CullMode=3)  # -> Points, Indices, Valence
interpolate_3 = Interpolate(Vertices=cull_duplicates_2.Points, Degree=3, Periodic=False, KnotStyle=0)  # -> Curve, Length, Domain
pipe = Pipe(Curve=interpolate_3.Curve, Radius=Slider(2.73, range=0..10), Caps=2)
transform_6 = Transform(Geometry=pipe, Transform=transform_5)

# ----
transform_7 = Transform(Geometry=cull_duplicates_2.Points, Transform=transform_5)
polyline_2 = PolyLine(Vertices=point_9, Closed=False)
smooth_polyline = SmoothPolyline(Polyline=polyline_2, Strength=1, Times=1)
reduce = Reduce(Polyline=polyline_2, Tolerance=1)  # -> Polyline, Reduction
transform_8 = Transform(Geometry=interpolate_3.Curve, Transform=transform_5)
custom_preview_lineweights = CustomPreviewLineweights(
    Geometry=flatten(transform_8),
    Shader={diffuse=RGB(255, 105, 180), emission=RGB(76, 32, 54), shine=0.5, specular=RGB(255, 255, 255), transparency=0},
    Thickness=Slider(8.222, range=0..20),
    Absolute=False)

# ---- group: Create extrusion simulation (continued)
brep_14 = Brep(transform_6)

# ---- group: Robot Simulation (continued)
extrusion_brep = Brep(brep_14)

# ----
preview_4 = CustomPreview(Geometry=extrusion_brep, Shader=ColourSwatch(SwatchColor=RGB(255, 31, 31)))

# ==== cluster PenHolderMesh
number = ClusterInput()
number_2 = ClusterInput()
number_3 = ClusterInput()
number_4 = Number(number)
number_5 = Number(number_2)
number_6 = Number(number_3)
subtraction = Subtraction(A=number_4, B=number_5)
unit_z = UnitZ(Factor=subtraction)
unit_z_2 = UnitZ(Factor=number_4)
circle = Circle(Plane=PlaneXY(0, 0, 0), Radius=number_6)
extrude = Extrude(Base=circle, Direction=unit_z)
construct_point = ConstructPoint(XCoordinate=0, YCoordinate=0, ZCoordinate=unit_z_2)
move = Move(Geometry=circle, Motion=unit_z)  # -> Geometry, Transform
extrude_point = ExtrudePoint(Base=move.Geometry, Point=construct_point)
merge = Merge(Data1=extrude_point, Data2=extrude)
mesh_brep = MeshBrep(
    Brep=merge,
    Settings={GridMaxCount=0, GridMinCount=16, JaggedSeams=False, MaxEdgeLength=0, MinEdgeLength=0.0001, MinTolerance=0, Refine=True, RefineAngle=0, RelativeTolerance=0.65, SimplePlanes=True, Tolerance=0})
brep = Brep([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])
mesh = Mesh(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)
merge_2 = Merge(Data1=mesh, Data2=mesh_brep)
mesh_join = MeshJoin(Meshes=merge_2)
mesh_2 = Mesh(mesh_join)
mesh_3 = ClusterOutput(mesh_2)
