# Grasshopper definition Surface Winding 003 [Jul-01 '19, 1508].gh (Grasshopper 1.0.7)
# plug-ins: Robots, Anemone, Human

offset = Panel("0")
diameters = Panel("""135
130
122
121
110""")
heights = Panel("""0
20
175
183
183""")
subtraction = Subtraction(A=heights, B=offset)
number = Number(subtraction)
number_2 = Number(diameters)

loop_start = LoopStart(Repeat="1000", Trigger=Button(), Data="0", D1=Slider(0.002, range=0..0.1), D2=Slider(0, range=0..1000))  # -> port, Counter, Data, Data_2, Data_3
addition = Addition(A=loop_start.Data, B=loop_start.Data_2)
larger_than = LargerThan(FirstNumber=addition, SecondNumber="1")  # -> LargerThan, OrEqualTo
time_buffer = TimeBuffer(Data=addition, Ms=loop_start.Data_3, UseThread=False)
gate_or = GateOr(A=Toggle(False), B=larger_than.OrEqualTo)
loop_end = LoopEnd(
    port=loop_start.port,
    Exit=gate_or,
    Data=time_buffer,
    Data_2=loop_start.Data_2,
    Data_3=loop_start.Data_3,
    TimeOutVal=0,
    pausedState=False,
    state="Constant output")  # -> Data, D1, D2
panel = Panel(loop_end.Data)

frame_curve_rotation = Slider(320.17, range=0..720)
number_3 = Number(loop_end.Data)
sphere_size = Slider(525.355, range=0..1000)
sphere_radius = Number(sphere_size)

# ---- group: What ??
number_slider = Slider(3, range=0..10)
division = Division(A="360", B=number_slider)
series = Series(Start=0, Step=division, Count=number_slider)

# ----
radians = Radians(Degrees=series)
yz_plane = YZPlane(Origin=Point(0, 0, 0))
rotate_3d = Rotate3D(Geometry=yz_plane, Angle=radians, Center=Point(0, 0, 0), Axis=Vector(0, 0, 1))  # -> Geometry, Transform

plane = Plane(rotate_3d.Geometry)

distance_between_hops = Slider(97.295, range=0..500)
hop_offset = Slider(0, range=0..100)
plane_hopping_offset_number = Number(hop_offset)

speed = Slider(34, range=0..100)
list = FlagFields({"Shoulder": 1, "Elbow": 2, "Wrist": 4}, selected=["Shoulder", "Wrist"])
list_2 = ValueList({"Joint", "Linear"}, selected="Joint")
speed_parameter = SpeedParameter(speed)
zone_parameter = ZoneParameter("2")
configuration = Integer(list)
motion_type = Text(list_2)

speed_2 = Slider(23, range=0..100)
list_3 = FlagFields({"Shoulder": 1, "Elbow": 2, "Wrist": 4}, selected=["Shoulder", "Wrist"])
list_4 = ValueList({"Joint", "Linear"}, selected="Linear")
speed_parameter_2 = SpeedParameter(speed_2)
zone_parameter_2 = ZoneParameter("5")
configuration_2 = Integer(list_3)
motion_type_2 = Text(list_4)

program_step_size = Slider(0.64, range=0..1)

number_4 = Number(number)
number_5 = Number(number_2)

point = ConstructPoint(XCoordinate=0, YCoordinate=0, ZCoordinate=number_4)
division_2 = Division(A=number_5, B=2)
loft_options = LoftOptions(Closed=False, Adjust=False, Rebuild=0, Refit=0, Type=3)
circle = Circle(Plane=point, Radius=division_2)
loft = Loft(Curves=circle, Options=loft_options)
fillet_edge = FilletEdge(Shape=loft, Blend=2, Metric=0, Edges=Slider(8, range=0..10), Radii=Slider(4, range=0..10))
last = Panel("-1")
list_item = ListItem(List=number_4, Index=last, Wrap=True)

list_item_2 = ListItem(List=circle, Index=last, Wrap=True)
boundary_surfaces = BoundarySurfaces(Edges=list_item_2)
merge = Merge(Data1=fillet_edge, Data2=boundary_surfaces)
brep_join = BrepJoin(Breps=merge)  # -> Breps, Closed
brep = Brep(brep_join.Breps)
height = Number(list_item)

brep_2 = Brep(brep)

brep_3 = Brep(brep)
number_slider_2 = Slider(65.6, range=10..100)

# ---- group: Upload to Robot
robot_ip_adress = Panel("192.168.178.22")
upload = Button()
pause = Button()
play = Button()
boolean = Boolean(play)
boolean_2 = Boolean(upload)
boolean_3 = Boolean(pause)

# ---- group: Robot Simulation
simulation_control = ControlKnob(Decimals=6, Limit=False, Maximum=1, Minimum=0, Range=0.1, Value=3.695609)
trail_length = Slider(6847, range=0..10000)
modulus = Modulus(A=simulation_control, B="1")
number_6 = Number(Slider(0, range=0..1))

# ----
unit_z = UnitZ(Factor=1)

xy_plane = XYPlane(Origin=Point(0, 0, 0))
loft_options_2 = LoftOptions(Closed=False, Adjust=False, Rebuild=0, Refit=0, Type=0)

# ---- group: Extruder nozzle position
number_slider_3 = Slider(728, range=-1000..1000)
number_slider_4 = Slider(-175, range=-1000..1000)
number_slider_5 = Slider(146, range=-1000..1000)

construct_point = ConstructPoint(XCoordinate=number_slider_3, YCoordinate=number_slider_4, ZCoordinate=number_slider_5)
xy_plane_2 = XYPlane(Origin=construct_point)

plane_2 = Plane(xy_plane_2)

# ---- group: Extruder position visualisation
number_slider_6 = Slider(69.678, range=0..100)
unit_z_2 = UnitZ(Factor=number_slider_6)
move = Move(Geometry=plane_2, Motion=unit_z_2)  # -> Geometry, Transform
cone = Cone(Base=move.Geometry, Radius=Slider(25.219, range=0..100), Length=expr("-x", number_slider_6))  # -> Cone, Tip
brep_4 = Brep(cone.Cone)

# ---- group: Robot Simulation (continued)
extruder_tip = Brep(brep_4)

# ---- group: Lower boundary
lowest_point = Slider(82.619, range=0..200)
brep_5 = Brep(brep)
number_7 = Number(lowest_point)

construct_point_2 = ConstructPoint(XCoordinate=0, YCoordinate=0, ZCoordinate=number_7)
xy_plane_3 = XYPlane(Origin=construct_point_2)
brep_plane = BrepPlane(Brep=brep_5, Plane=xy_plane_3)  # -> Curves, Points

plane_3 = Plane(xy_plane_3)
curve = Curve(brep_plane.Curves)

# ----
number_8 = Number(height)
brep_6 = Brep(brep)

subtraction_2 = Subtraction(A=number_8, B=0.01)
construct_domain = ConstructDomain(DomainStart=Slider(28.045, range=0..40), DomainEnd=subtraction_2)
range = Range(Domain=construct_domain, Steps=Slider(7, range=1..30))
construct_point_3 = ConstructPoint(XCoordinate=0, YCoordinate=0, ZCoordinate=range)
xy_plane_4 = XYPlane(Origin=construct_point_3)
brep_plane_2 = BrepPlane(Brep=brep_6, Plane=xy_plane_4)  # -> Curves, Points

curve_2 = Curve(brep_plane_2.Curves)

# ---- group: Projection sphere
sphere_radius_2 = Number(sphere_radius)
plane_4 = Plane(plane_3)
curve_3 = Curve(curve)

divide_curve = DivideCurve(Curve=curve_3, Count=10, Kinks=False)  # -> Points, Tangents, Parameters
xy_plane_5 = XYPlane(Origin=plane_4)
line = Line(StartPoint=xy_plane_5, EndPoint=divide_curve.Points)
extend_curve = ExtendCurve(Curve=line, Type=0, Start="0", End=Slider(659.077, range=0..1000))
loft_options_3 = LoftOptions(Closed=True, Adjust=False, Rebuild=0, Refit=0, Type=0)
sphere = Sphere(Base=PlaneXY(0, 0, 0), Radius=sphere_radius_2)
loft_2 = Loft(Curves=extend_curve, Options=loft_options_3)
split_brep = SplitBrep(Brep=sphere, Cutter=loft_2)
list_item_3 = ListItem(List=split_brep, Index=0, Wrap=True)  # -> Item, Item1

surface = Surface(list_item_3.Item)
surface_2 = Surface(list_item_3.Item1)

# ---- group: Create Interpolation Zone
number_slider_7 = Slider(1629.424, range=0..3000)
number_slider_8 = Slider(210, range=0..500)
brep_7 = Brep(surface)

unit_z_3 = UnitZ(Factor=number_slider_7)
circle_2 = Circle(Plane=PlaneXY(0, 0, 0), Radius=number_slider_8)
extrude = Extrude(Base=circle_2, Direction=unit_z_3)
split_brep_2 = SplitBrep(Brep=brep_7, Cutter=extrude)
cap_holes = CapHoles(Brep=extrude)
list_item_4 = ListItem(List=split_brep_2, Index=0, Wrap=True)  # -> Item, Item1

normal_zone = Brep(list_item_4.Item1)
interpolation_zone = Brep(list_item_4.Item)
brep_8 = Brep(cap_holes)
brep_9 = Brep(split_brep_2)

# ----
cap_holes_2 = CapHoles(Brep=brep_8)

brep_10 = Brep(surface)
plane_5 = Plane(plane)
number_9 = Number(frame_curve_rotation)

brep_plane_3 = BrepPlane(Brep=brep_10, Plane=plane_5)  # -> Curves, Points
divide_curve_2 = DivideCurve(Curve=brep_plane_3.Curves, Count=10, Kinks=False)  # -> Points, Tangents, Parameters
panel_2 = Panel("""0
-1""")
cull_index = CullIndex(List=divide_curve_2.Points, Indices=panel_2, Wrap=True)
point_2 = Point(flatten(cull_index))
radians_2 = Radians(Degrees=number_9)
interpolate = Interpolate(Vertices=point_2, Degree=3, Periodic=True, KnotStyle=1)  # -> Curve, Length, Domain

rotate = Rotate(Geometry=interpolate.Curve, Angle=radians_2, Plane=PlaneXY(0, 0, 0))  # -> Geometry, Transform
curve_4 = Curve(rotate.Geometry)

curve_5 = Curve(curve_4)
flip_curve = FlipCurve(Curve=curve_5)  # -> Curve, Flag
curve_6 = Curve(curve_5)

xz_plane = XZPlane(Origin=Point(0, 0, 0))
number_10 = Number(Slider(245.485, range=0..720))
brep_11 = Brep(surface)
plane_6 = Plane(xz_plane)
curve_7 = Curve(curve_6)

curve_8 = Curve(curve_7)
trim_with_brep = TrimWithBrep(Curve=curve_8, Brep=cap_holes_2)  # -> Inside, Outside

brep_plane_4 = BrepPlane(Brep=brep_11, Plane=plane_6)  # -> Curves, Points
divide_curve_3 = DivideCurve(Curve=brep_plane_4.Curves, Count=10, Kinks=False)  # -> Points, Tangents, Parameters
point_3 = Point(flatten(divide_curve_3.Points))
interpolate_2 = Interpolate(Vertices=point_3, Degree=3, Periodic=Toggle(False), KnotStyle=1)  # -> Curve, Length, Domain
radians_3 = Radians(Degrees=number_10)
rotate_2 = Rotate(Geometry=interpolate_2.Curve, Angle=radians_3, Plane=PlaneXY(0, 0, 0))  # -> Geometry, Transform

curve_9 = Curve(trim_with_brep.Outside)
curve_10 = Curve(trim_with_brep.Inside)
merge_2 = Merge(Data1=curve_10, Data2=curve_9)
curve_11 = Curve(merge_2)
length = Length(Curve=curve_11)
division_3 = Division(A=length, B=number_slider_2)

divide_length = DivideLength(Curve=reparameterize(curve_11), Length=number_slider_2)  # -> Points, Tangents, Parameters
divide_curve_4 = DivideCurve(Curve=curve_11, Count=division_3, Kinks=False)  # -> Points, Tangents, Parameters
line_2 = Line(StartPoint=xy_plane, EndPoint=divide_curve_4.Points)
shatter = Shatter(Curve=reparameterize(graft(curve_11)), Parameters=divide_length.Parameters)
loft_3 = Loft(Curves=line_2, Options=loft_options_2)
end_points = EndPoints(Curve=shatter)  # -> Start, End
brep_brep = BrepBrep(BrepA=brep_3, BrepB=loft_3)  # -> Curves, Points

curve_12 = Curve(brep_brep.Curves)

brep_12 = Brep(brep)
curve_13 = Curve(curve_4)

divide_length_2 = DivideLength(Curve=curve_13, Length=Slider(65.6, range=10..100))  # -> Points, Tangents, Parameters
xy_plane_6 = XYPlane(Origin=Point(0, 0, 0))
loft_options_4 = LoftOptions(Closed=True, Adjust=False, Rebuild=0, Refit=0, Type=0)
line_3 = Line(StartPoint=xy_plane_6, EndPoint=divide_length_2.Points)
loft_4 = Loft(Curves=line_3, Options=loft_options_4)
brep_brep_2 = BrepBrep(BrepA=brep_12, BrepB=loft_4)  # -> Curves, Points

curve_14 = Curve(brep_brep_2.Curves)

curve_15 = Curve(curve_7)
brep_13 = Brep(brep)

divide_length_3 = DivideLength(Curve=curve_15, Length=Slider(15.6, range=10..100))  # -> Points, Tangents, Parameters
loft_options_5 = LoftOptions(Closed=False, Adjust=False, Rebuild=0, Refit=0, Type=0)
line_4 = Line(StartPoint=plane_3, EndPoint=divide_length_3.Points)
loft_5 = Loft(Curves=line_4, Options=loft_options_5)
brep_brep_3 = BrepBrep(BrepA=brep_13, BrepB=loft_5)  # -> Curves, Points

curve_16 = Curve(brep_brep_3.Curves)

curve_17 = Curve(curve_16)

divide_length_4 = DivideLength(Curve=curve_17, Length=Slider(3.594, range=1..10))  # -> Points, Tangents, Parameters
brep_closest_point = BrepClosestPoint(Point=divide_length_4.Points, Brep=brep_2)  # -> Point, Normal, Distance
plane_normal = PlaneNormal(Origin=brep_closest_point.Point, ZAxis=brep_closest_point.Normal)
align_plane = AlignPlane(Plane=plane_normal, Direction=unit_z)  # -> Plane, Angle
flip_plane = FlipPlane(Plane=align_plane.Plane, ReverseX=False, ReverseY=False, SwapAxes=True)

plane_7 = Plane(flip_plane)

# ---- group: Divide Curve
distance_between_planes = Slider(2.352, range=0..10)
curve_18 = Curve(reparameterize(curve_16))
number_11 = Number(distance_between_planes)

length_2 = Length(Curve=curve_18)
division_4 = Division(A=length_2, B=number_11)
divide_curve_5 = DivideCurve(Curve=curve_18, Count=division_4, Kinks=False)  # -> Points, Tangents, Parameters

curve_length = Number(length_2)
point_4 = Point(divide_curve_5.Points)

# ---- group: Create Planes on Projection Sphere
lower_boundary_plane = Plane(plane_3)
projection_sphere_brep = Brep(surface)
point_5 = Point(point_4)
vector_2pt = Vector2Pt(PointA=lower_boundary_plane, PointB=point_5, Unitize=False)  # -> Vector, Length
project_point = ProjectPoint(Point=point_5, Direction=vector_2pt.Vector, Geometry=projection_sphere_brep)  # -> Point, Index; disabled

vector_display = VectorDisplay(Anchor=lower_boundary_plane, Vector=vector_2pt.Vector)
line_sdl = LineSDL(Start=point_5, Direction=vector_2pt.Vector, Length=sphere_radius)
brep_curve = BrepCurve(Brep=projection_sphere_brep, Curve=line_sdl)  # -> Curves, flatten(Points)
interpolate_3 = Interpolate(Vertices=brep_curve.Points, Degree=3, Periodic=False, KnotStyle=1)  # -> Curve, Length, Domain
list_length = ListLength(List=point_5)
divide_curve_6 = DivideCurve(Curve=interpolate_3.Curve, Count=list_length, Kinks=False)  # -> Points, Tangents, Parameters

# ----
line_5 = Line(StartPoint=plane_3, EndPoint=divide_curve_6.Points)

# ---- group: Create Planes on Projection Sphere (continued)
brep_closest_point_2 = BrepClosestPoint(Point=divide_curve_6.Points, Brep=projection_sphere_brep)  # -> Point, Normal, Distance
plane_normal_2 = PlaneNormal(Origin=brep_closest_point_2.Point, ZAxis=brep_closest_point_2.Normal)
plane_8 = Plane(plane_normal_2)

# ----
brep_curve_2 = BrepCurve(Brep=brep, Curve=line_5)  # -> Curves, flatten(Points)

# ---- group: Align Planes on Projection Sphere
sphere_radius_3 = Number(sphere_radius)
plane_9 = Plane(plane_8)

xy_plane_7 = XYPlane(Origin=Point(0, 0, 0))
line_sdl_2 = LineSDL(Start=xy_plane_7, Direction=Vector(0, 0, 1), Length=expr("x+10", sphere_radius_3))
curve_closest_point = CurveClosestPoint(Point=plane_9, Curve=line_sdl_2)  # -> Point, Parameter, Distance
vector_2pt_2 = Vector2Pt(PointA=plane_9, PointB=curve_closest_point.Point, Unitize=False)  # -> Vector, Length
align_plane_2 = AlignPlane(Plane=plane_9, Direction=vector_2pt_2.Vector)  # -> Plane, Angle

plane_10 = Plane(align_plane_2.Plane)

# ----
swap_axes = BooleanToggle(False)
reverse_x = BooleanToggle(True)
reverse_y = BooleanToggle(False)
flip_plane_2 = FlipPlane(Plane=plane_10, ReverseX=reverse_x, ReverseY=reverse_y, SwapAxes=swap_axes)
plane_11 = Plane(flip_plane_2)

# ---- group: Show plane axi
plane_12 = Plane(plane_11)
plane_axis_viewer = PlaneAxisViewer(plane=plane_12, length=Slider(30, range=0..30))

# ----
interpolation_zone_brep = Brep(brep_8)
plane_13 = Plane(plane_11)

point_in_brep = PointInBrep(Brep=interpolation_zone_brep, Point=plane_13, Strict=False)
boolean_4 = Boolean(point_in_brep)
list_length_2 = ListLength(List=boolean_4)
shift_list = ShiftList(List=boolean_4, Shift=1, Wrap=True)
equality = Equality(FirstNumber=boolean_4, SecondNumber=shift_list)  # -> Equality, Inequality
series_2 = Series(Start=0, Step=1, Count=list_length_2)
subtraction_3 = Subtraction(A=list_length_2, B=1)
panel_3 = Panel(subtraction_3)
cull_pattern = CullPattern(List=series_2, CullPattern=equality.Inequality)
first_index = Panel("0")
merge_3 = Merge(Data1=flatten(first_index), Data2=flatten(cull_pattern))
_2nd_index = Panel("1")

subtraction_4 = Subtraction(A=cull_pattern, B=1)

merge_4 = Merge(Data1=flatten(subtraction_4), Data2=flatten(panel_3))
construct_domain_2 = ConstructDomain(DomainStart=merge_3, DomainEnd=merge_4)
sub_list = SubList(List=boolean_4, Domain=construct_domain_2, Wrap=True)  # -> List, Index
sub_list_2 = SubList(List=plane_13, Domain=construct_domain_2, Wrap=True)  # -> List, Index
list_item_5 = ListItem(List=sub_list.List, Index=_2nd_index, Wrap=True)
cull_pattern_2 = CullPattern(List=sub_list_2.List, CullPattern=list_item_5)
clean_tree = CleanTree(RemoveNulls=True, RemoveInvalid=True, RemoveEmpty=True, Tree=cull_pattern_2)

domain_of_indices_to_split_the_list_of_p = Domain(construct_domain_2)  # "Domain of indices to split the list of planes"
projection_sphere_planes_to_interpolate = Plane(clean_tree)
boolean_if_branch_will_be_interpolated = Boolean(list_item_5)
projection_sphere_planes = Plane(sub_list_2.List)

# ---- group: Consecutively rotate interpolation planes
plane_14 = Plane(projection_sphere_planes_to_interpolate)
first_and_last_index = Panel("""0
-1""")
first_index_2 = Panel("0")
list_length_3 = ListLength(List=plane_14)
list_item_6 = ListItem(List=plane_14, Index=first_index_2, Wrap=True)  # -> Item1, Item
list_item_7 = ListItem(List=plane_14, Index=first_and_last_index, Wrap=True)
subtraction_5 = Subtraction(A=list_length_3, B="1")
deconstruct_plane = DeconstructPlane(Plane=list_item_7)  # -> Origin, XAxis, YAxis, ZAxis
vector_2pt_3 = Vector2Pt(PointA=list_item_6.Item1, PointB=list_item_6.Item, Unitize=False)  # -> Vector, Length
xy_plane_8 = XYPlane(Origin=Point(0, 0, 0))
list_item_8 = ListItem(List=deconstruct_plane.XAxis, Index=0, Wrap=True)  # -> Item, Item1
angle = Angle(VectorA=list_item_8.Item, VectorB=list_item_8.Item1, Plane=xy_plane_8)  # -> Angle, Reflex
align_plane_3 = AlignPlane(Plane=plane_14, Direction=vector_2pt_3.Vector)  # -> Plane, Angle

tree_statistics = TreeStatistics(Tree=plane_14)  # -> Paths, Length, Count
panel_4 = Panel("""1
-1""")
number_of_paths = Panel(tree_statistics.Count)
repeat_data = RepeatData(Data=panel_4, Length=number_of_paths)
multiplication = Multiplication(A=angle.Angle, B=simplify(graft(repeat_data)))

construct_domain_3 = ConstructDomain(DomainStart="0", DomainEnd=multiplication)
range_2 = Range(Domain=construct_domain_3, Steps=subtraction_5)
rotate_plane = RotatePlane(Plane=align_plane_3.Plane, Angle=range_2)

# ----
trim_tree = TrimTree(Tree=rotate_plane, Depth=1)

# ---- group: Consecutively rotate interpolation planes (continued)
plane_15 = Plane(trim_tree)

# ---- group: Create planes on form brep
# Comment: Creates Planes on the form Brep and also orders them by wether or not they will be interpolated
domain_of_indices_to_split_the_list_of_p_2 = Domain(domain_of_indices_to_split_the_list_of_p)  # "Domain of indices to split the list of planes"
mold_form_brep = Brep(brep)
point_6 = Point(brep_curve_2.Points)
number_12 = Number(number_11)
number_13 = Number(curve_length)
brep_closest_point_3 = BrepClosestPoint(Point=point_6, Brep=mold_form_brep)  # -> Point, Normal, Distance
plane_normal_3 = PlaneNormal(Origin=brep_closest_point_3.Point, ZAxis=brep_closest_point_3.Normal)
sub_list_3 = SubList(List=plane_normal_3, Domain=domain_of_indices_to_split_the_list_of_p_2, Wrap=True)  # -> List, Index
plane_16 = Plane(sub_list_3.List)

division_5 = Division(A=distance_between_hops, B=number_12)
division_6 = Division(A=number_13, B=distance_between_hops)
range_3 = Range(Domain=Domain(0, 1), Steps=simplify(division_5))  # -> simplify(Range)
list_length_4 = ListLength(List=point_6)
graph_mapper = GraphMapper(
    range_3,
    x0=0,
    x1=1,
    y0=0,
    y1=1,
    container_name="Bezier",
    cpx=[0, 0, 0.6523194909, 1],
    cpy=[0.8211622238, 1, 0.5624730587, 0.3098002076])
multiplication_2 = Multiplication(A=plane_hopping_offset_number, B=graph_mapper)  # -> flatten(Result)
division_7 = Division(A=list_length_4, B=division_5)
duplicate_data = DuplicateData(Data=multiplication_2, Number=division_7, Order=True)
list_length_5 = ListLength(List=duplicate_data)
subtraction_6 = Subtraction(A=list_length_5, B=list_length_4)
series_3 = Series(Start=-1, Step=-1, Count=subtraction_6)
cull_index_2 = CullIndex(List=duplicate_data, Indices=series_3, Wrap=True)
multiplication_3 = Multiplication(A=cull_index_2, B=Slider(-1, range=-1..1))
amplitude = Amplitude(Vector=brep_closest_point_3.Normal, Amplitude=flatten(multiplication_3))
point_7 = Point(point_6)
move_2 = Move(Geometry=point_7, Motion=amplitude)  # -> Geometry, Transform
plane_normal_4 = PlaneNormal(Origin=move_2.Geometry, ZAxis=brep_closest_point_3.Normal)
sub_list_4 = SubList(List=plane_normal_4, Domain=domain_of_indices_to_split_the_list_of_p_2, Wrap=True)  # -> List, Index

plane_17 = Plane(sub_list_4.List)

# ----
polyline = PolyLine(Vertices=flatten(plane_17), Closed=True)

# ---- group: Replace the original planes in the interpolation zone with interpolated ones
boolean_if_branch_will_be_interpolated_2 = Boolean(boolean_if_branch_will_be_interpolated)
projection_sphere_planes_2 = Plane(projection_sphere_planes)
plane_18 = Plane(plane_15)

cull_pattern_3 = CullPattern(List=projection_sphere_planes_2, CullPattern=invert(boolean_if_branch_will_be_interpolated_2))
clean_tree_2 = CleanTree(RemoveNulls=True, RemoveInvalid=True, RemoveEmpty=True, Tree=cull_pattern_3)
trim_tree_2 = TrimTree(Tree=plane_18, Depth=1)
merge_5 = Merge(Data1=plane_18, Data2=clean_tree_2)

plane_19 = Plane(merge_5)

# ---- group: Show plane axi
plane_20 = Plane(plane_19)
plane_axis_viewer_2 = PlaneAxisViewer(plane=plane_20, length=Slider(30, range=0..30))

# ---- group: Align planes on form brep with those on the projection sphere
plane_21 = Plane(plane_17)
plane_22 = Plane(plane_19)

align_planes = AlignPlanes(Planes=simplify(graft(plane_21)), Master=simplify(graft(plane_22)))
cull_duplicates = CullDuplicates(Points=flatten(align_planes), Tolerance=0.1, CullMode=1)  # -> Points, Indices, Valence
reverse_x_2 = BooleanToggle(True)
swap_axes_2 = BooleanToggle(False)
reverse_y_2 = BooleanToggle(False)
list_item_9 = ListItem(List=flatten(align_planes), Index=cull_duplicates.Indices, Wrap=True)
flip_plane_3 = FlipPlane(Plane=list_item_9, ReverseX=reverse_x_2, ReverseY=reverse_y_2, SwapAxes=swap_axes_2)

plane_23 = Plane(flip_plane_3)

# ---- group: Show plane axi
plane_24 = Plane(plane_23)
plane_axis_viewer_3 = PlaneAxisViewer(plane=plane_24, length=Slider(30, range=0..30))

# ---- group: Create Form TCP and Mesh
mold_form_brep_2 = Brep(brep)
height_num = Number(height)

pen_sharpness = Slider(15.94, range=0..50)
cap_holes_3 = CapHoles(Brep=mold_form_brep_2)
pen_thickness = Slider(5.3, range=0..100)
point_8 = ConstructPoint(XCoordinate=0, YCoordinate=0, ZCoordinate=height_num)
xy_plane_9 = XYPlane(Origin=point_8)
number_14 = Number(pen_thickness)
number_15 = Number(pen_sharpness)
plane_25 = Plane(xy_plane_9)
mesh = Mesh(cap_holes_3)
pen_holder_mesh = PenHolderMesh(number_3=number_14, number=height_num, number_2=number_15)
create_tool = CreateTool(Name="DefaultGHTool", TCP=plane_25, Weight=0, Mesh=mesh)  # -> Tool, TCP

tool_parameter = ToolParameter(create_tool.Tool)
tcp_plane = Plane(plane_25)

# ---- group: Convert planes to TCP position
plane_26 = Plane(tcp_plane)
plane_27 = Plane(plane_23)
plane_28 = Plane(plane_2)
orient = Orient(Geometry=plane_26, Source=plane_27, Target=plane_28)  # -> Geometry, Transform
transform = Transform(orient.Transform)
plane_29 = Plane(orient.Geometry)

# ----
plane_30 = Plane(plane_29)
unit_z_4 = UnitZ(Factor=Slider(-45.708, range=-100..0))
list_item_10 = ListItem(List=plane_30, Index=0, Wrap=True)
move_3 = Move(Geometry=list_item_10, Motion=unit_z_4)  # -> Geometry, Transform

speed_parameter_3 = SpeedParameter(speed_parameter)
zone_parameter_3 = ZoneParameter(zone_parameter)
tool_parameter_2 = ToolParameter(tool_parameter)
configuration_3 = Integer(configuration)
motion_type_3 = Text(motion_type)
plane_31 = Plane(move_3.Geometry)
create_target = CreateTarget(
    Plane=flatten(plane_31),
    RobConf=configuration_3,
    Motion=motion_type_3,
    Tool=tool_parameter_2,
    Speed=speed_parameter_3,
    Zone=zone_parameter_3,
    IsCartesian=True)
target_parameter = TargetParameter(create_target)

speed_parameter_4 = SpeedParameter(speed_parameter_2)
zone_parameter_4 = ZoneParameter(zone_parameter_2)
tool_parameter_3 = ToolParameter(tool_parameter)
configuration_4 = Integer(configuration_2)
motion_type_4 = Text(motion_type_2)
plane_32 = Plane(plane_29)
create_target_2 = CreateTarget(
    Plane=flatten(plane_32),
    RobConf=configuration_4,
    Motion=motion_type_4,
    Tool=tool_parameter_3,
    Speed=speed_parameter_4,
    Zone=zone_parameter_4,
    IsCartesian=True)
target_parameter_2 = TargetParameter(flatten(create_target_2))

# ---- group: Start angle configuration
_1 = Slider(0, range=-1..1)
_4 = Slider(0, range=-1..1)
_0 = Slider(0, range=-1..1)
_2 = Slider(0, range=-1..1)
_3 = Slider(0, range=-1..1)
_5 = Slider(0, range=-1..1)
boolean_toggle = BooleanToggle(False)

merge_6 = Merge(Data1=_0, Data2=_1, Data3=_2, Data4=_3, Data5=_4, Data6=_5)
multiplication_4 = Multiplication(A="360", B=merge_6)

# ----
zone_soft_radius = Number("6")
tool_parameter_4 = ToolParameter(tool_parameter)
speed_3 = Number(Slider(3, range=0..100))

# ---- group: Create Robot Program
list_5 = ValueList({"Bartlett-IRB120", "Bartlett-IRB1600", "Bartlett-KR6", "Bartlett-KR60", "Bartlett-UR10", "BURG Halle-UR5", "BURG Halle-UR5 on table", "KULeuven-IRB120", "KULeuven-UR5", "KULeuven-UR10"}, selected="BURG Halle-UR5")

load_robot_system = LoadRobotSystem(Name=list_5, Base=PlaneXY(0, 0, 0))

# ---- group: Start angle configuration (continued)
kinematics = Kinematics(RobotSystem=load_robot_system, Target=target_parameter, DisplayGeometry=boolean_toggle)  # -> Meshes, Joints, Planes, Errors
text_split = TextSplit(Text=kinematics.Joints, Separators=",")
degrees = Degrees(Radians=text_split)
subtraction_7 = Subtraction(A=degrees, B=multiplication_4)
number_16 = Number(subtraction_7)
radians_4 = Radians(Degrees=number_16)
text_join = TextJoin(Text=radians_4, Join=",")

# ----
start_angles_before_optimisation = Panel(degrees)
start_angles_after_optimisation = Panel(number_16)

# ---- group: Start angle configuration (continued)
joint_angles = Text(text_join)

# ----
joint_angles_2 = Text(joint_angles)
create_target_3 = CreateTarget(Joints=joint_angles_2, Tool=tool_parameter_4, Speed=speed_3, Zone=zone_soft_radius, IsCartesian=False)
target_parameter_3 = TargetParameter(create_target_3)

# ---- group: Create Robot Program (continued)
merge_7 = Merge(
    Data1=flatten(target_parameter_3),
    Data2=flatten(target_parameter_2),
    Data3=flatten(target_parameter),
    Data4=flatten(target_parameter_3))

create_program = CreateProgram(Name="DefaultProgram", RobotSystem=load_robot_system, Targets1=merge_7, StepSize=program_step_size)  # -> Program, Code, Duration, Warnings, Errors

program_parameter = ProgramParameter(create_program.Program)
number_17 = Number(create_program.Duration)
text = Text(create_program.Code)
text_2 = Text(create_program.Warnings)
text_3 = Text(create_program.Errors)

# ---- group: Program Code and Errors
errors = Panel(text_3)
program_code = Panel(text)
warnings = Panel(text_2)
program = Panel(program_parameter)

# ----
ip_adress = Text(robot_ip_adress)
boolean_5 = Boolean(boolean_2)
boolean_6 = Boolean(boolean_3)
boolean_7 = Boolean(boolean)
remote_connection = RemoteConnection(Program=program_parameter, IP=ip_adress, Upload=boolean_5, Play=boolean_7, Pause=boolean_6)
text_4 = Text(remote_connection)
data_recorder = DataRecorder(text_4, DataLimit=-10, RecordData=True)

# ---- group: Upload to Robot (continued)
text_5 = Text(data_recorder)
log = Panel(text_5)

# ---- group: Length of the program
list_length_6 = ListLength(List=text)
commands = Panel(list_length_6)

# ---- group: Robot Simulation
number_18 = Number(trail_length)
number_19 = Number(number_6)

program_simulation = ProgramSimulation(Program=program_parameter, Time=number_19, Normalized=True)  # -> SystemMeshes, JointRotations, Plane, Index, Time, Program, Errors
check_collisions = CheckCollisions(
    Program=program_simulation.Program,
    FirstSet=7,
    SecondSet=4,
    EnvironmentPlane=-1,
    LinearStepSize=100,
    AngularStepSize=0.7853981634)  # -> CollisionFound, TargetIndex, CollidedMeshes
simple_trail = SimpleTrail(Program=program_simulation.Program, Length=number_18, MechanicalGroup=0)
split_list = SplitList(List=program_simulation.SystemMeshes, Index=7)  # -> ListA, ListB

# ----
current_index = Panel(program_simulation.Index)

# ---- group: Robot Simulation (continued)
collisions = Panel(check_collisions.CollisionFound)
colliding_meshes_mesh = Mesh(check_collisions.CollidedMeshes)
number_20 = Number(program_simulation.JointRotations)
plane_33 = Plane(program_simulation.Plane)
integer = Integer(program_simulation.Index)
curve_19 = Curve(simple_trail)
robot_mesh = Mesh(split_list.ListA)
tool_mesh = Mesh(split_list.ListB)

# ----
number_21 = Number(number_20)
degrees_2 = Degrees(Radians=number_21)
axes_positions = Panel(degrees_2)

# ---- group: Robot Simulation (continued)
tool_mesh_2 = Mesh(tool_mesh)
simulation_robot_trail = Curve(curve_19)
simulatied_robot_mesh = Mesh(robot_mesh)

# ----
preview = CustomPreview(Geometry=simulatied_robot_mesh, Shader=ColourSwatch(SwatchColor=RGB(158, 158, 158)))
preview_2 = CustomPreview(Geometry=tool_mesh_2, Shader=ColourSwatch(SwatchColor=RGB(224, 196, 38)))

plane_34 = Plane(plane_33)
plane_35 = Plane(tcp_plane)

list_item_11 = ListItem(List=plane_34, Index=-1, Wrap=True)
orient_2 = Orient(Source=plane_35, Target=list_item_11)  # -> Geometry, Transform

transform_2 = Transform(orient_2.Transform)

# ---- group: Move Curve according to TCP position
transform_3 = Transform(transform_2)
curve_20 = Curve(polyline)
transform_4 = Transform(Geometry=curve_20, Transform=transform_3)
curve_21 = Curve(transform_4)

# ---- group: Robot Simulation (continued)
curve_in_position = Curve(curve_21)

# ----
preview_3 = CustomPreview(Geometry=curve_in_position, Shader=ColourSwatch(SwatchColor=RGBA(0, 136, 255, 143)))

# ---- group: Create extrusion simulation
simulation_index = Integer(integer)
point_9 = Point(flatten(plane_23))
transform_5 = Transform(transform_2)

split_list_2 = SplitList(List=point_9, Index=simulation_index)  # -> ListA, ListB
point_10 = Point(split_list_2.ListA)
cull_duplicates_2 = CullDuplicates(Points=point_10, Tolerance=Slider(5.268, range=0..10), CullMode=3)  # -> Points, Indices, Valence
interpolate_4 = Interpolate(Vertices=cull_duplicates_2.Points, Degree=3, Periodic=False, KnotStyle=0)  # -> Curve, Length, Domain
pipe = Pipe(Curve=interpolate_4.Curve, Radius=Slider(2.73, range=0..10), Caps=2)
transform_6 = Transform(Geometry=pipe, Transform=transform_5)

# ----
transform_7 = Transform(Geometry=cull_duplicates_2.Points, Transform=transform_5)
polyline_2 = PolyLine(Vertices=point_10, Closed=False)
smooth_polyline = SmoothPolyline(Polyline=polyline_2, Strength=1, Times=1)
reduce = Reduce(Polyline=polyline_2, Tolerance=1)  # -> Polyline, Reduction
transform_8 = Transform(Geometry=interpolate_4.Curve, Transform=transform_5)
custom_preview_lineweights = CustomPreviewLineweights(
    Geometry=flatten(transform_8),
    Shader={diffuse=RGB(255, 105, 180), emission=RGB(76, 32, 54), shine=0.5, specular=RGB(255, 255, 255), transparency=0},
    Thickness=Slider(8.222, range=0..20),
    Absolute=False)

# ---- group: Create extrusion simulation (continued)
brep_14 = Brep(transform_6)

# ---- group: Robot Simulation (continued)
extrusion_brep = Brep(brep_14)

# ----
preview_4 = CustomPreview(Geometry=extrusion_brep, Shader=ColourSwatch(SwatchColor=RGB(255, 31, 31)))

# ==== cluster PenHolderMesh
number = ClusterInput()
number_2 = ClusterInput()
number_3 = ClusterInput()
number_4 = Number(number)
number_5 = Number(number_2)
number_6 = Number(number_3)
subtraction = Subtraction(A=number_4, B=number_5)
unit_z = UnitZ(Factor=subtraction)
unit_z_2 = UnitZ(Factor=number_4)
circle = Circle(Plane=PlaneXY(0, 0, 0), Radius=number_6)
extrude = Extrude(Base=circle, Direction=unit_z)
construct_point = ConstructPoint(XCoordinate=0, YCoordinate=0, ZCoordinate=unit_z_2)
move = Move(Geometry=circle, Motion=unit_z)  # -> Geometry, Transform
extrude_point = ExtrudePoint(Base=move.Geometry, Point=construct_point)
merge = Merge(Data1=extrude_point, Data2=extrude)
mesh_brep = MeshBrep(
    Brep=merge,
    Settings={GridMaxCount=0, GridMinCount=16, JaggedSeams=False, MaxEdgeLength=0, MinEdgeLength=0.0001, MinTolerance=0, Refine=True, RefineAngle=0, RelativeTolerance=0.65, SimplePlanes=True, Tolerance=0})
brep = Brep([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])
mesh = Mesh(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)
merge_2 = Merge(Data1=mesh, Data2=mesh_brep)
mesh_join = MeshJoin(Meshes=merge_2)
mesh_2 = Mesh(mesh_join)
mesh_3 = ClusterOutput(mesh_2)

# ==== cluster PlaneAxisViewer
plane = ClusterInput()
panel = Panel("""Red
Green
Blue""")
length = ClusterInput()  # Size of the vector lines to display
plane_2 = Plane(graft(plane))
colour = Colour(panel)
deconstruct_plane = DeconstructPlane(Plane=plane_2)  # -> Origin, XAxis, YAxis, ZAxis
merge = Merge(Data1=deconstruct_plane.XAxis, Data2=deconstruct_plane.YAxis, Data3=deconstruct_plane.ZAxis)
multiplication = Multiplication(A=length, B=Slider(1.14, range=1..2))
amplitude = Amplitude(Vector=merge, Amplitude=length)
amplitude_2 = Amplitude(Vector=merge, Amplitude=multiplication)
move = Move(Geometry=deconstruct_plane.Origin, Motion=amplitude_2)  # -> Geometry, Transform
panel_2 = Panel("""X
Y
Z""")
text_tag = TextTag(Location=move.Geometry, Text=panel_2, Colour=colour)
vector_display_ex = VectorDisplayEx(Point=deconstruct_plane.Origin, Vector=amplitude, Colour=colour, Width=Slider(3.9, range=0..10))
