# Grasshopper definition Surface Winding 004 (Sphere Section) [Jul-02 '19, 0021].gh (Grasshopper 1.0.7)
# plug-ins: Robots, treesloth01, Anemone, Human

base_sphere_radius = Slider(228.62, range=0.1..500)
base_sphere_height = Slider(250, range=0..1000)
minimal_radius = Slider(15.16, range=0.1..500)
section_radius = Slider(221.8, range=0.1..500)
offset = Panel("0")
diameters = Panel("""135
130
122
121
110""")
heights = Panel("""0
20
175
183
183""")
number = Number(base_sphere_radius)
number_2 = Number(base_sphere_height)
subtraction = Subtraction(A=heights, B=offset)
number_3 = Number(section_radius)
number_4 = Number(minimal_radius)
number_5 = Number(subtraction)
number_6 = Number(diameters)

loop_start = LoopStart(Repeat="1000", Trigger=Button(), Data="0", D1=Slider(0.002, range=0..0.1), D2=Slider(0, range=0..1000))  # -> port, Counter, Data, Data_2, Data_3
addition = Addition(A=loop_start.Data, B=loop_start.Data_2)
larger_than = LargerThan(FirstNumber=addition, SecondNumber="1")  # -> LargerThan, OrEqualTo
time_buffer = TimeBuffer(Data=addition, Ms=loop_start.Data_3, UseThread=False)
gate_or = GateOr(A=Toggle(False), B=larger_than.OrEqualTo)
loop_end = LoopEnd(
    port=loop_start.port,
    Exit=gate_or,
    Data=time_buffer,
    Data_2=loop_start.Data_2,
    Data_3=loop_start.Data_3,
    TimeOutVal=0,
    pausedState=False,
    state="Constant output")  # -> Data, D1, D2
panel = Panel(loop_end.Data)

frame_curve_rotation = Slider(320.17, range=0..720)
cdomain = ConstructDomain(DomainStart=number_4, DomainEnd=number_3)
number_7 = Number(number_3)
range = Range(Domain=cdomain, Steps="24")
circle = Circle(Plane=PlaneXY(0, 0, 0), Radius=number_7)
boundary_surfaces = BoundarySurfaces(Edges=circle)
number_8 = Number(range)
loop_start_2 = LoopStart(Repeat="24", Trigger=Button(), curr_value=number_3, curr_circle=circle, list_of_values=number_8)  # -> port, Counter, Data, Data_2, Data_3, Data_4, Data_5

cdomain_2 = ConstructDomain(DomainStart=Slider(0.1, range=0..1), DomainEnd=Slider(0.358, range=0..1))
multiplication = Multiplication(A=loop_start_2.Counter, B=Slider(347, range=0..1000))
random = Random(Range=cdomain_2, Number=1, Seed=multiplication)

curve = Curve(reparameterize(loop_start_2.Data_2))
curve_2 = Curve(loop_start_2.Data_3)
point = Point(loop_start_2.Data_4)
populate_geometry = PopulateGeometry(Geometry=boundary_surfaces, Count="1", Seed=1, Points=point)
curve_closest_point = CurveClosestPoint(Point=populate_geometry, Curve=curve)  # -> Point, Parameter, Distance
number_9 = Number(loop_start_2.Data)
number_10 = Number(loop_start_2.Data_5)
smaller_than = SmallerThan(FirstNumber=curve_closest_point.Parameter, SecondNumber="0.1")  # -> SmallerThan, OrEqualTo
circle_2 = Circle(Plane=PlaneXY(0, 0, 0), Radius=range)
panel_2 = Panel("""0
-1""")
stream_filter = StreamFilter(Gate=smaller_than.SmallerThan, Stream0=curve_closest_point.Parameter, Stream1=random)
cull_index = CullIndex(List=circle_2, Indices=panel_2, Wrap=True)
multiplication_2 = Multiplication(A=loop_start_2.Counter, B=Slider(292, range=0..1000))
cdomain_3 = ConstructDomain(DomainStart="0", DomainEnd=curve_closest_point.Parameter)
jitter = Jitter(List=number_10, Jitter=1, Seed=multiplication_2)  # -> Values, Indices
first_last = FirstLast(List=jitter.Values)  # -> FirstValue, LastValue
sub_curve = SubCurve(BaseCurve=curve, Domain=cdomain_3)
number_11 = Number(first_last.FirstValue)
end_points = EndPoints(Curve=sub_curve)  # -> Start, End
subtraction_2 = Subtraction(A=number_9, B=number_11)
circle_3 = Circle(Plane=PlaneXY(0, 0, 0), Radius=number_11)
cull_index_2 = CullIndex(List=jitter.Values, Indices="0", Wrap=True)
point_2 = Point(end_points.End)
point_3 = Point(end_points.Start)
xy_plane = XYPlane(Origin=Point(0, 0, 0))
number_12 = Number(cull_index_2)
vector_2pt = Vector2Pt(PointA=point_2, PointB=xy_plane, Unitize=False)  # -> Vector, Length
sphere_size = Slider(525.355, range=0..1000)
line_sdl = LineSDL(Start=point_2, Direction=vector_2pt.Vector, Length=subtraction_2)
line = Line(line_sdl)
sphere_radius = Number(sphere_size)
curve_3 = Curve(sub_curve)
line_2 = Line(line)
merge = Merge(Data1=curve_3, Data2=line_2)  # -> flatten(Result)
point_4 = Point(point_2)
join_curves = JoinCurves(Curves=merge, Preserve=False)
curve_curve = CurveCurve(CurveA=circle_3, CurveB=line)  # -> Points, ParamsA, ParamsB
merge_2 = Merge(Data1=flatten(loop_start_2.Data_4), Data2=flatten(point_4))
merge_3 = Merge(Data1=curve_2, Data2=join_curves)  # -> flatten(Result)
seam = Seam(Curve=circle_3, Seam=curve_curve.ParamsA)
join_curves_2 = JoinCurves(Curves=merge_3, Preserve=False)
circle_4 = Circle(seam)

# ---- group: What ??
number_slider = Slider(3, range=0..10)
division = Division(A="360", B=number_slider)
series = Series(Start=0, Step=division, Count=number_slider)

# ----
number_slider_2 = Slider(0, range=0..100)
loop_end_2 = LoopEnd(
    port=loop_start_2.port,
    Exit=False,
    Data=number_11,
    Data_2=circle_4,
    Data_3=join_curves_2,
    Data_4=merge_2,
    Data_5=number_12,
    TimeOutVal=0,
    pausedState=False,
    state="Output last")  # -> D0, Data, D2, D3, D4
data_recorder = DataRecorder(loop_end_2.D2, DataLimit=-10, RecordData=True)
browse_history = BrowseHistory(
    Iteration=number_slider_2,
    Data_0=loop_end_2.D0,
    Data_1=loop_end_2.Data,
    Data_2=loop_end_2.D2,
    Data_3=loop_end_2.D3,
    Data_4=loop_end_2.D4)  # -> Data_0, Data_1, Data_2, Data_3, Data_4
browse_history_2 = BrowseHistory(Iteration=number_slider_2, Data_0=data_recorder)
curve_4 = Curve(loop_end_2.D2)

radians = Radians(Degrees=series)
yz_plane = YZPlane(Origin=Point(0, 0, 0))
rotate_3d = Rotate3D(Geometry=yz_plane, Angle=radians, Center=Point(0, 0, 0), Axis=Vector(0, 0, 1))  # -> Geometry, Transform

scale = Scale(Geometry=curve_4, Center=Point(0, 0, 0), Factor=Slider(0.95, range=0..1))  # -> Geometry, Transform
surface_closest_point = SurfaceClosestPoint()  # -> Point, UVPoint, Distance

plane = Plane(rotate_3d.Geometry)

evaluate_surface = EvaluateSurface()  # -> Point, Normal, UDirection, VDirection, Frame
curve_5 = Curve(scale.Geometry)
unit_x = UnitX(Factor=1)
swap_axes = BooleanToggle(False)
reverse_y = BooleanToggle(True)
reverse_x = BooleanToggle(True)

speed = Slider(34, range=0..100)
list = FlagFields({"Shoulder": 1, "Elbow": 2, "Wrist": 4}, selected=["Shoulder", "Wrist"])
list_2 = ValueList({"Joint", "Linear"}, selected="Joint")
speed_parameter = SpeedParameter(speed)
zone_parameter = ZoneParameter("2")
configuration = Integer(list)
motion_type = Text(list_2)

speed_2 = Slider(23, range=0..100)
list_3 = FlagFields({"Shoulder": 1, "Elbow": 2, "Wrist": 4}, selected=["Shoulder", "Elbow", "Wrist"])
list_4 = ValueList({"Joint", "Linear"}, selected="Linear")
speed_parameter_2 = SpeedParameter(speed_2)
zone_parameter_2 = ZoneParameter("5")
configuration_2 = Integer(list_3)
motion_type_2 = Text(list_4)

program_step_size = Slider(0.64, range=0..1)
number_13 = Number(loop_end.Data)
colour_picker = ColourPicker(PickedColour=RGB(0, 0, 0))
distance_between_hops = Slider(97.295, range=0..500)
hop_offset = Slider(0, range=0..100)
plane_hopping_offset_number = Number(hop_offset)

speed_3 = Slider(34, range=0..100)
list_5 = FlagFields({"Shoulder": 1, "Elbow": 2, "Wrist": 4}, selected=["Shoulder", "Wrist"])
list_6 = ValueList({"Joint", "Linear"}, selected="Joint")
speed_parameter_3 = SpeedParameter(speed_3)
zone_parameter_3 = ZoneParameter("2")
configuration_3 = Integer(list_5)
motion_type_3 = Text(list_6)

speed_4 = Slider(23, range=0..100)
list_7 = FlagFields({"Shoulder": 1, "Elbow": 2, "Wrist": 4}, selected=["Shoulder", "Wrist"])
list_8 = ValueList({"Joint", "Linear"}, selected="Linear")
speed_parameter_4 = SpeedParameter(speed_4)
zone_parameter_4 = ZoneParameter("5")
configuration_4 = Integer(list_7)
motion_type_4 = Text(list_8)

program_step_size_2 = Slider(0.64, range=0..1)

# ---- group: Create sphere and Helper geometry
# Comment: Creates Sphere according to Z offset and radius. also creates a point and a value of the increased radius (important for boolean operations)
A = Data(number_2)
A_2 = Data(number)

subtraction_3 = Subtraction(A=A, B=A_2)
construct_point = ConstructPoint(XCoordinate=0, YCoordinate=0, ZCoordinate=subtraction_3)
multiplication_3 = Multiplication(A=A_2, B=1.1)
circle_5 = Circle(Plane=construct_point, Radius=multiplication_3)
sphere = Sphere(Base=construct_point, Radius=A_2)
boundary_surfaces_2 = BoundarySurfaces(Edges=circle_5)
split_brep = SplitBrep(Brep=sphere, Cutter=boundary_surfaces_2)  # -> graft(Result)

point_5 = Data(construct_point)
result = Data(split_brep)
result_2 = Data(multiplication_3)

# ----
number_14 = Number(number_5)
number_15 = Number(number_6)

point_6 = ConstructPoint(XCoordinate=0, YCoordinate=0, ZCoordinate=number_14)
division_2 = Division(A=number_15, B=2)
loft_options = LoftOptions(Closed=False, Adjust=False, Rebuild=0, Refit=0, Type=3)
circle_6 = Circle(Plane=point_6, Radius=division_2)
loft = Loft(Curves=circle_6, Options=loft_options)
fillet_edge = FilletEdge(Shape=loft, Blend=2, Metric=0, Edges=Slider(8, range=0..10), Radii=Slider(4, range=0..10))
last = Panel("-1")
list_item = ListItem(List=number_14, Index=last, Wrap=True)

list_item_2 = ListItem(List=circle_6, Index=last, Wrap=True)
boundary_surfaces_3 = BoundarySurfaces(Edges=list_item_2)
merge_4 = Merge(Data1=fillet_edge, Data2=boundary_surfaces_3)
brep_join = BrepJoin(Breps=merge_4)  # -> Breps, Closed
brep = Brep(brep_join.Breps)
height = Number(list_item)

# ---- group: Upload to Robot
robot_ip_adress = Panel("192.168.178.22")
upload = Button()
pause = Button()
play = Button()
boolean = Boolean(play)
boolean_2 = Boolean(upload)
boolean_3 = Boolean(pause)

# ----
number_slider_3 = Slider(20, range=0..100)  # disabled
panel_3 = Panel("10")  # disabled
construct_domain = ConstructDomain(DomainStart=panel_3, DomainEnd=number_3)  # disabled
cdomain_4 = ConstructDomain(DomainStart=number_4, DomainEnd=number_3)  # disabled
panel_4 = Panel("10")  # disabled
range_2 = Range(Domain=construct_domain, Steps=number_slider_3)  # disabled
number_16 = Number(number_3)  # disabled
circle_7 = Circle(Plane=PlaneXY(0, 0, 0), Radius=number_16)  # disabled
boundary_surfaces_4 = BoundarySurfaces(Edges=circle_7)  # disabled
button = Button()  # disabled
circle_8 = Circle(Plane=PlaneXY(0, 0, 0), Radius=range_2)  # disabled
panel_5 = Panel("1")  # disabled
curve_6 = Curve(reparameterize(circle_8))  # disabled
shatter = Shatter(Curve=curve_6)  # disabled
range_3 = Range(Domain=cdomain_4, Steps=panel_4)  # disabled
panel_6 = Panel("0.1")  # disabled
number_slider_4 = Slider(179, range=0..1000)  # disabled
number_17 = Number(range_3)  # disabled
loop_start_3 = LoopStart(Repeat=panel_4, Trigger=button, curr_value=number_3, curr_circle=circle_7, list_of_values=number_17)  # -> port, Counter, Data, Data_2, Data_3, Data_4, Data_5; disabled
number_18 = Number(loop_start_3.Data_5)  # disabled
curve_7 = Curve(reparameterize(loop_start_3.Data_2))  # disabled
curve_8 = Curve(loop_start_3.Data_3)  # disabled
point_7 = Point(loop_start_3.Data_4)  # disabled
populate_geometry_2 = PopulateGeometry(Geometry=boundary_surfaces_4, Count=panel_5, Seed=1, Points=point_7)  # disabled
curve_closest_point_2 = CurveClosestPoint(Point=populate_geometry_2, Curve=curve_7)  # -> Point, Parameter, Distance; disabled
smaller_than_2 = SmallerThan(FirstNumber=curve_closest_point_2.Parameter, SecondNumber=panel_6)  # -> SmallerThan, OrEqualTo; disabled
panel_7 = Panel("0")  # disabled
circle_9 = Circle(Plane=PlaneXY(0, 0, 0), Radius=range_3)  # disabled
panel_8 = Panel("""0
-1""")  # disabled
cull_index_3 = CullIndex(List=circle_9, Indices=panel_8, Wrap=True)  # disabled
multiplication_4 = Multiplication(A=loop_start_3.Counter, B=number_slider_4)  # disabled
jitter_2 = Jitter(List=number_18, Jitter=1, Seed=multiplication_4)  # -> Values, Indices; disabled
first_last_2 = FirstLast(List=jitter_2.Values)  # -> FirstValue, LastValue; disabled
xy_plane_2 = XYPlane(Origin=Point(0, 0, 0))  # disabled
number_19 = Number(first_last_2.FirstValue)  # disabled
number_slider_5 = Slider(0.161, range=0..1)  # disabled
number_slider_6 = Slider(0.851, range=0..1)  # disabled
number_slider_7 = Slider(451, range=0..1000)  # disabled
cdomain_5 = ConstructDomain(DomainStart=number_slider_5, DomainEnd=number_slider_6)  # disabled
multiplication_5 = Multiplication(A=loop_start_3.Counter, B=number_slider_7)  # disabled
random_2 = Random(Range=cdomain_5, Number=1, Seed=multiplication_5)  # disabled
panel_9 = Panel("0")  # disabled
cdomain_6 = ConstructDomain(DomainStart=panel_9, DomainEnd=random_2)  # disabled
panel_10 = Panel("0")  # disabled
panel_11 = Panel("1")  # disabled
merge_5 = Merge(Data1=flatten(panel_10), Data2=flatten(panel_11))  # -> flatten(Result); disabled
xy_plane_3 = XYPlane(Origin=Point(0, 0, 0))  # disabled
number_slider_8 = Slider(1, range=0..100)  # disabled

number_slider_9 = Slider(179, range=0..1000)  # disabled
number_slider_10 = Slider(0.358, range=0..1)  # disabled
number_slider_11 = Slider(0.1, range=0..1)  # disabled
cdomain_7 = ConstructDomain(DomainStart=number_slider_11, DomainEnd=number_slider_10)  # disabled
multiplication_6 = Multiplication(A=loop_start_3.Counter, B=number_slider_9)  # disabled
random_3 = Random(Range=cdomain_7, Number=1, Seed=multiplication_6)  # disabled

# ---- group: Find upper half
# Comment: Over-complicated method of finding the upper half of the sphere if the Brep split rverses the order for any reason
radius_number = Number(result_2)
brep_2 = Brep(result)
point_8 = Point(point_5)

unit_z = UnitZ(Factor=1)
line_sdl_2 = LineSDL(Start=point_8, Direction=unit_z, Length=radius_number)
brep_curve = BrepCurve(Brep=brep_2, Curve=line_sdl_2)  # -> Curves, Points
trim_tree = TrimTree(Tree=brep_curve.Points, Depth=1)
clean_tree = CleanTree(RemoveNulls=True, RemoveInvalid=True, RemoveEmpty=True, Tree=trim_tree)
tree_statistics = TreeStatistics(Tree=clean_tree)  # -> Paths, Length, Count
tree_branch = TreeBranch(Tree=brep_2, Path=tree_statistics.Paths, MaintainPaths=True)

brep_3 = Brep(tree_branch)

# ---- group: Create Section Cutter
section_radius_2 = Number(number_3)
point_9 = Point(point_5)
number_20 = Number(number)

multiplication_7 = Multiplication(A=number_20, B=1.1)
negative = Negative(Value=multiplication_7)
merge_6 = Merge(Data1=multiplication_7, Data2=negative)
cylinder = Cylinder(Base=point_9, Radius=section_radius_2, Length=merge_6)
brep_join_2 = BrepJoin(Breps=cylinder)  # -> Breps, Closed
cap_holes = CapHoles(Brep=brep_join_2.Breps)

brep_4 = Brep(cap_holes)

# ---- group: Lower boundary
lowest_point = Slider(82.619, range=0..200)
brep_5 = Brep(brep)
number_21 = Number(lowest_point)

construct_point_2 = ConstructPoint(XCoordinate=0, YCoordinate=0, ZCoordinate=number_21)
xy_plane_4 = XYPlane(Origin=construct_point_2)
brep_plane = BrepPlane(Brep=brep_5, Plane=xy_plane_4)  # -> Curves, Points

plane_2 = Plane(xy_plane_4)
curve_9 = Curve(brep_plane.Curves)

# ----
number_22 = Number(height)
brep_6 = Brep(brep)

subtraction_4 = Subtraction(A=number_22, B=0.01)
construct_domain_2 = ConstructDomain(DomainStart=Slider(28.045, range=0..40), DomainEnd=subtraction_4)
range_4 = Range(Domain=construct_domain_2, Steps=Slider(7, range=1..30))
construct_point_3 = ConstructPoint(XCoordinate=0, YCoordinate=0, ZCoordinate=range_4)
xy_plane_5 = XYPlane(Origin=construct_point_3)
brep_plane_2 = BrepPlane(Brep=brep_6, Plane=xy_plane_5)  # -> Curves, Points

curve_10 = Curve(brep_plane_2.Curves)

stream_filter_2 = StreamFilter(Gate=smaller_than_2.SmallerThan, Stream0=curve_closest_point_2.Parameter, Stream1=random_3)  # disabled
cdomain_8 = ConstructDomain(DomainStart=panel_7, DomainEnd=stream_filter_2)  # disabled
sub_curve_2 = SubCurve(BaseCurve=curve_7, Domain=cdomain_8)  # disabled
end_points_2 = EndPoints(Curve=sub_curve_2)  # -> Start, End; disabled
point_10 = Point(end_points_2.Start)  # disabled
point_11 = Point(end_points_2.End)  # disabled
vector_2pt_2 = Vector2Pt(PointA=point_11, PointB=xy_plane_2, Unitize=False)  # -> Vector, Length; disabled
curve_11 = Curve(sub_curve_2)  # disabled
point_12 = Point(point_11)  # disabled
merge_7 = Merge(Data1=flatten(loop_start_3.Data_4), Data2=flatten(point_12))  # disabled

# ---- group: Line towards the center
line_sdl_3 = LineSDL(Start=point_11, Direction=vector_2pt_2.Vector, Length=vector_2pt_2.Length)  # disabled
circle_10 = Circle(Plane=PlaneXY(0, 0, 0), Radius=number_4)  # disabled
curve_12 = Curve(reparameterize(line_sdl_3))  # disabled
curve_13 = Curve(circle_10)  # disabled
number_slider_12 = Slider(0.067, range=0..1)  # disabled
number_slider_13 = Slider(451, range=0..1000)  # disabled
curve_curve_2 = CurveCurve(CurveA=curve_13, CurveB=curve_12)  # -> Points, ParamsA, ParamsB; disabled
cdomain_9 = ConstructDomain(DomainStart=number_slider_12, DomainEnd=curve_curve_2.ParamsB)  # disabled
multiplication_8 = Multiplication(A=loop_start_3.Counter, B=number_slider_13)  # disabled
random_4 = Random(Range=cdomain_9, Number=1, Seed=multiplication_8)  # disabled
panel_12 = Panel("0")  # disabled
cdomain_10 = ConstructDomain(DomainStart=panel_12, DomainEnd=random_4)  # disabled
sub_curve_3 = SubCurve(BaseCurve=curve_12, Domain=cdomain_10)  # disabled
line_3 = Line(sub_curve_3)  # disabled

# ---- group: Cut Section
# Comment: Cuts the section from the base sphere and chooses only the section not the outer part of the base sphere
brep_7 = Brep(brep_4)
brep_8 = Brep(brep_3)

split_brep_2 = SplitBrep(Brep=brep_8, Cutter=brep_7)
area = Area(Geometry=split_brep_2)  # -> Area, Centroid
deconstruct = Deconstruct(Point=area.Centroid)  # -> XComponent, YComponent, ZComponent
sort_list = SortList(Keys=deconstruct.ZComponent, ValuesA=split_brep_2)  # -> Keys, ValuesA
panel_13 = Panel("-1")
first_last_3 = FirstLast(List=sort_list.ValuesA)  # -> FirstValue, LastValue

brep_9 = Brep(first_last_3.LastValue)

# ----
brep_10 = Brep(brep_9)
project = Project(Curve=curve_5, Brep=brep_10, Direction=Vector(0, 0, 1))  # -> reparameterize(Curve)
divide_distance = DivideDistance(Curve=project, Distance=Slider(7.6, range=0..100))  # -> Points, Tangents, Parameters
brep_closest_point = BrepClosestPoint(Point=divide_distance.Points, Brep=brep_10)  # -> Point, Normal, Distance
plane_normal = PlaneNormal(Origin=brep_closest_point.Point, ZAxis=brep_closest_point.Normal)
align_plane = AlignPlane(Plane=plane_normal, Direction=unit_x)  # -> Plane, Angle
flip_plane = FlipPlane(Plane=align_plane.Plane, ReverseX=reverse_x, ReverseY=reverse_y, SwapAxes=swap_axes)
plane_3 = Plane(flip_plane)

# ---- group: Line towards the outside
xy_plane_6 = XYPlane(Origin=Point(0, 0, 0))  # disabled
curve_closest_point_3 = CurveClosestPoint(Point=xy_plane_6, Curve=curve_7)  # -> Point, Parameter, Distance; disabled
number_23 = Number(number_3)  # disabled
reverse = Reverse(Vector=vector_2pt_2.Vector)  # disabled
subtraction_5 = Subtraction(A=number_23, B=curve_closest_point_3.Distance)  # disabled
point_13 = Point(point_11)  # disabled
line_sdl_4 = LineSDL(Start=point_13, Direction=reverse, Length=subtraction_5)  # disabled

# ---- group: Projection sphere
sphere_radius_2 = Number(sphere_radius)
plane_4 = Plane(plane_2)
curve_14 = Curve(curve_9)

divide_curve = DivideCurve(Curve=curve_14, Count=10, Kinks=False)  # -> Points, Tangents, Parameters
xy_plane_7 = XYPlane(Origin=plane_4)
line_4 = Line(StartPoint=xy_plane_7, EndPoint=divide_curve.Points)
extend_curve = ExtendCurve(Curve=line_4, Type=0, Start="0", End=Slider(659.077, range=0..1000))
loft_options_2 = LoftOptions(Closed=True, Adjust=False, Rebuild=0, Refit=0, Type=0)
sphere_2 = Sphere(Base=PlaneXY(0, 0, 0), Radius=sphere_radius_2)
loft_2 = Loft(Curves=extend_curve, Options=loft_options_2)
split_brep_3 = SplitBrep(Brep=sphere_2, Cutter=loft_2)
list_item_3 = ListItem(List=split_brep_3, Index=0, Wrap=True)  # -> Item, Item1

surface = Surface(list_item_3.Item)
surface_2 = Surface(list_item_3.Item1)

# ---- group: Create Form TCP and Mesh
height_num = Number(number_2)
mold_form_brep = Brep(brep_9)

cap_holes_2 = CapHoles(Brep=mold_form_brep)
point_14 = ConstructPoint(XCoordinate=0, YCoordinate=0, ZCoordinate=height_num)
xy_plane_8 = XYPlane(Origin=point_14)
plane_5 = Plane(xy_plane_8)
mesh = Mesh(cap_holes_2)
create_tool = CreateTool(Name="DefaultGHTool", TCP=plane_5, Weight=0, Mesh=mesh)  # -> Tool, TCP

tool_parameter = ToolParameter(create_tool.Tool)
tcp_plane = Plane(plane_5)

# ----
sub_curve_4 = SubCurve(BaseCurve=line_sdl_4, Domain=cdomain_6)  # disabled
length = Length(Curve=line_3)  # disabled

# ---- group: Line towards the outside (continued)
line_5 = Line(sub_curve_4)  # disabled

# ----
length_2 = Length(Curve=line_5)  # disabled
merge_8 = Merge(Data1=flatten(length), Data2=flatten(length_2))  # -> flatten(Result); disabled
merge_9 = Merge(Data1=flatten(line_3), Data2=flatten(line_5))  # -> flatten(Result); disabled
sort_list_2 = SortList(Keys=merge_8, ValuesValuesA=merge_9)  # -> Keys, ValuesValuesA; disabled
sort_list_3 = SortList(Keys=merge_8, ValuesValuesA=merge_5)  # -> Keys, ValuesValuesA; disabled
first_last_4 = FirstLast(List=sort_list_2.ValuesValuesA)  # -> FirstValue, LastValue; disabled
first_last_5 = FirstLast(List=sort_list_3.ValuesValuesA)  # -> FirstValue, LastValue; disabled
line_6 = Line(first_last_4.LastValue)  # disabled
line_7 = Line(first_last_4.FirstValue)  # disabled
line_8 = Line(line_6)  # disabled
end_points_3 = EndPoints(Curve=line_8)  # -> Start, End; disabled
distance = Distance(PointA=end_points_3.End, PointB=xy_plane_3)  # disabled
circle_11 = Circle(Plane=PlaneXY(0, 0, 0), Radius=distance)  # disabled
line_9 = Line(line_8)  # disabled
curve_curve_3 = CurveCurve(CurveA=circle_11, CurveB=line_8)  # -> Points, ParamsA, ParamsB; disabled
merge_10 = Merge(Data1=curve_11, Data2=line_9)  # -> flatten(Result); disabled
join_curves_3 = JoinCurves(Curves=merge_10, Preserve=False)  # disabled
seam_2 = Seam(Curve=circle_11, Seam=curve_curve_3.ParamsA)  # disabled
merge_11 = Merge(Data1=curve_8, Data2=join_curves_3)  # -> flatten(Result); disabled
join_curves_4 = JoinCurves(Curves=merge_11, Preserve=False)  # disabled
circle_12 = Circle(seam_2)  # disabled
loop_end_3 = LoopEnd(
    port=loop_start_3.port,
    Exit=False,
    Data_2=circle_12,
    Data_3=join_curves_4,
    Data_4=merge_7,
    TimeOutVal=0,
    pausedState=False,
    state="Output last")  # -> D0, Data, D2, D3, D4; disabled
browse_history_3 = BrowseHistory(Iteration=number_slider_8, Data_0=loop_end_3.Data, Data_1=loop_end_3.D2)  # -> Data_0, Data_1; disabled

brep_11 = Brep(brep)

# ---- group: Create Interpolation Zone
number_slider_14 = Slider(1629.424, range=0..3000)
number_slider_15 = Slider(210, range=0..500)
brep_12 = Brep(surface)

unit_z_2 = UnitZ(Factor=number_slider_14)
circle_13 = Circle(Plane=PlaneXY(0, 0, 0), Radius=number_slider_15)
extrude = Extrude(Base=circle_13, Direction=unit_z_2)
split_brep_4 = SplitBrep(Brep=brep_12, Cutter=extrude)
cap_holes_3 = CapHoles(Brep=extrude)
list_item_4 = ListItem(List=split_brep_4, Index=0, Wrap=True)  # -> Item, Item1

normal_zone = Brep(list_item_4.Item1)
interpolation_zone = Brep(list_item_4.Item)
brep_13 = Brep(cap_holes_3)
brep_14 = Brep(split_brep_4)

# ----
cap_holes_4 = CapHoles(Brep=brep_13)

brep_15 = Brep(brep)
number_slider_16 = Slider(65.6, range=10..100)

brep_16 = Brep(surface)
plane_6 = Plane(plane)
number_24 = Number(frame_curve_rotation)

brep_plane_3 = BrepPlane(Brep=brep_16, Plane=plane_6)  # -> Curves, Points
divide_curve_2 = DivideCurve(Curve=brep_plane_3.Curves, Count=10, Kinks=False)  # -> Points, Tangents, Parameters
panel_14 = Panel("""0
-1""")
cull_index_4 = CullIndex(List=divide_curve_2.Points, Indices=panel_14, Wrap=True)
point_15 = Point(flatten(cull_index_4))
radians_2 = Radians(Degrees=number_24)
interpolate = Interpolate(Vertices=point_15, Degree=3, Periodic=True, KnotStyle=1)  # -> Curve, Length, Domain

rotate = Rotate(Geometry=interpolate.Curve, Angle=radians_2, Plane=PlaneXY(0, 0, 0))  # -> Geometry, Transform
curve_15 = Curve(rotate.Geometry)

curve_16 = Curve(curve_15)
flip_curve = FlipCurve(Curve=curve_16)  # -> Curve, Flag
curve_17 = Curve(curve_16)

xz_plane = XZPlane(Origin=Point(0, 0, 0))
number_25 = Number(Slider(245.485, range=0..720))
plane_7 = Plane(xz_plane)
brep_17 = Brep(surface)
curve_18 = Curve(curve_17)

curve_19 = Curve(curve_18)
trim_with_brep = TrimWithBrep(Curve=curve_19, Brep=cap_holes_4)  # -> Inside, Outside

brep_plane_4 = BrepPlane(Brep=brep_17, Plane=plane_7)  # -> Curves, Points
divide_curve_3 = DivideCurve(Curve=brep_plane_4.Curves, Count=10, Kinks=False)  # -> Points, Tangents, Parameters
point_16 = Point(flatten(divide_curve_3.Points))
interpolate_2 = Interpolate(Vertices=point_16, Degree=3, Periodic=Toggle(False), KnotStyle=1)  # -> Curve, Length, Domain
radians_3 = Radians(Degrees=number_25)
rotate_2 = Rotate(Geometry=interpolate_2.Curve, Angle=radians_3, Plane=PlaneXY(0, 0, 0))  # -> Geometry, Transform

curve_20 = Curve(trim_with_brep.Outside)
curve_21 = Curve(trim_with_brep.Inside)
merge_12 = Merge(Data1=curve_21, Data2=curve_20)
curve_22 = Curve(merge_12)
length_3 = Length(Curve=curve_22)
division_3 = Division(A=length_3, B=number_slider_16)

divide_length = DivideLength(Curve=reparameterize(curve_22), Length=number_slider_16)  # -> Points, Tangents, Parameters
xy_plane_9 = XYPlane(Origin=Point(0, 0, 0))
divide_curve_4 = DivideCurve(Curve=curve_22, Count=division_3, Kinks=False)  # -> Points, Tangents, Parameters
loft_options_3 = LoftOptions(Closed=False, Adjust=False, Rebuild=0, Refit=0, Type=0)
line_10 = Line(StartPoint=xy_plane_9, EndPoint=divide_curve_4.Points)
shatter_2 = Shatter(Curve=reparameterize(graft(curve_22)), Parameters=divide_length.Parameters)
loft_3 = Loft(Curves=line_10, Options=loft_options_3)
end_points_4 = EndPoints(Curve=shatter_2)  # -> Start, End
brep_brep = BrepBrep(BrepA=brep_15, BrepB=loft_3)  # -> Curves, Points

curve_23 = Curve(brep_brep.Curves)

unit_z_3 = UnitZ(Factor=1)

# ---- group: Extruder nozzle position
number_slider_17 = Slider(573.9, range=-1000..1000)
number_slider_18 = Slider(-175, range=-1000..1000)
number_slider_19 = Slider(319.4, range=-1000..1000)

construct_point_4 = ConstructPoint(XCoordinate=number_slider_17, YCoordinate=number_slider_18, ZCoordinate=number_slider_19)
xy_plane_10 = XYPlane(Origin=construct_point_4)

plane_8 = Plane(xy_plane_10)

# ---- group: Convert planes to TCP position
plane_9 = Plane(tcp_plane)
plane_10 = Plane(plane_3)
plane_11 = Plane(plane_8)
orient = Orient(Geometry=plane_9, Source=plane_10, Target=plane_11)  # -> Geometry, Transform
transform = Transform(orient.Transform)
plane_12 = Plane(orient.Geometry)

# ----
plane_13 = Plane(plane_12)
unit_z_4 = UnitZ(Factor=Slider(-45.708, range=-100..0))
list_item_5 = ListItem(List=plane_13, Index=0, Wrap=True)
move = Move(Geometry=list_item_5, Motion=unit_z_4)  # -> Geometry, Transform

speed_parameter_5 = SpeedParameter(speed_parameter)
zone_parameter_5 = ZoneParameter(zone_parameter)
tool_parameter_2 = ToolParameter(tool_parameter)
configuration_5 = Integer(configuration)
motion_type_5 = Text(motion_type)
plane_14 = Plane(move.Geometry)
create_target = CreateTarget(
    Plane=flatten(plane_14),
    RobConf=configuration_5,
    Motion=motion_type_5,
    Tool=tool_parameter_2,
    Speed=speed_parameter_5,
    Zone=zone_parameter_5,
    IsCartesian=True)
target_parameter = TargetParameter(create_target)

speed_parameter_6 = SpeedParameter(speed_parameter_2)
zone_parameter_6 = ZoneParameter(zone_parameter_2)
tool_parameter_3 = ToolParameter(tool_parameter)
configuration_6 = Integer(configuration_2)
motion_type_6 = Text(motion_type_2)
plane_15 = Plane(plane_12)
create_target_2 = CreateTarget(
    Plane=flatten(plane_15),
    RobConf=configuration_6,
    Motion=motion_type_6,
    Tool=tool_parameter_3,
    Speed=speed_parameter_6,
    Zone=zone_parameter_6,
    IsCartesian=True)
target_parameter_2 = TargetParameter(flatten(create_target_2))

# ---- group: Extruder position visualisation
number_slider_20 = Slider(69.678, range=0..100)
unit_z_5 = UnitZ(Factor=number_slider_20)
move_2 = Move(Geometry=plane_8, Motion=unit_z_5)  # -> Geometry, Transform
cone = Cone(Base=move_2.Geometry, Radius=Slider(25.219, range=0..100), Length=expr("-x", number_slider_20))  # -> Cone, Tip
brep_18 = Brep(cone.Cone)

# ----
brep_19 = Brep(brep)
curve_24 = Curve(curve_15)

divide_length_2 = DivideLength(Curve=curve_24, Length=Slider(65.6, range=10..100))  # -> Points, Tangents, Parameters
xy_plane_11 = XYPlane(Origin=Point(0, 0, 0))
loft_options_4 = LoftOptions(Closed=True, Adjust=False, Rebuild=0, Refit=0, Type=0)
line_11 = Line(StartPoint=xy_plane_11, EndPoint=divide_length_2.Points)
loft_4 = Loft(Curves=line_11, Options=loft_options_4)
brep_brep_2 = BrepBrep(BrepA=brep_19, BrepB=loft_4)  # -> Curves, Points

curve_25 = Curve(brep_brep_2.Curves)

curve_26 = Curve(curve_18)
brep_20 = Brep(brep)

divide_length_3 = DivideLength(Curve=curve_26, Length=Slider(15.6, range=10..100))  # -> Points, Tangents, Parameters
loft_options_5 = LoftOptions(Closed=False, Adjust=False, Rebuild=0, Refit=0, Type=0)
line_12 = Line(StartPoint=plane_2, EndPoint=divide_length_3.Points)
loft_5 = Loft(Curves=line_12, Options=loft_options_5)
brep_brep_3 = BrepBrep(BrepA=brep_20, BrepB=loft_5)  # -> Curves, Points

curve_27 = Curve(brep_brep_3.Curves)

curve_28 = Curve(curve_27)

divide_length_4 = DivideLength(Curve=curve_28, Length=Slider(3.594, range=1..10))  # -> Points, Tangents, Parameters
brep_closest_point_2 = BrepClosestPoint(Point=divide_length_4.Points, Brep=brep_11)  # -> Point, Normal, Distance
plane_normal_2 = PlaneNormal(Origin=brep_closest_point_2.Point, ZAxis=brep_closest_point_2.Normal)
align_plane_2 = AlignPlane(Plane=plane_normal_2, Direction=unit_z_3)  # -> Plane, Angle
flip_plane_2 = FlipPlane(Plane=align_plane_2.Plane, ReverseX=False, ReverseY=False, SwapAxes=True)

plane_16 = Plane(flip_plane_2)

# ---- group: Start angle configuration
_0 = Slider(0, range=-1..1)
_1 = Slider(0, range=-1..1)
_2 = Slider(0, range=-1..1)
_3 = Slider(0, range=-1..1)
_4 = Slider(0, range=-1..1)
_5 = Slider(0, range=-1..1)
boolean_toggle = BooleanToggle(False)

# ---- group: Divide Curve
distance_between_planes = Slider(2.352, range=0..10)
curve_29 = Curve(reparameterize(curve_27))
number_26 = Number(distance_between_planes)

length_4 = Length(Curve=curve_29)
division_4 = Division(A=length_4, B=number_26)
divide_curve_5 = DivideCurve(Curve=curve_29, Count=division_4, Kinks=False)  # -> Points, Tangents, Parameters

curve_length = Number(length_4)
point_17 = Point(divide_curve_5.Points)

# ---- group: Start angle configuration
merge_13 = Merge(Data1=_0, Data2=_1, Data3=_2, Data4=_3, Data5=_4, Data6=_5)
multiplication_9 = Multiplication(A="360", B=merge_13)

# ---- group: Create Planes on Projection Sphere
lower_boundary_plane = Plane(plane_2)
projection_sphere_brep = Brep(surface)
point_18 = Point(point_17)
vector_2pt_3 = Vector2Pt(PointA=lower_boundary_plane, PointB=point_18, Unitize=False)  # -> Vector, Length
project_point = ProjectPoint(Point=point_18, Direction=vector_2pt_3.Vector, Geometry=projection_sphere_brep)  # -> Point, Index; disabled

vector_display = VectorDisplay(Anchor=lower_boundary_plane, Vector=vector_2pt_3.Vector)
line_sdl_5 = LineSDL(Start=point_18, Direction=vector_2pt_3.Vector, Length=sphere_radius)
brep_curve_2 = BrepCurve(Brep=projection_sphere_brep, Curve=line_sdl_5)  # -> Curves, flatten(Points)
interpolate_3 = Interpolate(Vertices=brep_curve_2.Points, Degree=3, Periodic=False, KnotStyle=1)  # -> Curve, Length, Domain
list_length = ListLength(List=point_18)
divide_curve_6 = DivideCurve(Curve=interpolate_3.Curve, Count=list_length, Kinks=False)  # -> Points, Tangents, Parameters

# ----
line_13 = Line(StartPoint=plane_2, EndPoint=divide_curve_6.Points)

# ---- group: Create Planes on Projection Sphere (continued)
brep_closest_point_3 = BrepClosestPoint(Point=divide_curve_6.Points, Brep=projection_sphere_brep)  # -> Point, Normal, Distance
plane_normal_3 = PlaneNormal(Origin=brep_closest_point_3.Point, ZAxis=brep_closest_point_3.Normal)
plane_17 = Plane(plane_normal_3)

# ----
brep_curve_3 = BrepCurve(Brep=brep, Curve=line_13)  # -> Curves, flatten(Points)

zone_soft_radius = Number("6")
tool_parameter_4 = ToolParameter()
speed_5 = Number(Slider(3, range=0..100))

# ---- group: Create Robot Program
list_9 = ValueList({"Bartlett-IRB120", "Bartlett-IRB1600", "Bartlett-KR6", "Bartlett-KR60", "Bartlett-UR10", "BURG Halle-UR5", "BURG Halle-UR5 on table", "KULeuven-IRB120", "KULeuven-UR5", "KULeuven-UR10"}, selected="BURG Halle-UR5")

load_robot_system = LoadRobotSystem(Name=list_9, Base=PlaneXY(0, 0, 0))
create_program = CreateProgram(Name="DefaultProgram", RobotSystem=load_robot_system, Targets1=target_parameter_2, StepSize=program_step_size)  # -> Program, Code, Duration, Warnings, Errors

# ---- group: Start angle configuration (continued)
kinematics = Kinematics(RobotSystem=load_robot_system, Target=target_parameter, DisplayGeometry=boolean_toggle)  # -> Meshes, Joints, Planes, Errors
text_split = TextSplit(Text=kinematics.Joints, Separators=",")
degrees = Degrees(Radians=text_split)
subtraction_6 = Subtraction(A=degrees, B=multiplication_9)
number_27 = Number(subtraction_6)
radians_4 = Radians(Degrees=number_27)
text_join = TextJoin(Text=radians_4, Join=",")

# ----
start_angles_before_optimisation = Panel(degrees)
start_angles_after_optimisation = Panel(number_27)

# ---- group: Start angle configuration (continued)
joint_angles = Text(text_join)

# ----
joint_angles_2 = Text(joint_angles)
create_target_3 = CreateTarget(Joints=joint_angles_2, Tool=tool_parameter_4, Speed=speed_5, Zone=zone_soft_radius, IsCartesian=False)
target_parameter_3 = TargetParameter(create_target_3)

# ---- group: Create Robot Program (continued)
merge_14 = Merge(
    Data1=flatten(target_parameter_3),
    Data2=flatten(target_parameter_2),
    Data3=flatten(target_parameter),
    Data4=flatten(target_parameter_3))
program_parameter = ProgramParameter(create_program.Program)
text = Text(create_program.Code)
number_28 = Number(create_program.Duration)
text_2 = Text(create_program.Warnings)
text_3 = Text(create_program.Errors)

# ----
warnings = Panel(text_2)

ip_adress = Text(robot_ip_adress)
boolean_4 = Boolean(boolean_2)
boolean_5 = Boolean(boolean)
boolean_6 = Boolean(boolean_3)
remote_connection = RemoteConnection(Program=program_parameter, IP=ip_adress, Upload=boolean_4, Play=boolean_5, Pause=boolean_6)
text_4 = Text(remote_connection)
data_recorder_2 = DataRecorder(text_4, DataLimit=-10, RecordData=True)

# ---- group: Length of the program
list_length_2 = ListLength(List=text)
commands = Panel(list_length_2)

# ---- group: Program Code and Errors
errors = Panel(text_3)
program_code = Panel(text)

# ---- group: Robot Simulation
extruder_tip = Brep(brep_18)
simulation_control = ControlKnob(Decimals=6, Limit=False, Maximum=1, Minimum=0, Range=0.1, Value=3.695609)
trail_length = Slider(6847, range=0..10000)
modulus = Modulus(A=simulation_control, B="1")
number_29 = Number(Slider(1, range=0..1))

number_30 = Number(trail_length)
number_31 = Number(number_29)

program_simulation = ProgramSimulation(Program=program_parameter, Time=number_31, Normalized=True)  # -> SystemMeshes, JointRotations, Plane, Index, Time, Program, Errors
check_collisions = CheckCollisions(
    Program=program_simulation.Program,
    FirstSet=7,
    SecondSet=4,
    EnvironmentPlane=-1,
    LinearStepSize=100,
    AngularStepSize=0.7853981634)  # -> CollisionFound, TargetIndex, CollidedMeshes
simple_trail = SimpleTrail(Program=program_simulation.Program, Length=number_30, MechanicalGroup=0)
split_list = SplitList(List=program_simulation.SystemMeshes, Index=7)  # -> ListA, ListB

colliding_meshes_mesh = Mesh(check_collisions.CollidedMeshes)
collisions = Panel(check_collisions.CollisionFound)
number_32 = Number(program_simulation.JointRotations)
plane_18 = Plane(program_simulation.Plane)
integer = Integer(program_simulation.Index)
curve_30 = Curve(simple_trail)
robot_mesh = Mesh(split_list.ListA)
tool_mesh = Mesh(split_list.ListB)

tool_mesh_2 = Mesh(tool_mesh)
simulatied_robot_mesh = Mesh(robot_mesh)
simulation_robot_trail = Curve(curve_30)

# ---- group: Align Planes on Projection Sphere
sphere_radius_3 = Number(sphere_radius)
plane_19 = Plane(plane_17)

xy_plane_12 = XYPlane(Origin=Point(0, 0, 0))
line_sdl_6 = LineSDL(Start=xy_plane_12, Direction=Vector(0, 0, 1), Length=expr("x+10", sphere_radius_3))
curve_closest_point_4 = CurveClosestPoint(Point=plane_19, Curve=line_sdl_6)  # -> Point, Parameter, Distance
vector_2pt_4 = Vector2Pt(PointA=plane_19, PointB=curve_closest_point_4.Point, Unitize=False)  # -> Vector, Length
align_plane_3 = AlignPlane(Plane=plane_19, Direction=vector_2pt_4.Vector)  # -> Plane, Angle

plane_20 = Plane(align_plane_3.Plane)

# ----
swap_axes_2 = BooleanToggle(False)
reverse_x_2 = BooleanToggle(True)
reverse_y_2 = BooleanToggle(False)
flip_plane_3 = FlipPlane(Plane=plane_20, ReverseX=reverse_x_2, ReverseY=reverse_y_2, SwapAxes=swap_axes_2)
plane_21 = Plane(flip_plane_3)

# ---- group: Show plane axi
plane_22 = Plane(plane_21)
plane_axis_viewer = PlaneAxisViewer(plane=plane_22, length=Slider(30, range=0..30))

# ----
plane_23 = Plane(plane_18)
plane_24 = Plane(tcp_plane)

list_item_6 = ListItem(List=plane_23, Index=-1, Wrap=True)
orient_2 = Orient(Source=plane_24, Target=list_item_6)  # -> Geometry, Transform

transform_2 = Transform(orient_2.Transform)

preview = CustomPreview(Geometry=simulatied_robot_mesh, Shader=ColourSwatch(SwatchColor=RGB(158, 158, 158)))
preview_2 = CustomPreview(Geometry=tool_mesh_2, Shader=ColourSwatch(SwatchColor=RGB(224, 196, 38)))

# ---- group: Create extrusion simulation
simulation_index = Integer(integer)
point_19 = Point(flatten(plane_3))
transform_3 = Transform(transform_2)

split_list_2 = SplitList(List=point_19, Index=simulation_index)  # -> ListA, ListB
point_20 = Point(split_list_2.ListA)
cull_duplicates = CullDuplicates(Points=point_20, Tolerance=Slider(5.268, range=0..10), CullMode=3)  # -> Points, Indices, Valence
interpolate_4 = Interpolate(Vertices=cull_duplicates.Points, Degree=0, Periodic=False, KnotStyle=0)  # -> Curve, Length, Domain
pipe = Pipe(Curve=interpolate_4.Curve, Radius=Slider(2.73, range=0..10), Caps=2)  # disabled
transform_4 = Transform(Geometry=pipe, Transform=transform_3)

# ----
transform_5 = Transform(Geometry=point_20, Transform=transform_3)
polyline = PolyLine(Vertices=transform_5, Closed=False)
reduce = Reduce(Polyline=polyline, Tolerance=1)  # -> Polyline, Reduction
smooth_polyline = SmoothPolyline(Polyline=polyline, Strength=1, Times=1)
transform_6 = Transform(Geometry=interpolate_4.Curve, Transform=transform_3)
custom_preview_lineweights = CustomPreviewLineweights(Geometry=flatten(polyline), Shader=colour_picker, Thickness=Slider(10.104, range=0..20), Absolute=False)

# ---- group: Create extrusion simulation (continued)
brep_21 = Brep(transform_4)

# ----
interpolation_zone_brep = Brep(brep_13)
plane_25 = Plane(plane_21)

point_in_brep = PointInBrep(Brep=interpolation_zone_brep, Point=plane_25, Strict=False)
boolean_7 = Boolean(point_in_brep)
list_length_3 = ListLength(List=boolean_7)
shift_list = ShiftList(List=boolean_7, Shift=1, Wrap=True)
equality = Equality(FirstNumber=boolean_7, SecondNumber=shift_list)  # -> Equality, Inequality
series_2 = Series(Start=0, Step=1, Count=list_length_3)
subtraction_7 = Subtraction(A=list_length_3, B=1)
panel_15 = Panel(subtraction_7)
cull_pattern = CullPattern(List=series_2, CullPattern=equality.Inequality)
first_index = Panel("0")
merge_15 = Merge(Data1=flatten(first_index), Data2=flatten(cull_pattern))
_2nd_index = Panel("1")

subtraction_8 = Subtraction(A=cull_pattern, B=1)

merge_16 = Merge(Data1=flatten(subtraction_8), Data2=flatten(panel_15))
construct_domain_3 = ConstructDomain(DomainStart=merge_15, DomainEnd=merge_16)
sub_list = SubList(List=boolean_7, Domain=construct_domain_3, Wrap=True)  # -> List, Index
sub_list_2 = SubList(List=plane_25, Domain=construct_domain_3, Wrap=True)  # -> List, Index
list_item_7 = ListItem(List=sub_list.List, Index=_2nd_index, Wrap=True)
cull_pattern_2 = CullPattern(List=sub_list_2.List, CullPattern=list_item_7)
clean_tree_2 = CleanTree(RemoveNulls=True, RemoveInvalid=True, RemoveEmpty=True, Tree=cull_pattern_2)

domain_of_indices_to_split_the_list_of_p = Domain(construct_domain_3)  # "Domain of indices to split the list of planes"
projection_sphere_planes_to_interpolate = Plane(clean_tree_2)
boolean_if_branch_will_be_interpolated = Boolean(list_item_7)
projection_sphere_planes = Plane(sub_list_2.List)

# ---- group: Consecutively rotate interpolation planes
plane_26 = Plane(projection_sphere_planes_to_interpolate)
first_and_last_index = Panel("""0
-1""")
first_index_2 = Panel("0")
list_length_4 = ListLength(List=plane_26)
list_item_8 = ListItem(List=plane_26, Index=first_index_2, Wrap=True)  # -> Item1, Item
list_item_9 = ListItem(List=plane_26, Index=first_and_last_index, Wrap=True)
subtraction_9 = Subtraction(A=list_length_4, B="1")
deconstruct_plane = DeconstructPlane(Plane=list_item_9)  # -> Origin, XAxis, YAxis, ZAxis
vector_2pt_5 = Vector2Pt(PointA=list_item_8.Item1, PointB=list_item_8.Item, Unitize=False)  # -> Vector, Length
xy_plane_13 = XYPlane(Origin=Point(0, 0, 0))
list_item_10 = ListItem(List=deconstruct_plane.XAxis, Index=0, Wrap=True)  # -> Item, Item1
angle = Angle(VectorA=list_item_10.Item, VectorB=list_item_10.Item1, Plane=xy_plane_13)  # -> Angle, Reflex
align_plane_4 = AlignPlane(Plane=plane_26, Direction=vector_2pt_5.Vector)  # -> Plane, Angle

tree_statistics_2 = TreeStatistics(Tree=plane_26)  # -> Paths, Length, Count
panel_16 = Panel("""1
-1""")
number_of_paths = Panel(tree_statistics_2.Count)
repeat_data = RepeatData(Data=panel_16, Length=number_of_paths)
multiplication_10 = Multiplication(A=angle.Angle, B=simplify(graft(repeat_data)))

construct_domain_4 = ConstructDomain(DomainStart="0", DomainEnd=multiplication_10)
range_5 = Range(Domain=construct_domain_4, Steps=subtraction_9)
rotate_plane = RotatePlane(Plane=align_plane_4.Plane, Angle=range_5)

# ----
trim_tree_2 = TrimTree(Tree=rotate_plane, Depth=1)

# ---- group: Consecutively rotate interpolation planes (continued)
plane_27 = Plane(trim_tree_2)

# ---- group: Create planes on form brep
# Comment: Creates Planes on the form Brep and also orders them by wether or not they will be interpolated
domain_of_indices_to_split_the_list_of_p_2 = Domain(domain_of_indices_to_split_the_list_of_p)  # "Domain of indices to split the list of planes"
mold_form_brep_2 = Brep(brep)
point_21 = Point(brep_curve_3.Points)
number_33 = Number(number_26)
number_34 = Number(curve_length)
brep_closest_point_4 = BrepClosestPoint(Point=point_21, Brep=mold_form_brep_2)  # -> Point, Normal, Distance
plane_normal_4 = PlaneNormal(Origin=brep_closest_point_4.Point, ZAxis=brep_closest_point_4.Normal)
sub_list_3 = SubList(List=plane_normal_4, Domain=domain_of_indices_to_split_the_list_of_p_2, Wrap=True)  # -> List, Index
plane_28 = Plane(sub_list_3.List)

division_5 = Division(A=distance_between_hops, B=number_33)
division_6 = Division(A=number_34, B=distance_between_hops)
range_6 = Range(Domain=Domain(0, 1), Steps=simplify(division_5))  # -> simplify(Range)
list_length_5 = ListLength(List=point_21)
graph_mapper = GraphMapper(
    range_6,
    x0=0,
    x1=1,
    y0=0,
    y1=1,
    container_name="Bezier",
    cpx=[0, 0, 0.6523194909, 1],
    cpy=[0.8211622238, 1, 0.5624730587, 0.3098002076])
multiplication_11 = Multiplication(A=plane_hopping_offset_number, B=graph_mapper)  # -> flatten(Result)
division_7 = Division(A=list_length_5, B=division_5)
duplicate_data = DuplicateData(Data=multiplication_11, Number=division_7, Order=True)
list_length_6 = ListLength(List=duplicate_data)
subtraction_10 = Subtraction(A=list_length_6, B=list_length_5)
series_3 = Series(Start=-1, Step=-1, Count=subtraction_10)
cull_index_5 = CullIndex(List=duplicate_data, Indices=series_3, Wrap=True)
multiplication_12 = Multiplication(A=cull_index_5, B=Slider(-1, range=-1..1))
amplitude = Amplitude(Vector=brep_closest_point_4.Normal, Amplitude=flatten(multiplication_12))
point_22 = Point(point_21)
move_3 = Move(Geometry=point_22, Motion=amplitude)  # -> Geometry, Transform
plane_normal_5 = PlaneNormal(Origin=move_3.Geometry, ZAxis=brep_closest_point_4.Normal)
sub_list_4 = SubList(List=plane_normal_5, Domain=domain_of_indices_to_split_the_list_of_p_2, Wrap=True)  # -> List, Index

plane_29 = Plane(sub_list_4.List)

# ----
polyline_2 = PolyLine(Vertices=flatten(plane_29), Closed=True)

# ---- group: Replace the original planes in the interpolation zone with interpolated ones
boolean_if_branch_will_be_interpolated_2 = Boolean(boolean_if_branch_will_be_interpolated)
projection_sphere_planes_2 = Plane(projection_sphere_planes)
plane_30 = Plane(plane_27)

cull_pattern_3 = CullPattern(List=projection_sphere_planes_2, CullPattern=invert(boolean_if_branch_will_be_interpolated_2))
clean_tree_3 = CleanTree(RemoveNulls=True, RemoveInvalid=True, RemoveEmpty=True, Tree=cull_pattern_3)
trim_tree_3 = TrimTree(Tree=plane_30, Depth=1)
merge_17 = Merge(Data1=plane_30, Data2=clean_tree_3)

plane_31 = Plane(merge_17)

# ---- group: Show plane axi
plane_32 = Plane(plane_31)
plane_axis_viewer_2 = PlaneAxisViewer(plane=plane_32, length=Slider(30, range=0..30))

# ---- group: Align planes on form brep with those on the projection sphere
plane_33 = Plane(plane_29)
plane_34 = Plane(plane_31)

align_planes = AlignPlanes(Planes=simplify(graft(plane_33)), Master=simplify(graft(plane_34)))
cull_duplicates_2 = CullDuplicates(Points=flatten(align_planes), Tolerance=0.1, CullMode=1)  # -> Points, Indices, Valence
reverse_x_3 = BooleanToggle(True)
swap_axes_3 = BooleanToggle(False)
reverse_y_3 = BooleanToggle(False)
list_item_11 = ListItem(List=flatten(align_planes), Index=cull_duplicates_2.Indices, Wrap=True)
flip_plane_4 = FlipPlane(Plane=list_item_11, ReverseX=reverse_x_3, ReverseY=reverse_y_3, SwapAxes=swap_axes_3)

plane_35 = Plane(flip_plane_4)

# ---- group: Show plane axi
plane_36 = Plane(plane_35)
plane_axis_viewer_3 = PlaneAxisViewer(plane=plane_36, length=Slider(30, range=0..30))

# ---- group: Create Form TCP and Mesh
mold_form_brep_3 = Brep(brep)
height_num_2 = Number(height)

pen_sharpness = Slider(15.94, range=0..50)
cap_holes_5 = CapHoles(Brep=mold_form_brep_3)
pen_thickness = Slider(5.3, range=0..100)
point_23 = ConstructPoint(XCoordinate=0, YCoordinate=0, ZCoordinate=height_num_2)
xy_plane_14 = XYPlane(Origin=point_23)
number_35 = Number(pen_sharpness)
number_36 = Number(pen_thickness)
plane_37 = Plane(xy_plane_14)
mesh_2 = Mesh(cap_holes_5)
pen_holder_mesh = PenHolderMesh(number_3=number_36, number=height_num_2, number_2=number_35)
create_tool_2 = CreateTool(Name="DefaultGHTool", TCP=plane_37, Weight=0, Mesh=mesh_2)  # -> Tool, TCP

tool_parameter_5 = ToolParameter(create_tool_2.Tool)
tcp_plane_2 = Plane(plane_37)

# ---- group: Convert planes to TCP position
plane_38 = Plane(tcp_plane_2)
plane_39 = Plane(plane_35)
plane_40 = Plane(plane_8)
orient_3 = Orient(Geometry=plane_38, Source=plane_39, Target=plane_40)  # -> Geometry, Transform
transform_7 = Transform(orient_3.Transform)
plane_41 = Plane(orient_3.Geometry)

# ----
plane_42 = Plane(plane_41)
unit_z_6 = UnitZ(Factor=Slider(-45.708, range=-100..0))
list_item_12 = ListItem(List=plane_42, Index=0, Wrap=True)
move_4 = Move(Geometry=list_item_12, Motion=unit_z_6)  # -> Geometry, Transform

speed_parameter_7 = SpeedParameter(speed_parameter_3)
zone_parameter_7 = ZoneParameter(zone_parameter_3)
tool_parameter_6 = ToolParameter(tool_parameter_5)
configuration_7 = Integer(configuration_3)
motion_type_7 = Text(motion_type_3)
plane_43 = Plane(move_4.Geometry)
create_target_4 = CreateTarget(
    Plane=flatten(plane_43),
    RobConf=configuration_7,
    Motion=motion_type_7,
    Tool=tool_parameter_6,
    Speed=speed_parameter_7,
    Zone=zone_parameter_7,
    IsCartesian=True)
target_parameter_4 = TargetParameter(create_target_4)

speed_parameter_8 = SpeedParameter(speed_parameter_4)
zone_parameter_8 = ZoneParameter(zone_parameter_4)
tool_parameter_7 = ToolParameter(tool_parameter_5)
configuration_8 = Integer(configuration_4)
motion_type_8 = Text(motion_type_4)
plane_44 = Plane(plane_41)
create_target_5 = CreateTarget(
    Plane=flatten(plane_44),
    RobConf=configuration_8,
    Motion=motion_type_8,
    Tool=tool_parameter_7,
    Speed=speed_parameter_8,
    Zone=zone_parameter_8,
    IsCartesian=True)
target_parameter_5 = TargetParameter(flatten(create_target_5))

# ---- group: Start angle configuration
_1_2 = Slider(0, range=-1..1)
_3_2 = Slider(0, range=-1..1)
_4_2 = Slider(0, range=-1..1)
_5_2 = Slider(0, range=-1..1)
_0_2 = Slider(0, range=-1..1)
_2_2 = Slider(0, range=-1..1)
boolean_toggle_2 = BooleanToggle(False)

merge_18 = Merge(Data1=_0_2, Data2=_1_2, Data3=_2_2, Data4=_3_2, Data5=_4_2, Data6=_5_2)
multiplication_13 = Multiplication(A="360", B=merge_18)

# ----
zone_soft_radius_2 = Number("6")
tool_parameter_8 = ToolParameter(tool_parameter_5)
speed_6 = Number(Slider(3, range=0..100))

# ---- group: Create Robot Program
list_10 = ValueList({"Bartlett-IRB120", "Bartlett-IRB1600", "Bartlett-KR6", "Bartlett-KR60", "Bartlett-UR10", "BURG Halle-UR5", "BURG Halle-UR5 on table", "KULeuven-IRB120", "KULeuven-UR5", "KULeuven-UR10"}, selected="BURG Halle-UR5")

load_robot_system_2 = LoadRobotSystem(Name=list_10, Base=PlaneXY(0, 0, 0))

# ---- group: Start angle configuration (continued)
kinematics_2 = Kinematics(RobotSystem=load_robot_system_2, Target=target_parameter_4, DisplayGeometry=boolean_toggle_2)  # -> Meshes, Joints, Planes, Errors
text_split_2 = TextSplit(Text=kinematics_2.Joints, Separators=",")
degrees_2 = Degrees(Radians=text_split_2)
subtraction_11 = Subtraction(A=degrees_2, B=multiplication_13)
number_37 = Number(subtraction_11)
radians_5 = Radians(Degrees=number_37)
text_join_2 = TextJoin(Text=radians_5, Join=",")

# ----
start_angles_before_optimisation_2 = Panel(degrees_2)
start_angles_after_optimisation_2 = Panel(number_37)

# ---- group: Start angle configuration (continued)
joint_angles_3 = Text(text_join_2)

# ----
joint_angles_4 = Text(joint_angles_3)
create_target_6 = CreateTarget(Joints=joint_angles_4, Tool=tool_parameter_8, Speed=speed_6, Zone=zone_soft_radius_2, IsCartesian=False)
target_parameter_6 = TargetParameter(create_target_6)

# ---- group: Create Robot Program (continued)
merge_19 = Merge(
    Data1=flatten(target_parameter_6),
    Data2=flatten(target_parameter_5),
    Data3=flatten(target_parameter_4),
    Data4=flatten(target_parameter_6))

create_program_2 = CreateProgram(Name="DefaultProgram", RobotSystem=load_robot_system_2, Targets1=merge_19, StepSize=program_step_size_2)  # -> Program, Code, Duration, Warnings, Errors

program_parameter_2 = ProgramParameter(create_program_2.Program)
number_38 = Number(create_program_2.Duration)
text_5 = Text(create_program_2.Warnings)
text_6 = Text(create_program_2.Errors)
text_7 = Text(create_program_2.Code)

# ---- group: Program Code and Errors
program_code_2 = Panel(text_7)
errors_2 = Panel(text_6)
program = Panel(program_parameter_2)
warnings_3 = Panel(text_5)

# ----
ip_adress_2 = Text(robot_ip_adress)
boolean_8 = Boolean(boolean_2)
boolean_9 = Boolean(boolean)
boolean_10 = Boolean(boolean_3)
remote_connection_2 = RemoteConnection(Program=program_parameter_2, IP=ip_adress_2, Upload=boolean_8, Play=boolean_9, Pause=boolean_10)
text_8 = Text(remote_connection_2)
data_recorder_3 = DataRecorder(text_8, DataLimit=-10, RecordData=True)

# ---- group: Upload to Robot (continued)
text_9 = Text(data_recorder_3)
log = Panel(text_9)

# ---- group: Length of the program
list_length_7 = ListLength(List=text_7)
commands_2 = Panel(list_length_7)

# ---- group: Robot Simulation
number_39 = Number(trail_length)
number_40 = Number(number_29)

program_simulation_2 = ProgramSimulation(Program=program_parameter_2, Time=number_40, Normalized=True)  # -> SystemMeshes, JointRotations, Plane, Index, Time, Program, Errors
check_collisions_2 = CheckCollisions(
    Program=program_simulation_2.Program,
    FirstSet=7,
    SecondSet=4,
    EnvironmentPlane=-1,
    LinearStepSize=100,
    AngularStepSize=0.7853981634)  # -> CollisionFound, TargetIndex, CollidedMeshes
simple_trail_2 = SimpleTrail(Program=program_simulation_2.Program, Length=number_39, MechanicalGroup=0)
split_list_3 = SplitList(List=program_simulation_2.SystemMeshes, Index=7)  # -> ListA, ListB

# ----
current_index = Panel(program_simulation_2.Index)

# ---- group: Robot Simulation (continued)
colliding_meshes_mesh_2 = Mesh(check_collisions_2.CollidedMeshes)
collisions_2 = Panel(check_collisions_2.CollisionFound)
number_41 = Number(program_simulation_2.JointRotations)
plane_45 = Plane(program_simulation_2.Plane)
integer_2 = Integer(program_simulation_2.Index)
curve_31 = Curve(simple_trail_2)
robot_mesh_2 = Mesh(split_list_3.ListA)
tool_mesh_3 = Mesh(split_list_3.ListB)

# ----
number_42 = Number(number_41)
degrees_3 = Degrees(Radians=number_42)
axes_positions = Panel(degrees_3)

plane_46 = Plane(plane_45)
plane_47 = Plane(tcp_plane_2)

list_item_13 = ListItem(List=plane_46, Index=-1, Wrap=True)
orient_4 = Orient(Source=plane_47, Target=list_item_13)  # -> Geometry, Transform

transform_8 = Transform(orient_4.Transform)

# ---- group: Move Curve according to TCP position
transform_9 = Transform(transform_8)
curve_32 = Curve(polyline_2)
transform_10 = Transform(Geometry=curve_32, Transform=transform_9)
curve_33 = Curve(transform_10)

# ---- group: Robot Simulation (continued)
curve_in_position = Curve(curve_33)  # disabled

# ----
preview_3 = CustomPreview(Geometry=curve_in_position, Shader=ColourSwatch(SwatchColor=RGBA(0, 136, 255, 143)))

# ---- group: Create extrusion simulation
simulation_index_2 = Integer(integer_2)
point_24 = Point(flatten(plane_35))
transform_11 = Transform(transform_8)

split_list_4 = SplitList(List=point_24, Index=simulation_index_2)  # -> ListA, ListB
point_25 = Point(split_list_4.ListA)
cull_duplicates_3 = CullDuplicates(Points=point_25, Tolerance=Slider(5.268, range=0..10), CullMode=3)  # -> Points, Indices, Valence
interpolate_5 = Interpolate(Vertices=cull_duplicates_3.Points, Degree=3, Periodic=False, KnotStyle=0)  # -> Curve, Length, Domain
pipe_2 = Pipe(Curve=interpolate_5.Curve, Radius=Slider(2.73, range=0..10), Caps=2)
transform_12 = Transform(Geometry=pipe_2, Transform=transform_11)

# ----
transform_13 = Transform(Geometry=cull_duplicates_3.Points, Transform=transform_11)
polyline_3 = PolyLine(Vertices=point_25, Closed=False)
smooth_polyline_2 = SmoothPolyline(Polyline=polyline_3, Strength=1, Times=1)
reduce_2 = Reduce(Polyline=polyline_3, Tolerance=1)  # -> Polyline, Reduction
transform_14 = Transform(Geometry=interpolate_5.Curve, Transform=transform_11)
custom_preview_lineweights_2 = CustomPreviewLineweights(
    Geometry=flatten(transform_14),
    Shader={diffuse=RGB(255, 105, 180), emission=RGB(76, 32, 54), shine=0.5, specular=RGB(255, 255, 255), transparency=0},
    Thickness=Slider(8.222, range=0..20),
    Absolute=False)

# ---- group: Create extrusion simulation (continued)
brep_22 = Brep(transform_12)

# ---- group: Robot Simulation (continued)
extrusion_brep = Brep(brep_22)  # disabled

# ----
preview_4 = CustomPreview(Geometry=extrusion_brep, Shader=ColourSwatch(SwatchColor=RGB(255, 31, 31)))

# ==== cluster PenHolderMesh
number = ClusterInput()
number_2 = ClusterInput()
number_3 = ClusterInput()
number_4 = Number(number)
number_5 = Number(number_2)
number_6 = Number(number_3)
subtraction = Subtraction(A=number_4, B=number_5)
unit_z = UnitZ(Factor=subtraction)
unit_z_2 = UnitZ(Factor=number_4)
circle = Circle(Plane=PlaneXY(0, 0, 0), Radius=number_6)
extrude = Extrude(Base=circle, Direction=unit_z)
construct_point = ConstructPoint(XCoordinate=0, YCoordinate=0, ZCoordinate=unit_z_2)
move = Move(Geometry=circle, Motion=unit_z)  # -> Geometry, Transform
extrude_point = ExtrudePoint(Base=move.Geometry, Point=construct_point)
merge = Merge(Data1=extrude_point, Data2=extrude)
mesh_brep = MeshBrep(
    Brep=merge,
    Settings={GridMaxCount=0, GridMinCount=16, JaggedSeams=False, MaxEdgeLength=0, MinEdgeLength=0.0001, MinTolerance=0, Refine=True, RefineAngle=0, RelativeTolerance=0.65, SimplePlanes=True, Tolerance=0})
brep = Brep([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])
mesh = Mesh(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)
merge_2 = Merge(Data1=mesh, Data2=mesh_brep)
mesh_join = MeshJoin(Meshes=merge_2)
mesh_2 = Mesh(mesh_join)
mesh_3 = ClusterOutput(mesh_2)

# ==== cluster PlaneAxisViewer
plane = ClusterInput()
panel = Panel("""Red
Green
Blue""")
length = ClusterInput()  # Size of the vector lines to display
plane_2 = Plane(graft(plane))
colour = Colour(panel)
deconstruct_plane = DeconstructPlane(Plane=plane_2)  # -> Origin, XAxis, YAxis, ZAxis
merge = Merge(Data1=deconstruct_plane.XAxis, Data2=deconstruct_plane.YAxis, Data3=deconstruct_plane.ZAxis)
multiplication = Multiplication(A=length, B=Slider(1.14, range=1..2))
amplitude = Amplitude(Vector=merge, Amplitude=length)
amplitude_2 = Amplitude(Vector=merge, Amplitude=multiplication)
move = Move(Geometry=deconstruct_plane.Origin, Motion=amplitude_2)  # -> Geometry, Transform
panel_2 = Panel("""X
Y
Z""")
text_tag = TextTag(Location=move.Geometry, Text=panel_2, Colour=colour)
vector_display_ex = VectorDisplayEx(Point=deconstruct_plane.Origin, Vector=amplitude, Colour=colour, Width=Slider(3.9, range=0..10))
