# Grasshopper definition Surface Winding 004 (Sphere sidetable 01) [Jul-07 '19, 1837].gh (Grasshopper 1.0.7)
# plug-ins: Robots, treesloth01, Anemone, Human

base_sphere_radius = Slider(150, range=0.1..500)
base_sphere_height = Slider(250, range=0..1000)
minimal_radius = Slider(40, range=0.1..500)
section_radius = Slider(150, range=0.1..500)
number = Number(base_sphere_radius)
division = Division(A="455", B=2)
number_2 = Number(base_sphere_height)
number_3 = Number(section_radius)
number_4 = Number(minimal_radius)
cdomain = ConstructDomain(DomainStart=number_4, DomainEnd=number_3)
range = Range(Domain=cdomain, Steps="15")
subtraction = Subtraction(A="15", B=2)
circle = Circle(Plane=PlaneXY(0, 0, 0), Radius=range)
panel = Panel("""0
-1""")
cull_index = CullIndex(List=range, Indices=panel, Wrap=True)
number_5 = Number(number_3)
circle_2 = Circle(Plane=PlaneXY(0, 0, 0), Radius=number_5)
boundary_surfaces = BoundarySurfaces(Edges=circle_2)
number_6 = Number(cull_index)
loop_start = LoopStart(Repeat=subtraction, Trigger=Button(), curr_value=number_3, curr_circle=circle_2, list_of_values=number_6)  # -> port, Counter, Data, Data_2, Data_3, Data_4, Data_5

cdomain_2 = ConstructDomain(DomainStart=Slider(0.122, range=0..1), DomainEnd=Slider(0.777, range=0..1))
multiplication = Multiplication(A=loop_start.Counter, B=Slider(620, range=0..1000))
random = Random(Range=cdomain_2, Number=1, Seed=multiplication)

curve = Curve(reparameterize(loop_start.Data_2))
curve_2 = Curve(loop_start.Data_3)
point = Point(loop_start.Data_4)
populate_geometry = PopulateGeometry(Geometry=boundary_surfaces, Count="1", Seed=1, Points=point)
curve_closest_point = CurveClosestPoint(Point=populate_geometry, Curve=curve)  # -> Point, Parameter, Distance
smaller_than = SmallerThan(FirstNumber=curve_closest_point.Parameter, SecondNumber="0.1")  # -> SmallerThan, OrEqualTo
number_7 = Number(loop_start.Data)
number_8 = Number(loop_start.Data_5)
panel_2 = Panel(loop_start.Counter)
list_length = ListLength(List=curve_closest_point.Parameter)
boolean = Boolean(invert(list_length))
gate_or = GateOr(A=boolean, B=smaller_than.SmallerThan)
stream_filter = StreamFilter(Gate=gate_or, Stream0=curve_closest_point.Parameter, Stream1=random)
multiplication_2 = Multiplication(A=loop_start.Counter, B=Slider(530, range=0..1000))
cdomain_3 = ConstructDomain(DomainStart="0", DomainEnd=random)
jitter = Jitter(List=number_8, Jitter=1, Seed=multiplication_2)  # -> Values, Indices
first_last = FirstLast(List=jitter.Values)  # -> FirstValue, LastValue
sub_curve = SubCurve(BaseCurve=curve, Domain=cdomain_3)
number_9 = Number(first_last.FirstValue)
end_points = EndPoints(Curve=sub_curve)  # -> Start, End
subtraction_2 = Subtraction(A=number_7, B=number_9)
circle_3 = Circle(Plane=PlaneXY(0, 0, 0), Radius=number_9)
cull_index_2 = CullIndex(List=jitter.Values, Indices="0", Wrap=True)
point_2 = Point(end_points.End)
point_3 = Point(end_points.Start)
xy_plane = XYPlane(Origin=Point(0, 0, 0))
number_10 = Number(cull_index_2)
vector_2pt = Vector2Pt(PointA=point_2, PointB=xy_plane, Unitize=False)  # -> Vector, Length
line_sdl = LineSDL(Start=point_2, Direction=vector_2pt.Vector, Length=subtraction_2)
line = Line(line_sdl)
construct_point = ConstructPoint(XCoordinate=0, YCoordinate=0, ZCoordinate="5")
construct_point_2 = ConstructPoint(XCoordinate=0, YCoordinate=0, ZCoordinate="190")
curve_3 = Curve(sub_curve)
line_2 = Line(line)
merge = Merge(Data1=curve_3, Data2=line_2)  # -> flatten(Result)
cylinder = Cylinder(Base=construct_point, Radius=Slider(4, range=0..1000), Length=Slider(370, range=0..1000))
cylinder_2 = Cylinder(Base=construct_point, Radius=Slider(35, range=0..1000), Length=Slider(207, range=0..1000))
point_4 = Point(point_2)
join_curves = JoinCurves(Curves=merge, Preserve=False)
curve_curve = CurveCurve(CurveA=circle_3, CurveB=line)  # -> Points, ParamsA, ParamsB
merge_2 = Merge(Data1=flatten(loop_start.Data_4), Data2=flatten(point_4))
cap_holes = CapHoles(Brep=cylinder_2)
merge_3 = Merge(Data1=curve_2, Data2=join_curves)  # -> flatten(Result)
seam = Seam(Curve=circle_3, Seam=curve_curve.ParamsA)
circle_4 = Circle(seam)
join_curves_2 = JoinCurves(Curves=merge_3, Preserve=False)
number_slider = Slider(27, range=0..100)
loop_end = LoopEnd(
    port=loop_start.port,
    Exit=False,
    Data=number_9,
    Data_2=circle_4,
    Data_3=join_curves_2,
    Data_4=merge_2,
    Data_5=number_10,
    TimeOutVal=0,
    pausedState=False,
    state="Constant output")  # -> D0, Data, D2, D3, D4
weight_in_kg = Panel("2")
sub_curve_2 = SubCurve(BaseCurve=reparameterize(loop_end.Data), Domain="0 to 0.999")
browse_history = BrowseHistory(
    Iteration=number_slider,
    Data_0=loop_end.D0,
    Data_1=loop_end.Data,
    Data_2=loop_end.D2,
    Data_3=loop_end.D3,
    Data_4=loop_end.D4)  # -> Data_0, Data_1, Data_2, Data_3, Data_4
data_recorder = DataRecorder(loop_end.D2, DataLimit=-10, RecordData=True)
curve_4 = Curve(reparameterize(loop_end.Data))
browse_history_2 = BrowseHistory(Iteration=number_slider, Data_0=data_recorder)
shatter = Shatter(Curve=curve_4, Parameters="1")
merge_4 = Merge(Data1=flatten(loop_end.D2), Data2=flatten(sub_curve_2))
panel_3 = Panel(browse_history.Data_2)
panel_4 = Panel(browse_history.Data_1)
panel_5 = Panel(browse_history.Data_0)
construct_domain = ConstructDomain(DomainStart="0", DomainEnd=Slider(1, range=0..1))
join_curves_3 = JoinCurves(Curves=merge_4, Preserve=False)
panel_6 = Panel(browse_history.Data_3)
panel_7 = Panel(browse_history.Data_4)
curve_5 = Curve(join_curves_3)
sub_curve_3 = SubCurve(BaseCurve=reparameterize(curve_5), Domain=construct_domain)
rotate_frame_shape = Slider(358.7, range=0..360)
surface_closest_point = SurfaceClosestPoint()  # -> Point, UVPoint, Distance
end_points_2 = EndPoints(Curve=curve_5)  # -> Start, End
evaluate_surface = EvaluateSurface()  # -> Point, Normal, UDirection, VDirection, Frame
radians = Radians(Degrees=rotate_frame_shape)
xy_plane_2 = XYPlane(Origin=Point(0, 0, 0))
point_5 = Point(end_points_2.Start)
vector_2pt_2 = Vector2Pt(PointA=point_5, PointB=xy_plane_2, Unitize=False)  # -> Vector, Length
panel_8 = Panel("-15")
line_sdl_2 = LineSDL(Start=point_5, Direction=vector_2pt_2.Vector, Length=vector_2pt_2.Length)
construct_point_3 = ConstructPoint(XCoordinate=0, YCoordinate=0, ZCoordinate=Slider(-15.2, range=-1000..1000))
curve_curve_2 = CurveCurve(CurveA=curve_5, CurveB=line_sdl_2)  # -> Points, ParamsA, ParamsB
xy_plane_3 = XYPlane(Origin=construct_point_3)
unit_x = UnitX(Factor=1)
cull_index_3 = CullIndex(List=curve_curve_2.ParamsB, Indices="0", Wrap=True)
jitter_2 = Jitter(List=cull_index_3, Jitter=1, Seed=Slider(200, range=0..1000))  # -> Values, Indices
swap_axes = BooleanToggle(True)
reverse_y = BooleanToggle(False)
reverse_x = BooleanToggle(True)
first_last_2 = FirstLast(List=jitter_2.Values)  # -> FirstValue, LastValue
swap_axes_2 = BooleanToggle(False)
reverse_y_2 = BooleanToggle(True)
reverse_x_2 = BooleanToggle(True)
cdomain_4 = ConstructDomain(DomainStart="0", DomainEnd=first_last_2.FirstValue)
sub_curve_4 = SubCurve(BaseCurve=line_sdl_2, Domain=cdomain_4)
merge_5 = Merge(Data1=flatten(curve_5), Data2=flatten(sub_curve_4))

speed = Slider(34, range=0..100)
list = FlagFields({"Shoulder": 1, "Elbow": 2, "Wrist": 4}, selected="Shoulder")
list_2 = ValueList({"Joint", "Linear"}, selected="Linear")
speed_parameter = SpeedParameter(speed)
zone_parameter = ZoneParameter("2")
configuration = Integer(list)
motion_type = Text(list_2)

join_curves_4 = JoinCurves(Curves=merge_5, Preserve=False)
scale = Scale(Geometry=join_curves_4, Center=Point(0, 0, 0), Factor=Slider(0.98, range=0..1))  # -> Geometry, Transform
rotate = Rotate(Geometry=scale.Geometry, Angle=radians, Plane=PlaneXY(0, 0, 0))  # -> Geometry, Transform
curve_6 = Curve(rotate.Geometry)
end_points_3 = EndPoints(Curve=join_curves_4)  # -> Start, End
point_6 = Point(end_points_3.End)
point_7 = Point(end_points_3.Start)

speed_2 = Slider(23, range=0..100)
list_3 = FlagFields({"Shoulder": 1, "Elbow": 2, "Wrist": 4}, selected=["Shoulder", "Wrist"])
list_4 = ValueList({"Joint", "Linear"}, selected="Linear")
speed_parameter_2 = SpeedParameter(speed_2)
zone_parameter_2 = ZoneParameter("5")
configuration_2 = Integer(list_3)
motion_type_2 = Text(list_4)

program_step_size = Slider(0.64, range=0..1)  # disabled

number_slider_2 = Slider(0, range=0..1000)  # disabled
number_slider_3 = Slider(0.015, range=0..0.1)  # disabled
panel_9 = Panel("1000")  # disabled
panel_10 = Panel("0")  # disabled
button = Button()  # disabled
loop_start_2 = LoopStart(Repeat=panel_9, Trigger=button, Data=panel_10, D1=number_slider_3, D2=number_slider_2)  # -> port, Counter, Data, Data_2, Data_3; disabled
addition = Addition(A=loop_start_2.Data, B=loop_start_2.Data_2)  # disabled
panel_11 = Panel("1")  # disabled
larger_than = LargerThan(FirstNumber=addition, SecondNumber=panel_11)  # -> LargerThan, OrEqualTo; disabled
time_buffer = TimeBuffer(Data=addition, Ms=loop_start_2.Data_3, UseThread=False)  # disabled
boolean_toggle = BooleanToggle(True)  # disabled
gate_or_2 = GateOr(A=boolean_toggle, B=larger_than.OrEqualTo)  # disabled
loop_end_2 = LoopEnd(
    port=loop_start_2.port,
    Exit=gate_or_2,
    Data=time_buffer,
    Data_2=loop_start_2.Data_2,
    Data_3=loop_start_2.Data_3,
    TimeOutVal=0,
    pausedState=False,
    state="Constant output")  # -> Data, D1, D2; disabled
panel_12 = Panel(loop_end_2.Data)  # disabled

panel_13 = Panel("""0
1
2
3
4
5
6""")  # disabled
panel_14 = Panel("3")  # disabled
panel_15 = Panel("5")  # disabled
panel_16 = Panel("7")  # disabled
number_slider_4 = Slider(4, range=0..10)  # disabled
colour_swatch = ColourSwatch(SwatchColor=RGB(255, 0, 0))  # disabled
boolean_toggle_2 = BooleanToggle(True)  # disabled
number_slider_5 = Slider(1, range=0..1)  # disabled
number_11 = Number(loop_end_2.Data)  # disabled
number_slider_6 = Slider(10.104, range=0..20)  # disabled
colour_picker = ColourPicker(PickedColour=RGB(0, 0, 0))  # disabled

speed_3 = Slider(34, range=0..100)  # disabled
list_5 = FlagFields({"Shoulder": 1, "Elbow": 2, "Wrist": 4}, selected=["Shoulder", "Wrist"])  # disabled
list_6 = ValueList({"Joint", "Linear"}, selected="Joint")  # disabled
panel_17 = Panel("2")  # disabled
speed_parameter_3 = SpeedParameter(speed_3)  # disabled
zone_parameter_3 = ZoneParameter(panel_17)  # disabled
configuration_3 = Integer(list_5)  # disabled
motion_type_3 = Text(list_6)  # disabled

speed_4 = Slider(23, range=0..100)  # disabled
list_7 = FlagFields({"Shoulder": 1, "Elbow": 2, "Wrist": 4}, selected=["Shoulder", "Wrist"])  # disabled
list_8 = ValueList({"Joint", "Linear"}, selected="Linear")  # disabled
panel_18 = Panel("5")  # disabled
speed_parameter_4 = SpeedParameter(speed_4)  # disabled
zone_parameter_4 = ZoneParameter(panel_18)  # disabled
configuration_4 = Integer(list_7)  # disabled
motion_type_4 = Text(list_8)  # disabled

# ---- group: Create sphere and Helper geometry
# Comment: Creates Sphere according to Z offset and radius. also creates a point and a value of the increased radius (important for boolean operations)
A = Data(number_2)
A_2 = Data(number)

subtraction_3 = Subtraction(A=A, B=A_2)
construct_point_4 = ConstructPoint(XCoordinate=0, YCoordinate=0, ZCoordinate=subtraction_3)
multiplication_3 = Multiplication(A=A_2, B=1.1)
circle_5 = Circle(Plane=construct_point_4, Radius=multiplication_3)
sphere = Sphere(Base=construct_point_4, Radius=A_2)
boundary_surfaces_2 = BoundarySurfaces(Edges=circle_5)
split_brep = SplitBrep(Brep=sphere, Cutter=boundary_surfaces_2)  # -> graft(Result)

point_8 = Data(construct_point_4)
result = Data(split_brep)
result_2 = Data(multiplication_3)

# ---- group: Find upper half
# Comment: Over-complicated method of finding the upper half of the sphere if the Brep split rverses the order for any reason
radius_number = Number(result_2)
brep = Brep(result)
point_9 = Point(point_8)

unit_z = UnitZ(Factor=1)
line_sdl_3 = LineSDL(Start=point_9, Direction=unit_z, Length=radius_number)
brep_curve = BrepCurve(Brep=brep, Curve=line_sdl_3)  # -> Curves, Points
trim_tree = TrimTree(Tree=brep_curve.Points, Depth=1)
clean_tree = CleanTree(RemoveNulls=True, RemoveInvalid=True, RemoveEmpty=True, Tree=trim_tree)
tree_statistics = TreeStatistics(Tree=clean_tree)  # -> Paths, Length, Count
tree_branch = TreeBranch(Tree=brep, Path=tree_statistics.Paths, MaintainPaths=True)

brep_2 = Brep(tree_branch)

# ---- group: Create Section Cutter
section_radius_2 = Number(number_3)
point_10 = Point(point_8)
number_12 = Number(number)

multiplication_4 = Multiplication(A=number_12, B=1.1)
negative = Negative(Value=multiplication_4)
merge_6 = Merge(Data1=multiplication_4, Data2=negative)
cylinder_3 = Cylinder(Base=point_10, Radius=section_radius_2, Length=merge_6)
brep_join = BrepJoin(Breps=cylinder_3)  # -> Breps, Closed
cap_holes_2 = CapHoles(Brep=brep_join.Breps)

brep_3 = Brep(cap_holes_2)

# ---- group: Cut Section
# Comment: Cuts the section from the base sphere and chooses only the section not the outer part of the base sphere
brep_4 = Brep(brep_3)
brep_5 = Brep(brep_2)

split_brep_2 = SplitBrep(Brep=brep_5, Cutter=brep_4)
area = Area(Geometry=split_brep_2)  # -> Area, Centroid
deconstruct = Deconstruct(Point=area.Centroid)  # -> XComponent, YComponent, ZComponent
sort_list = SortList(Keys=deconstruct.ZComponent, ValuesValuesA=split_brep_2)  # -> Keys, ValuesValuesA
panel_19 = Panel("-1")
first_last_3 = FirstLast(List=sort_list.ValuesValuesA)  # -> FirstValue, LastValue

brep_6 = Brep(first_last_3.LastValue)

# ----
cap_holes_3 = CapHoles(Brep=brep_6)
solid_union = SolidUnion(Breps=flatten([cap_holes, cap_holes_3, cylinder]))
brep_7 = Brep(brep_6)
project = Project(Curve=curve_6, Brep=brep_7, Direction=Vector(0, 0, 1))  # -> reparameterize(Curve)
divide_distance = DivideDistance(Curve=project, Distance=Slider(7.6, range=0..100))  # -> Points, Tangents, Parameters; disabled
brep_closest_point = BrepClosestPoint(Point=divide_distance.Points, Brep=brep_7)  # -> Point, Normal, Distance
plane_normal = PlaneNormal(Origin=brep_closest_point.Point, ZAxis=brep_closest_point.Normal)
align_plane = AlignPlane(Plane=plane_normal, Direction=unit_x)  # -> Plane, Angle
vector_2pt_3 = Vector2Pt(PointA=construct_point_3, PointB=align_plane.Plane, Unitize=False)  # -> Vector, Length
xy_plane_4 = XYPlane(Origin=align_plane.Plane)
plane_normal_2 = PlaneNormal(Origin=align_plane.Plane, ZAxis=vector_2pt_3.Vector)
align_plane_2 = AlignPlane(Plane=plane_normal_2, Direction=unit_x)  # -> Plane, Angle

# ---- group: Show plane axi
plane = Plane(align_plane_2.Plane)
plane_axis_viewer = PlaneAxisViewer(plane=plane, length=Slider(30, range=0..30))

# ----
adjust_plane = AdjustPlane(Plane=align_plane.Plane, Normal=Vector(0, 0, 1))
flip_plane = FlipPlane(Plane=adjust_plane, ReverseX=reverse_x, ReverseY=reverse_y, SwapAxes=swap_axes)
angle = Angle(Plane=plane_normal_2)  # -> Angle, Reflex
flip_plane_2 = FlipPlane(Plane=align_plane_2.Plane, ReverseX=reverse_x_2, ReverseY=reverse_y_2, SwapAxes=swap_axes_2)
plane_2 = Plane(flip_plane)
multiplication_5 = Multiplication(A=angle.Angle, B=Slider(0, range=0..1))
plane_3 = Plane(flip_plane_2)
rotate_plane = RotatePlane(Plane=plane_2, Angle=multiplication_5)

# ---- group: Create Form TCP and Mesh
height_num = Number(number_2)
mold_form_brep = Brep(solid_union)
point_11 = Point(construct_point_2)

cap_holes_4 = CapHoles(Brep=mold_form_brep)
point_12 = ConstructPoint(XCoordinate=0, YCoordinate=0, ZCoordinate=height_num)
xy_plane_5 = XYPlane(Origin=point_12)
plane_4 = Plane(xy_plane_5)
mesh = Mesh(cap_holes_4)
create_tool = CreateTool(Name="DefaultGHTool", TCP=plane_4, Weight=weight_in_kg, Centroid=point_11, Mesh=mesh)  # -> Tool, TCP

tool_parameter = ToolParameter(create_tool.Tool)
tcp_plane = Plane(plane_4)

# ---- group: Extruder nozzle position
number_slider_7 = Slider(-150, range=-1000..1000)
number_slider_8 = Slider(-730, range=-1000..1000)
number_slider_9 = Slider(564, range=-1000..1000)

construct_point_5 = ConstructPoint(XCoordinate=number_slider_7, YCoordinate=number_slider_8, ZCoordinate=number_slider_9)
xy_plane_6 = XYPlane(Origin=construct_point_5)

# ----
yz_plane = YZPlane(Origin=construct_point_5)
yz_plane_2 = YZPlane(Origin=construct_point_5)
xz_plane = XZPlane(Origin=construct_point_5)
flip_plane_3 = FlipPlane(Plane=yz_plane_2, ReverseX=False, ReverseY=False, SwapAxes=True)

# ---- group: Extruder nozzle position (continued)
plane_5 = Plane(xz_plane)

# ---- group: Convert planes to TCP position
plane_6 = Plane(tcp_plane)
plane_7 = Plane(plane_3)
plane_8 = Plane(plane_5)
orient = Orient(Geometry=plane_6, Source=plane_7, Target=plane_8)  # -> Geometry, Transform
transform = Transform(orient.Transform)
plane_9 = Plane(orient.Geometry)

# ----
number_slider_10 = Slider(-45.708, range=-100..0)
plane_10 = Plane(plane_9)
unit_z_2 = UnitZ(Factor=number_slider_10)
unit_y = UnitY(Factor=expr("x*-1", number_slider_10))
list_item = ListItem(List=plane_10, Index=0, Wrap=True)
move = Move(Geometry=list_item, Motion=unit_y)  # -> Geometry, Transform

speed_parameter_5 = SpeedParameter(speed_parameter)
zone_parameter_5 = ZoneParameter(zone_parameter)
tool_parameter_2 = ToolParameter(tool_parameter)
configuration_5 = Integer(configuration)
motion_type_5 = Text(motion_type)
plane_11 = Plane(move.Geometry)
create_target = CreateTarget(
    Plane=flatten(plane_11),
    RobConf=configuration_5,
    Motion=motion_type_5,
    Tool=tool_parameter_2,
    Speed=speed_parameter_5,
    Zone=zone_parameter_5,
    IsCartesian=True)
target_parameter = TargetParameter(create_target)

speed_parameter_6 = SpeedParameter(speed_parameter_2)
zone_parameter_6 = ZoneParameter(zone_parameter_2)
tool_parameter_3 = ToolParameter(tool_parameter)
configuration_6 = Integer(configuration_2)
motion_type_6 = Text(motion_type_2)
plane_12 = Plane(plane_9)
create_target_2 = CreateTarget(
    Plane=flatten(plane_12),
    RobConf=configuration_6,
    Motion=motion_type_6,
    Tool=tool_parameter_3,
    Speed=speed_parameter_6,
    Zone=zone_parameter_6,
    IsCartesian=True)
target_parameter_2 = TargetParameter(flatten(create_target_2))

target_parameter_3 = TargetParameter(target_parameter_2)  # disabled
target_parameter_4 = TargetParameter(target_parameter)  # disabled

# ---- group: Extruder position visualisation
number_slider_11 = Slider(69.678, range=0..100)
unit_z_3 = UnitZ(Factor=number_slider_11)

# ----
unit_y_2 = UnitY(Factor=expr("x*-1", number_slider_11))
unit_x_2 = UnitX(Factor=number_slider_11)

# ---- group: Extruder position visualisation (continued)
move_2 = Move(Geometry=plane_5, Motion=unit_y_2)  # -> Geometry, Transform
cone = Cone(Base=move_2.Geometry, Radius=Slider(25.219, range=0..100), Length=expr("-x", number_slider_11))  # -> Cone, Tip
brep_8 = Brep(cone.Cone)

# ---- group: Start angle configuration
_0 = Slider(0, range=-1..1)
_1 = Slider(0, range=-1..1)
_2 = Slider(0, range=-1..1)
_3 = Slider(0, range=-1..1)
_4 = Slider(0, range=-1..1)
_5 = Slider(0, range=-1..1)
boolean_toggle_3 = BooleanToggle(True)

merge_7 = Merge(Data1=_0, Data2=_1, Data3=_2, Data4=_3, Data5=_4, Data6=_5)
multiplication_6 = Multiplication(A="360", B=merge_7)

# ----
number_slider_12 = Slider(3, range=0..100)  # disabled
panel_20 = Panel("6")  # disabled
zone_soft_radius = Number(panel_20)  # disabled
tool_parameter_4 = ToolParameter(tool_parameter)  # disabled
speed_5 = Number(number_slider_12)  # disabled

# ---- group: Create Robot Program
list_9 = ValueList({"Bartlett-IRB120", "Bartlett-IRB1600", "Bartlett-KR6", "Bartlett-KR60", "Bartlett-UR10", "BURG Halle-UR5", "BURG Halle-UR5 on table", "KULeuven-IRB120", "KULeuven-UR5", "KULeuven-UR10"}, selected="BURG Halle-UR5")  # disabled

load_robot_system = LoadRobotSystem(Name=list_9, Base=PlaneXY(0, 0, 0))  # disabled

# ---- group: Start angle configuration (continued)
kinematics = Kinematics(RobotSystem=load_robot_system, Target=target_parameter, DisplayGeometry=boolean_toggle_3)  # -> Meshes, Joints, Planes, Errors
text_split = TextSplit(Text=kinematics.Joints, Separators=",")
degrees = Degrees(Radians=text_split)
subtraction_4 = Subtraction(A=degrees, B=multiplication_6)
number_13 = Number(subtraction_4)
radians_2 = Radians(Degrees=number_13)
text_join = TextJoin(Text=radians_2, Join=",")

# ----
start_angles_before_optimisation = Panel(degrees)
start_angles_after_optimisation = Panel(number_13)

list_length_2 = ListLength(List=kinematics.Meshes)
multiplication_7 = Multiplication(A=Slider(0.9, range=0..1), B=list_length_2)
list_item_2 = ListItem(List=kinematics.Meshes, Index=Slider(5, range=0..10), Wrap=True)
list_item_3 = ListItem(List=kinematics.Meshes, Index=multiplication_7, Wrap=True)

# ---- group: Start angle configuration (continued)
joint_angles = Text(text_join)

# ----
joint_angles_2 = Text(joint_angles)  # disabled
create_target_3 = CreateTarget(Joints=joint_angles_2, Tool=tool_parameter_4, Speed=speed_5, Zone=zone_soft_radius, IsCartesian=False)  # disabled
target_parameter_5 = TargetParameter(create_target_3)  # disabled

target_parameter_6 = TargetParameter(target_parameter_5)  # disabled

# ---- group: Create Robot Program (continued)
merge_8 = Merge(Data1=flatten(target_parameter_6), Data2=flatten(target_parameter_3))  # disabled

create_program = CreateProgram(Name="DefaultProgram", RobotSystem=load_robot_system, Targets1=merge_8, StepSize=program_step_size)  # -> Program, Code, Duration, Warnings, Errors; disabled

program_parameter = ProgramParameter(create_program.Program)  # disabled
number_14 = Number(create_program.Duration)  # disabled
text = Text(create_program.Warnings)  # disabled
text_2 = Text(create_program.Errors)  # disabled
text_3 = Text(create_program.Code)  # disabled

# ---- group: Program Code and Errors
program_code = Panel(text_3)
warnings = Panel(text)
errors = Panel(text_2)
program = Panel(program_parameter)

# ----
warnings_2 = Panel(text)  # disabled

# ---- group: Length of the program
list_length_3 = ListLength(List=text_3)  # disabled
commands = Panel(list_length_3)  # disabled

# ---- group: Upload to Robot
robot_ip_adress = Panel("192.168.178.22")  # disabled
upload = Button()  # disabled
pause = Button()  # disabled
play = Button()  # disabled
boolean_2 = Boolean(play)  # disabled
boolean_3 = Boolean(upload)  # disabled
boolean_4 = Boolean(pause)  # disabled

# ----
ip_adress = Text(robot_ip_adress)  # disabled
boolean_5 = Boolean(boolean_3)  # disabled
boolean_6 = Boolean(boolean_2)  # disabled
boolean_7 = Boolean(boolean_4)  # disabled
remote_connection = RemoteConnection(Program=program_parameter, IP=ip_adress, Upload=boolean_5, Play=boolean_6, Pause=boolean_7)  # disabled
text_4 = Text(remote_connection)  # disabled
data_recorder_2 = DataRecorder(text_4, DataLimit=-10, RecordData=True)  # disabled

# ---- group: Robot Simulation
extruder_tip = Brep(brep_8)  # disabled
simulation_control = ControlKnob(Decimals=6, Limit=False, Maximum=1, Minimum=0, Range=0.1, Value=3.982766)  # disabled
trail_length = Slider(6847, range=0..10000)  # disabled
panel_21 = Panel("1")  # disabled
modulus = Modulus(A=simulation_control, B=panel_21)  # disabled
number_15 = Number(number_slider_5)  # disabled

number_16 = Number(trail_length)  # disabled
number_17 = Number(number_15)  # disabled

program_simulation = ProgramSimulation(Program=program_parameter, Time=number_17, Normalized=True)  # -> SystemMeshes, JointRotations, Plane, Index, Time, Program, Errors; disabled
check_collisions = CheckCollisions(
    Program=program_simulation.Program,
    FirstSet=panel_16,
    SecondSet=panel_14,
    EnvironmentPlane=-1,
    LinearStepSize=number_slider_4,
    AngularStepSize=0.7853981634)  # -> CollisionFound, TargetIndex, CollidedMeshes; disabled
simple_trail = SimpleTrail(Program=program_simulation.Program, Length=number_16, MechanicalGroup=0)  # disabled
split_list = SplitList(List=program_simulation.SystemMeshes, Index=7)  # -> ListA, ListB; disabled

colliding_meshes_mesh = Mesh(check_collisions.CollidedMeshes)  # disabled
collisions = Panel(check_collisions.CollisionFound)  # disabled
number_18 = Number(program_simulation.JointRotations)  # disabled
plane_13 = Plane(program_simulation.Plane)  # disabled
integer = Integer(program_simulation.Index)  # disabled
curve_7 = Curve(simple_trail)  # disabled
robot_mesh = Mesh(split_list.ListA)  # disabled
tool_mesh = Mesh(split_list.ListB)  # disabled

# ----
integer_2 = Integer(check_collisions.TargetIndex)  # disabled
panel_22 = Panel(integer_2)  # disabled
custom_preview = CustomPreview(Geometry=colliding_meshes_mesh, Material=colour_swatch)  # disabled
degrees_2 = Degrees(Radians=number_18)  # disabled
panel_23 = Panel(integer)  # disabled
panel_24 = Panel(degrees_2)  # disabled

# ---- group: Robot Simulation (continued)
tool_mesh_2 = Mesh(tool_mesh)  # disabled
simulatied_robot_mesh = Mesh(robot_mesh)  # disabled
simulation_robot_trail = Curve(curve_7)  # disabled

# ----
plane_14 = Plane(plane_13)  # disabled
plane_15 = Plane(tcp_plane)  # disabled

list_item_4 = ListItem(List=plane_14, Index=-1, Wrap=True)  # disabled
orient_2 = Orient(Source=plane_15, Target=list_item_4)  # -> Geometry, Transform; disabled

transform_2 = Transform(orient_2.Transform)  # disabled

swatch = ColourSwatch(SwatchColor=RGB(255, 31, 31))  # disabled
swatch_2 = ColourSwatch(SwatchColor=RGB(158, 158, 158))  # disabled
swatch_3 = ColourSwatch(SwatchColor=RGBA(0, 136, 255, 143))  # disabled
swatch_4 = ColourSwatch(SwatchColor=RGB(224, 196, 38))  # disabled
preview = CustomPreview(Geometry=simulatied_robot_mesh, Shader=swatch_2)  # disabled
preview_2 = CustomPreview(Geometry=tool_mesh_2, Shader=swatch_4)  # disabled

# ---- group: Create extrusion simulation
simulation_index = Integer(integer)  # disabled
point_13 = Point(flatten(plane_3))  # disabled
transform_3 = Transform(transform_2)  # disabled

split_list_2 = SplitList(List=point_13, Index=simulation_index)  # -> ListA, ListB; disabled
number_slider_13 = Slider(5.268, range=0..10)  # disabled
number_slider_14 = Slider(2.73, range=0..10)  # disabled
point_14 = Point(split_list_2.ListA)  # disabled
cull_duplicates = CullDuplicates(Points=point_14, Tolerance=number_slider_13, CullMode=3)  # -> Points, Indices, Valence; disabled
interpolate = Interpolate(Vertices=cull_duplicates.Points, Degree=0, Periodic=False, KnotStyle=0)  # -> Curve, Length, Domain; disabled
pipe = Pipe(Curve=interpolate.Curve, Radius=number_slider_14, Caps=2)  # disabled
transform_4 = Transform(Geometry=pipe, Transform=transform_3)  # disabled

# ----
transform_5 = Transform(Geometry=point_14, Transform=transform_3)  # disabled
polyline = PolyLine(Vertices=transform_5, Closed=False)  # disabled
reduce = Reduce(Polyline=polyline, Tolerance=1)  # -> Polyline, Reduction; disabled
smooth_polyline = SmoothPolyline(Polyline=polyline, Strength=1, Times=1)  # disabled
transform_6 = Transform(Geometry=interpolate.Curve, Transform=transform_3)  # disabled
custom_preview_lineweights = CustomPreviewLineweights(Geometry=flatten(polyline), Shader=colour_picker, Thickness=number_slider_6, Absolute=False)  # disabled

# ---- group: Create extrusion simulation (continued)
brep_9 = Brep(transform_4)  # disabled

# ---- group: Create Form TCP and Mesh
mold_form_brep_2 = Brep()  # disabled
height_num_2 = Number()  # disabled

pen_sharpness = Slider(15.94, range=0..50)  # disabled
cap_holes_5 = CapHoles(Brep=mold_form_brep_2)  # disabled
pen_thickness = Slider(5.3, range=0..100)  # disabled
point_15 = ConstructPoint(XCoordinate=0, YCoordinate=0, ZCoordinate=height_num_2)  # disabled
xy_plane_7 = XYPlane(Origin=point_15)  # disabled
number_19 = Number(pen_sharpness)  # disabled
number_20 = Number(pen_thickness)  # disabled
plane_16 = Plane(xy_plane_7)  # disabled
mesh_2 = Mesh(cap_holes_5)  # disabled
pen_holder_mesh = PenHolderMesh(number_3=number_20, number=height_num_2, number_2=number_19)  # disabled
create_tool_2 = CreateTool(Name="DefaultGHTool", TCP=plane_16, Weight=0, Mesh=mesh_2)  # -> Tool, TCP; disabled

tool_parameter_5 = ToolParameter(create_tool_2.Tool)  # disabled
tcp_plane_2 = Plane(plane_16)  # disabled

# ---- group: Convert planes to TCP position
plane_17 = Plane(tcp_plane_2)  # disabled
plane_18 = Plane()  # disabled
plane_19 = Plane(plane_5)  # disabled
orient_3 = Orient(Geometry=plane_17, Source=plane_18, Target=plane_19)  # -> Geometry, Transform; disabled
transform_7 = Transform(orient_3.Transform)  # disabled
plane_20 = Plane(orient_3.Geometry)  # disabled

# ----
number_slider_15 = Slider(-45.708, range=-100..0)  # disabled
plane_21 = Plane(plane_20)  # disabled
unit_z_4 = UnitZ(Factor=number_slider_15)  # disabled
list_item_5 = ListItem(List=plane_21, Index=0, Wrap=True)  # disabled
move_3 = Move(Geometry=list_item_5, Motion=unit_z_4)  # -> Geometry, Transform; disabled

speed_parameter_7 = SpeedParameter(speed_parameter_3)  # disabled
zone_parameter_7 = ZoneParameter(zone_parameter_3)  # disabled
tool_parameter_6 = ToolParameter(tool_parameter_5)  # disabled
configuration_7 = Integer(configuration_3)  # disabled
motion_type_7 = Text(motion_type_3)  # disabled
plane_22 = Plane(move_3.Geometry)  # disabled
create_target_4 = CreateTarget(
    Plane=flatten(plane_22),
    RobConf=configuration_7,
    Motion=motion_type_7,
    Tool=tool_parameter_6,
    Speed=speed_parameter_7,
    Zone=zone_parameter_7,
    IsCartesian=True)  # disabled
target_parameter_7 = TargetParameter(create_target_4)  # disabled

speed_parameter_8 = SpeedParameter(speed_parameter_4)  # disabled
zone_parameter_8 = ZoneParameter(zone_parameter_4)  # disabled
tool_parameter_7 = ToolParameter(tool_parameter_5)  # disabled
configuration_8 = Integer(configuration_4)  # disabled
motion_type_8 = Text(motion_type_4)  # disabled
plane_23 = Plane(plane_20)  # disabled
create_target_5 = CreateTarget(
    Plane=flatten(plane_23),
    RobConf=configuration_8,
    Motion=motion_type_8,
    Tool=tool_parameter_7,
    Speed=speed_parameter_8,
    Zone=zone_parameter_8,
    IsCartesian=True)  # disabled
target_parameter_8 = TargetParameter(flatten(create_target_5))  # disabled

# ---- group: Start angle configuration
_1_2 = Slider(0, range=-1..1)  # disabled
_3_2 = Slider(0, range=-1..1)  # disabled
_4_2 = Slider(0, range=-1..1)  # disabled
_5_2 = Slider(0, range=-1..1)  # disabled
_0_2 = Slider(0, range=-1..1)  # disabled
_2_2 = Slider(0, range=-1..1)  # disabled
boolean_toggle_4 = BooleanToggle(False)  # disabled

# ----
panel_25 = Panel(",")  # disabled
merge_9 = Merge(Data1=_0_2, Data2=_1_2, Data3=_2_2, Data4=_3_2, Data5=_4_2, Data6=_5_2)  # disabled
panel_26 = Panel("360")  # disabled
multiplication_8 = Multiplication(A=panel_26, B=merge_9)  # disabled

number_slider_16 = Slider(3, range=0..100)  # disabled
panel_27 = Panel("6")  # disabled
zone_soft_radius_2 = Number(panel_27)  # disabled
tool_parameter_8 = ToolParameter(tool_parameter_5)  # disabled
speed_6 = Number(number_slider_16)  # disabled

# ---- group: Create Robot Program
list_10 = ValueList({"Bartlett-IRB120", "Bartlett-IRB1600", "Bartlett-KR6", "Bartlett-KR60", "Bartlett-UR10", "BURG Halle-UR5", "BURG Halle-UR5 on table", "KULeuven-IRB120", "KULeuven-UR5", "KULeuven-UR10"}, selected="BURG Halle-UR5")  # disabled

# ----
program_step_size_2 = Slider(0.64, range=0..1)  # disabled
polyline_2 = PolyLine(Closed=True)  # disabled
number_slider_17 = Slider(8.222, range=0..20)  # disabled

# ---- group: Create Robot Program
load_robot_system_2 = LoadRobotSystem(Name=list_10, Base=PlaneXY(0, 0, 0))  # disabled

# ----
kinematics_2 = Kinematics(RobotSystem=load_robot_system_2, Target=target_parameter_7, DisplayGeometry=boolean_toggle_4)  # -> Meshes, Joints, Planes, Errors; disabled
text_split_2 = TextSplit(Text=kinematics_2.Joints, Separators=panel_25)  # disabled
degrees_3 = Degrees(Radians=text_split_2)  # disabled
subtraction_5 = Subtraction(A=degrees_3, B=multiplication_8)  # disabled
number_21 = Number(subtraction_5)  # disabled
radians_3 = Radians(Degrees=number_21)  # disabled
text_join_2 = TextJoin(Text=radians_3, Join=panel_25)  # disabled

start_angles_before_optimisation_2 = Panel(degrees_3)  # disabled
start_angles_after_optimisation_2 = Panel(number_21)  # disabled

# ---- group: Start angle configuration (continued)
joint_angles_3 = Text(text_join_2)  # disabled

# ----
joint_angles_4 = Text(joint_angles_3)  # disabled
create_target_6 = CreateTarget(Joints=joint_angles_4, Tool=tool_parameter_8, Speed=speed_6, Zone=zone_soft_radius_2, IsCartesian=False)  # disabled
target_parameter_9 = TargetParameter(create_target_6)  # disabled

# ---- group: Create Robot Program (continued)
merge_10 = Merge(
    Data1=flatten(target_parameter_9),
    Data2=flatten(target_parameter_8),
    Data3=flatten(target_parameter_7),
    Data4=flatten(target_parameter_9))  # disabled

create_program_2 = CreateProgram(Name="DefaultProgram", RobotSystem=load_robot_system_2, Targets1=merge_10, StepSize=program_step_size_2)  # -> Program, Code, Duration, Warnings, Errors; disabled

program_parameter_2 = ProgramParameter(create_program_2.Program)  # disabled
number_22 = Number(create_program_2.Duration)  # disabled
text_5 = Text(create_program_2.Warnings)  # disabled
text_6 = Text(create_program_2.Errors)  # disabled
text_7 = Text(create_program_2.Code)  # disabled

# ----
ip_adress_2 = Text(robot_ip_adress)  # disabled
boolean_8 = Boolean(boolean_3)  # disabled
boolean_9 = Boolean(boolean_2)  # disabled
boolean_10 = Boolean(boolean_4)  # disabled
remote_connection_2 = RemoteConnection(Program=program_parameter_2, IP=ip_adress_2, Upload=boolean_8, Play=boolean_9, Pause=boolean_10)  # disabled
text_8 = Text(remote_connection_2)  # disabled
data_recorder_3 = DataRecorder(text_8, DataLimit=-10, RecordData=True)  # disabled

# ---- group: Upload to Robot (continued)
text_9 = Text(data_recorder_3)  # disabled
log = Panel(text_9)  # disabled

# ---- group: Length of the program
list_length_4 = ListLength(List=text_7)  # disabled
commands_2 = Panel(list_length_4)  # disabled

# ----
warnings_3 = Panel(text_5)  # disabled

# ---- group: Robot Simulation
number_23 = Number(trail_length)  # disabled
number_24 = Number(number_15)  # disabled

program_simulation_2 = ProgramSimulation(Program=program_parameter_2, Time=number_24, Normalized=True)  # -> SystemMeshes, JointRotations, Plane, Index, Time, Program, Errors; disabled
check_collisions_2 = CheckCollisions(
    Program=program_simulation_2.Program,
    FirstSet=7,
    SecondSet=4,
    EnvironmentPlane=-1,
    LinearStepSize=100,
    AngularStepSize=0.7853981634)  # -> CollisionFound, TargetIndex, CollidedMeshes; disabled
simple_trail_2 = SimpleTrail(Program=program_simulation_2.Program, Length=number_23, MechanicalGroup=0)  # disabled
split_list_3 = SplitList(List=program_simulation_2.SystemMeshes, Index=7)  # -> ListA, ListB; disabled

colliding_meshes_mesh_2 = Mesh(check_collisions_2.CollidedMeshes)  # disabled
collisions_2 = Panel(check_collisions_2.CollisionFound)  # disabled
number_25 = Number(program_simulation_2.JointRotations)  # disabled
plane_24 = Plane(program_simulation_2.Plane)  # disabled
integer_3 = Integer(program_simulation_2.Index)  # disabled
curve_8 = Curve(simple_trail_2)  # disabled
robot_mesh_2 = Mesh(split_list_3.ListA)  # disabled
tool_mesh_3 = Mesh(split_list_3.ListB)  # disabled

# ----
plane_25 = Plane(plane_24)  # disabled
plane_26 = Plane(tcp_plane_2)  # disabled

list_item_6 = ListItem(List=plane_25, Index=-1, Wrap=True)  # disabled
orient_4 = Orient(Source=plane_26, Target=list_item_6)  # -> Geometry, Transform; disabled

transform_8 = Transform(orient_4.Transform)  # disabled

# ---- group: Move Curve according to TCP position
transform_9 = Transform(transform_8)  # disabled
curve_9 = Curve(polyline_2)  # disabled
transform_10 = Transform(Geometry=curve_9, Transform=transform_9)  # disabled
curve_10 = Curve(transform_10)  # disabled

# ---- group: Robot Simulation (continued)
curve_in_position = Curve(curve_10)  # disabled

# ----
preview_3 = CustomPreview(Geometry=curve_in_position, Shader=swatch_3)  # disabled

# ---- group: Create extrusion simulation
simulation_index_2 = Integer(integer_3)  # disabled
point_16 = Point()  # disabled
transform_11 = Transform(transform_8)  # disabled

split_list_4 = SplitList(List=point_16, Index=simulation_index_2)  # -> ListA, ListB; disabled
number_slider_18 = Slider(5.268, range=0..10)  # disabled
number_slider_19 = Slider(2.73, range=0..10)  # disabled
point_17 = Point(split_list_4.ListA)  # disabled
cull_duplicates_2 = CullDuplicates(Points=point_17, Tolerance=number_slider_18, CullMode=3)  # -> Points, Indices, Valence; disabled
interpolate_2 = Interpolate(Vertices=cull_duplicates_2.Points, Degree=3, Periodic=False, KnotStyle=0)  # -> Curve, Length, Domain; disabled
pipe_2 = Pipe(Curve=interpolate_2.Curve, Radius=number_slider_19, Caps=2)  # disabled
transform_12 = Transform(Geometry=pipe_2, Transform=transform_11)  # disabled

# ----
transform_13 = Transform(Geometry=cull_duplicates_2.Points, Transform=transform_11)  # disabled
polyline_3 = PolyLine(Vertices=point_17, Closed=False)  # disabled
smooth_polyline_2 = SmoothPolyline(Polyline=polyline_3, Strength=1, Times=1)  # disabled
reduce_2 = Reduce(Polyline=polyline_3, Tolerance=1)  # -> Polyline, Reduction; disabled
transform_14 = Transform(Geometry=interpolate_2.Curve, Transform=transform_11)  # disabled
custom_preview_lineweights_2 = CustomPreviewLineweights(
    Geometry=flatten(transform_14),
    Shader={diffuse=RGB(255, 105, 180), emission=RGB(76, 32, 54), shine=0.5, specular=RGB(255, 255, 255), transparency=0},
    Thickness=number_slider_17,
    Absolute=False)  # disabled

# ---- group: Create extrusion simulation (continued)
brep_10 = Brep(transform_12)  # disabled

# ---- group: Robot Simulation (continued)
extrusion_brep = Brep(brep_10)  # disabled

# ----
preview_4 = CustomPreview(Geometry=extrusion_brep, Shader=swatch)  # disabled

# ==== cluster PenHolderMesh
number = ClusterInput()
number_2 = ClusterInput()
number_3 = ClusterInput()
number_4 = Number(number)
number_5 = Number(number_2)
number_6 = Number(number_3)
subtraction = Subtraction(A=number_4, B=number_5)
unit_z = UnitZ(Factor=subtraction)
unit_z_2 = UnitZ(Factor=number_4)
circle = Circle(Plane=PlaneXY(0, 0, 0), Radius=number_6)
extrude = Extrude(Base=circle, Direction=unit_z)
construct_point = ConstructPoint(XCoordinate=0, YCoordinate=0, ZCoordinate=unit_z_2)
move = Move(Geometry=circle, Motion=unit_z)  # -> Geometry, Transform
extrude_point = ExtrudePoint(Base=move.Geometry, Point=construct_point)
merge = Merge(Data1=extrude_point, Data2=extrude)
mesh_brep = MeshBrep(
    Brep=merge,
    Settings={GridMaxCount=0, GridMinCount=16, JaggedSeams=False, MaxEdgeLength=0, MinEdgeLength=0.0001, MinTolerance=0, Refine=True, RefineAngle=0, RelativeTolerance=0.65, SimplePlanes=True, Tolerance=0})
brep = Brep([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])
mesh = Mesh(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)
merge_2 = Merge(Data1=mesh, Data2=mesh_brep)
mesh_join = MeshJoin(Meshes=merge_2)
mesh_2 = Mesh(mesh_join)
mesh_3 = ClusterOutput(mesh_2)

# ==== cluster PlaneAxisViewer
plane = ClusterInput()
panel = Panel("""Red
Green
Blue""")
length = ClusterInput()  # Size of the vector lines to display
plane_2 = Plane(graft(plane))
colour = Colour(panel)
deconstruct_plane = DeconstructPlane(Plane=plane_2)  # -> Origin, XAxis, YAxis, ZAxis
merge = Merge(Data1=deconstruct_plane.XAxis, Data2=deconstruct_plane.YAxis, Data3=deconstruct_plane.ZAxis)
multiplication = Multiplication(A=length, B=Slider(1.14, range=1..2))
amplitude = Amplitude(Vector=merge, Amplitude=length)
amplitude_2 = Amplitude(Vector=merge, Amplitude=multiplication)
move = Move(Geometry=deconstruct_plane.Origin, Motion=amplitude_2)  # -> Geometry, Transform
panel_2 = Panel("""X
Y
Z""")
text_tag = TextTag(Location=move.Geometry, Text=panel_2, Colour=colour)
vector_display_ex = VectorDisplayEx(Point=deconstruct_plane.Origin, Vector=amplitude, Colour=colour, Width=Slider(3.9, range=0..10))
