# Grasshopper definition Surface Winding 005 (Animations)_PancakeEmergency [Jul-08 '19, 2224].gh (Grasshopper 1.0.7)
# plug-ins: Robots, treesloth01, Pufferfish, Anemone, Human, horsterCameraControl

base_sphere_radius = Slider(150, range=0.1..500)
base_sphere_height = Slider(250, range=0..1000)
minimal_radius = Slider(40, range=0.1..500)
section_radius = Slider(150, range=0.1..500)
number = Number(base_sphere_radius)
division = Division(A="455", B=2)
number_2 = Number(base_sphere_height)
number_3 = Number(section_radius)
number_4 = Number(minimal_radius)
cdomain = ConstructDomain(DomainStart=number_4, DomainEnd=number_3)
range = Range(Domain=cdomain, Steps="8")
panel = Panel("""0
-1""")
cull_index = CullIndex(List=range, Indices=panel, Wrap=True)
circle = Circle(Plane=PlaneXY(0, 0, 0), Radius=range)
subtraction = Subtraction(A="8", B=2)
number_5 = Number(number_3)
circle_2 = Circle(Plane=PlaneXY(0, 0, 0), Radius=number_5)
number_6 = Number(cull_index)

# ---- group: Loop
loop_start = LoopStart(Repeat=subtraction, Trigger=Button(), curr_value=number_3, curr_circle=circle_2, list_of_values=number_6)  # -> port, Counter, Data, Data_2, Data_3, Data_4, Data_5
curve = Curve(reparameterize(loop_start.Data_2))
number_7 = Number(loop_start.Data_5)
curve_2 = Curve(loop_start.Data_3)
point = Point(loop_start.Data_4)
number_8 = Number(loop_start.Data)
integer = Integer(loop_start.Counter)

# ---- group: Loop / Seed modification
integer_2 = Integer(integer)
multiplication = Multiplication(A=integer_2, B=Slider(343, range=0..1000))
integer_3 = Integer(multiplication)

# ---- group: Loop
boundary_surfaces = BoundarySurfaces(Edges=circle_2)  # disabled
panel_2 = Panel("1")  # disabled
populate_geometry = PopulateGeometry(Geometry=boundary_surfaces, Count=panel_2, Seed=1, Points=point)  # disabled
curve_closest_point = CurveClosestPoint(Point=populate_geometry, Curve=curve)  # -> Point, Parameter, Distance; disabled
panel_3 = Panel("0.1")  # disabled
list_length = ListLength(List=curve_closest_point.Parameter)  # disabled
smaller_than = SmallerThan(FirstNumber=curve_closest_point.Parameter, SecondNumber=panel_3)  # -> SmallerThan, OrEqualTo; disabled
boolean = Boolean(invert(list_length))  # disabled
gate_or = GateOr(A=boolean, B=smaller_than.SmallerThan)  # disabled

# ---- group: Loop / Circle section domain
integer_4 = Integer(integer_3)
cdomain_2 = ConstructDomain(DomainStart=Slider(0.5, range=0..1), DomainEnd=Slider(0.8, range=0..1))
multiplication_2 = Multiplication(A=integer_4, B=Slider(806, range=0..1000))
random = Random(Range=cdomain_2, Number=1, Seed=multiplication_2)

# ----
construct_point = ConstructPoint(XCoordinate=0, YCoordinate=0, ZCoordinate="5")
construct_point_2 = ConstructPoint(XCoordinate=0, YCoordinate=0, ZCoordinate="190")
cylinder = Cylinder(Base=construct_point, Radius=Slider(4, range=0..1000), Length=Slider(224, range=0..1000))  # disabled
cylinder_2 = Cylinder(Base=construct_point, Radius=Slider(25, range=0..1000), Length=Slider(101, range=0..1000))
cap_holes = CapHoles(Brep=cylinder_2)
weight_in_kg = Panel("2")
number_slider = Slider(64, range=0..100)
surface_closest_point = SurfaceClosestPoint()  # -> Point, UVPoint, Distance
evaluate_surface = EvaluateSurface()  # -> Point, Normal, UDirection, VDirection, Frame
curve_3 = Curve([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])
curve_4 = Curve(curve_3)
unit_x = UnitX(Factor=1)

curve_5 = Curve(curve_4)
list_length_2 = ListLength(List=curve_5)
multiplication_3 = Multiplication(A=list_length_2, B=Slider(0.2138, range=0..1))
list_item = ListItem(List=curve_5, Index=multiplication_3, Wrap=True)
curve_6 = Curve(list_item)

# ---- group: Iterative shape generation
list = Data(curve_4)
animation_controller = Slider(0.969, range=0..1)
list_length_3 = ListLength(List=list)
multiplication_4 = Multiplication(A=animation_controller, B=list_length_3)
round = Round(Number=multiplication_4)  # -> Nearest, Floor, Ceiling
panel_4 = Panel(round.Floor)
list_item_2 = ListItem(List=list, Index=round.Floor, Wrap=True)
modulus = Modulus(A=multiplication_4, B="1")
construct_domain = ConstructDomain(DomainStart="0", DomainEnd=modulus)
panel_5 = Panel(modulus)
sub_curve = SubCurve(BaseCurve=reparameterize(list_item_2), Domain=construct_domain)

# ---- group: Iterative shape generation+ grid
list_2 = Data(curve_4)
animation_controller_2 = Slider(1, range=0..1)
list_length_4 = ListLength(List=list_2)
multiplication_5 = Multiplication(A=animation_controller_2, B=list_length_4)
round_2 = Round(Number=multiplication_5)  # -> Nearest, Floor, Ceiling
number_slider_2 = Slider(1.5, range=-1000..1000)
panel_6 = Panel(round_2.Floor)
list_item_3 = ListItem(List=list_2, Index=round_2.Floor, Wrap=True)
modulus_2 = Modulus(A=multiplication_5, B="1")
construct_point_3 = ConstructPoint(XCoordinate=Slider(-638.5, range=-1000..1000), YCoordinate=Slider(188.2, range=-1000..1000), ZCoordinate=0)
construct_domain_2 = ConstructDomain(DomainStart="0", DomainEnd=modulus_2)
number_slider_3 = Slider(4, range=0..10)
panel_7 = Panel(modulus_2)
plane = Plane(construct_point_3)
flip_plane = FlipPlane(Plane=plane, ReverseX=Toggle(False), ReverseY=Toggle(True), SwapAxes=Toggle(True))
sub_curve_2 = SubCurve(BaseCurve=reparameterize(list_item_3), Domain=construct_domain_2)
number_9 = Number(number_3)
division_2 = Division(A=list_length_4, B=number_slider_3)
series = Series(Start=0, Step=1, Count=list_length_4)
addition = Addition(A=number_9, B=Slider(-61.8, range=-1000..1000))
square = Square(Plane=flip_plane, Size=addition, ExtentX=division_2, ExtentY=number_slider_3)  # -> Cells, Points
split_list = SplitList(List=series, Index=round_2.Floor)  # -> ListA, ListB
split_list_2 = SplitList(List=list_2, Index=round_2.Floor)  # -> ListA, ListB
flip_matrix = FlipMatrix(Data=square.Points)
point_2 = Point(flatten(square.Points))
list_item_4 = ListItem(List=point_2, Index=split_list.ListA, Wrap=True)
reverse_list = ReverseList(List=point_2)
xy_plane = XYPlane(Origin=Point(0, 0, 0))
vector_2pt = Vector2Pt(PointA=xy_plane, PointB=list_item_4, Unitize=False)  # -> Vector, Length
move = Move(Geometry=split_list_2.ListA, Motion=vector_2pt.Vector)  # -> Geometry, Transform
scale = Scale(Geometry=move.Geometry, Center=list_item_4, Factor=Slider(0.2, range=0..1))  # -> Geometry, Transform
colour_swatch = ColourSwatch(SwatchColor=RGB(0, 0, 0))
custom_preview_lineweights = CustomPreviewLineweights(Geometry=sub_curve_2, Shader=colour_swatch, Thickness=Slider(4.6, range=0..10), Absolute=False)
custom_preview_lineweights_2 = CustomPreviewLineweights(Geometry=scale.Geometry, Shader=colour_swatch, Thickness=Slider(1.9, range=0..3), Absolute=False)

# ----
construct_point_4 = ConstructPoint(XCoordinate=0, YCoordinate=0, ZCoordinate=Slider(66.4, range=-1000..1000))
radians = Radians(Degrees=Slider(-202, range=-360..360))
reverse_x = BooleanToggle(True)
reverse_y = BooleanToggle(True)
swap_axes = BooleanToggle(False)
unit_x_2 = UnitX(Factor=1)
animation_controller_3 = Slider(1, range=0..1)
number_10 = Number(animation_controller_3)
animation_controller_4 = Slider(0.997, range=0..1)
z_angle = Slider(106.2, range=-1000..222)
rotation_around_z = Slider(214, range=-360..360)
z_angle_2 = Slider(222, range=-1000..222)
rotation_around_z_2 = Slider(360, range=-360..360)
graph_mapper = GraphMapper(number_10, x0=0, x1=1, y0=0, y1=1, container_name="Gaussian", factor=0.3557235003, mean=0.2651154995, sdev=0.1338527501)
graph_mapper_2 = GraphMapper(number_10, x0=0, x1=1, y0=0, y1=1, container_name="Gaussian", factor=0.408210218, mean=0.6558041573, sdev=0.1739130616)

loop_start_2 = LoopStart(Repeat="1000", Trigger=Button(), Data="0", D1=Slider(0.015, range=0..0.1), D2=Slider(0, range=0..1000))  # -> port, Counter, Data, Data_2, Data_3
addition_2 = Addition(A=loop_start_2.Data, B=loop_start_2.Data_2)
larger_than = LargerThan(FirstNumber=addition_2, SecondNumber="1")  # -> LargerThan, OrEqualTo
time_buffer = TimeBuffer(Data=addition_2, Ms=loop_start_2.Data_3, UseThread=False)
gate_or_2 = GateOr(A=Toggle(True), B=larger_than.OrEqualTo)
loop_end = LoopEnd(
    port=loop_start_2.port,
    Exit=gate_or_2,
    Data=time_buffer,
    Data_2=loop_start_2.Data_2,
    Data_3=loop_start_2.Data_3,
    TimeOutVal=0,
    pausedState=False,
    state="Constant output")  # -> Data, D1, D2
panel_8 = Panel(loop_end.Data)

number_11 = Number(animation_controller_4)
multiplication_6 = Multiplication(A=graph_mapper, B=z_angle_2)
vector = Vector(unit_x_2)
multiplication_7 = Multiplication(A=graph_mapper_2, B=rotation_around_z_2)
vector_2 = Vector(unit_x_2)
number_12 = Number(z_angle)
number_13 = Number(rotation_around_z)
number_14 = Number(multiplication_6)
number_15 = Number(multiplication_7)
construct_point_5 = ConstructPoint(XCoordinate=0, YCoordinate=0, ZCoordinate=number_12)
construct_point_6 = ConstructPoint(XCoordinate=0, YCoordinate=0, ZCoordinate=number_14)
animate_camera = AnimateCamera(SaveCameraState=False, Reset=False)
radians_2 = Radians(Degrees=number_13)
radians_3 = Radians(Degrees=number_15)
reverse_x_2 = BooleanToggle(True)
reverse_y_2 = BooleanToggle(True)
swap_axes_2 = BooleanToggle(False)
number_16 = Number(loop_end.Data)
reverse_x_3 = BooleanToggle(True)
reverse_y_3 = BooleanToggle(True)
swap_axes_3 = BooleanToggle(False)
boolean_toggle = BooleanToggle(True)
panel_9 = Panel("""100
101""")
panel_10 = Panel("""100
101""")

speed = Slider(23, range=0..100)
list_3 = FlagFields({"Shoulder": 1, "Elbow": 2, "Wrist": 4}, selected=["Shoulder", "Elbow", "Wrist"])
list_4 = ValueList({"Joint", "Linear"}, selected="Linear")
speed_parameter = SpeedParameter(speed)
zone_parameter = ZoneParameter("5")
configuration = Integer(list_3)
motion_type = Text(list_4)

speed_2 = Slider(23, range=0..100)
list_5 = FlagFields({"Shoulder": 1, "Elbow": 2, "Wrist": 4}, selected=["Shoulder", "Elbow", "Wrist"])
list_6 = ValueList({"Joint", "Linear"}, selected="Linear")
speed_parameter_2 = SpeedParameter(speed_2)
zone_parameter_2 = ZoneParameter("5")
configuration_2 = Integer(list_5)
motion_type_2 = Text(list_6)

program_step_size = Slider(0.64, range=0..1)
program_step_size_2 = Slider(0.64, range=0..1)

# ---- group: Robot Simulation
number_slider_4 = Slider(0.881367, range=0..1)
simulation_control = ControlKnob(Decimals=6, Limit=False, Maximum=1, Minimum=0, Range=0.1, Value=3.982766)
modulus_3 = Modulus(A=simulation_control, B="1")
number_17 = Number(number_11)

simulation_control_2 = ControlKnob(Decimals=6, Limit=False, Maximum=1, Minimum=0, Range=0.1, Value=3.982766)
modulus_4 = Modulus(A=simulation_control_2, B="1")
number_18 = Number(Slider(0.058818, range=0..1))

# ----
panel_11 = Panel("""0
1
2
3
4
5
6""")
construct_point_7 = ConstructPoint(XCoordinate=Slider(-360, range=-1000..1000), YCoordinate=Slider(573, range=-1000..1000), ZCoordinate=0)
construct_point_8 = ConstructPoint(XCoordinate=Slider(-360, range=-1000..1000), YCoordinate=Slider(573, range=-1000..1000), ZCoordinate=0)
xy_plane_2 = XYPlane(Origin=construct_point_7)
xy_plane_3 = XYPlane(Origin=construct_point_8)
number_slider_5 = Slider(0, range=0..100)
number_slider_6 = Slider(0, range=0..100)
create_material = CreateMaterial(
    Diffuse=ColourSwatch(SwatchColor=RGB(0, 0, 0)),
    Specular=ColourSwatch(SwatchColor=RGB(255, 255, 255)),
    Emission=RGB(0, 0, 0),
    Transparency=0,
    Shine=number_slider_6)
swatch = ColourSwatch(SwatchColor=RGB(46, 42, 0))
create_material_2 = CreateMaterial(
    Diffuse=ColourSwatch(SwatchColor=RGB(76, 76, 76)),
    Specular=RGB(255, 255, 255),
    Emission=RGB(0, 0, 0),
    Transparency=0,
    Shine=0)
create_material_3 = CreateMaterial(
    Diffuse=ColourSwatch(SwatchColor=RGB(92, 92, 92)),
    Specular=RGB(255, 255, 255),
    Emission=RGB(0, 0, 0),
    Transparency=0,
    Shine=0)
colour_picker = ColourPicker(PickedColour=RGB(0, 0, 0))

speed_3 = Slider(34, range=0..100)  # disabled
list_7 = FlagFields({"Shoulder": 1, "Elbow": 2, "Wrist": 4}, selected=["Shoulder", "Wrist"])  # disabled
list_8 = ValueList({"Joint", "Linear"}, selected="Joint")  # disabled
panel_13 = Panel("2")  # disabled
speed_parameter_3 = SpeedParameter(speed_3)  # disabled
zone_parameter_3 = ZoneParameter(panel_13)  # disabled
configuration_3 = Integer(list_7)  # disabled
motion_type_3 = Text(list_8)  # disabled

speed_4 = Slider(23, range=0..100)  # disabled
list_9 = FlagFields({"Shoulder": 1, "Elbow": 2, "Wrist": 4}, selected=["Shoulder", "Wrist"])  # disabled
list_10 = ValueList({"Joint", "Linear"}, selected="Linear")  # disabled
panel_14 = Panel("5")  # disabled
speed_parameter_4 = SpeedParameter(speed_4)  # disabled
zone_parameter_4 = ZoneParameter(panel_14)  # disabled
configuration_4 = Integer(list_9)  # disabled
motion_type_4 = Text(list_10)  # disabled

# ---- group: Create sphere and Helper geometry
# Comment: Creates Sphere according to Z offset and radius. also creates a point and a value of the increased radius (important for boolean operations)
A = Data(number_2)
A_2 = Data(number)

subtraction_2 = Subtraction(A=A, B=A_2)
construct_point_9 = ConstructPoint(XCoordinate=0, YCoordinate=0, ZCoordinate=subtraction_2)
multiplication_8 = Multiplication(A=A_2, B=1.1)
circle_3 = Circle(Plane=construct_point_9, Radius=multiplication_8)
sphere = Sphere(Base=construct_point_9, Radius=A_2)
boundary_surfaces_2 = BoundarySurfaces(Edges=circle_3)
split_brep = SplitBrep(Brep=sphere, Cutter=boundary_surfaces_2)  # -> graft(Result)

point_3 = Data(construct_point_9)
result = Data(split_brep)
result_2 = Data(multiplication_8)

# ---- group: Find upper half
# Comment: Over-complicated method of finding the upper half of the sphere if the Brep split rverses the order for any reason
radius_number = Number(result_2)
brep = Brep(result)
point_4 = Point(point_3)

unit_z = UnitZ(Factor=1)
line_sdl = LineSDL(Start=point_4, Direction=unit_z, Length=radius_number)
brep_curve = BrepCurve(Brep=brep, Curve=line_sdl)  # -> Curves, Points
trim_tree = TrimTree(Tree=brep_curve.Points, Depth=1)
clean_tree = CleanTree(RemoveNulls=True, RemoveInvalid=True, RemoveEmpty=True, Tree=trim_tree)
tree_statistics = TreeStatistics(Tree=clean_tree)  # -> Paths, Length, Count
tree_branch = TreeBranch(Tree=brep, Path=tree_statistics.Paths, MaintainPaths=True)

brep_2 = Brep(tree_branch)

# ---- group: Create Section Cutter
section_radius_2 = Number(number_3)
point_5 = Point(point_3)
number_19 = Number(number)

multiplication_9 = Multiplication(A=number_19, B=1.1)
negative = Negative(Value=multiplication_9)
merge = Merge(Data1=multiplication_9, Data2=negative)
cylinder_3 = Cylinder(Base=point_5, Radius=section_radius_2, Length=merge)
brep_join = BrepJoin(Breps=cylinder_3)  # -> Breps, Closed
cap_holes_2 = CapHoles(Brep=brep_join.Breps)

brep_3 = Brep(cap_holes_2)

# ---- group: Cut Section
# Comment: Cuts the section from the base sphere and chooses only the section not the outer part of the base sphere
brep_4 = Brep(brep_3)
brep_5 = Brep(brep_2)

split_brep_2 = SplitBrep(Brep=brep_5, Cutter=brep_4)
area = Area(Geometry=split_brep_2)  # -> Area, Centroid
deconstruct = Deconstruct(Point=area.Centroid)  # -> XComponent, YComponent, ZComponent
sort_list = SortList(Keys=deconstruct.ZComponent, ValuesValuesA=split_brep_2)  # -> Keys, ValuesValuesA
panel_15 = Panel("-1")
first_last = FirstLast(List=sort_list.ValuesValuesA)  # -> FirstValue, LastValue

brep_6 = Brep(first_last.LastValue)

# ----
cap_holes_3 = CapHoles(Brep=brep_6)
solid_union = SolidUnion(Breps=flatten([cap_holes, cap_holes_3, cylinder]))
brep_7 = Brep(brep_6)
brep_8 = Brep(brep_6)

# ---- group: Loop / Create circle section
panel_16 = Panel("0")
number_20 = Number(random)
curve_7 = Curve(curve)

cdomain_3 = ConstructDomain(DomainStart=panel_16, DomainEnd=number_20)
sub_curve_3 = SubCurve(BaseCurve=curve_7, Domain=cdomain_3)
end_points = EndPoints(Curve=sub_curve_3)  # -> Start, End

point_6 = Point(end_points.End)
point_7 = Point(end_points.Start)

# ---- group: Loop
point_8 = Point(loop_start.Data_4)
point_9 = Point(point_6)
merge_2 = Merge(Data1=flatten(point_8), Data2=flatten(point_9))

# ---- group: Loop / List management of circle radii
number_slider_7 = Slider(433, range=0..1000)
integer_5 = Integer(integer_3)
number_21 = Number(number_7)

multiplication_10 = Multiplication(A=integer_5, B=number_slider_7)
jitter = Jitter(List=number_21, Jitter=1, Seed=multiplication_10)  # -> Values, Indices
first_last_2 = FirstLast(List=jitter.Values)  # -> FirstValue, LastValue
cull_index_2 = CullIndex(List=jitter.Values, Indices="0", Wrap=True)

list_without_current_circle = Number(cull_index_2)
next_circle_radius = Number(first_last_2.FirstValue)

# ---- group: Create Form TCP and Mesh
height_num = Number(number_2)
mold_form_brep = Brep(solid_union)
point_10 = Point(construct_point_2)

cap_holes_4 = CapHoles(Brep=mold_form_brep)
point_11 = ConstructPoint(XCoordinate=0, YCoordinate=0, ZCoordinate=height_num)
xy_plane_4 = XYPlane(Origin=point_11)
plane_2 = Plane(xy_plane_4)
mesh = Mesh(cap_holes_4)
create_tool = CreateTool(Name="DefaultGHTool", TCP=plane_2, Weight=weight_in_kg, Centroid=point_10, Mesh=mesh)  # -> Tool, TCP

tool_parameter = ToolParameter(create_tool.Tool)
tcp_plane = Plane(plane_2)

# ---- group: Loop / Create radial line
number_22 = Number(number_8)
number_23 = Number(next_circle_radius)
point_12 = Point(point_6)

xy_plane_5 = XYPlane(Origin=Point(0, 0, 0))
subtraction_3 = Subtraction(A=number_22, B=number_23)
vector_2pt_2 = Vector2Pt(PointA=point_12, PointB=xy_plane_5, Unitize=False)  # -> Vector, Length
line_sdl_2 = LineSDL(Start=point_12, Direction=vector_2pt_2.Vector, Length=subtraction_3)

line = Line(line_sdl_2)

# ---- group: Loop
curve_8 = Curve(line)
number_24 = Number(next_circle_radius)

circle_4 = Circle(Plane=PlaneXY(0, 0, 0), Radius=number_24)
curve_curve = CurveCurve(CurveA=circle_4, CurveB=curve_8)  # -> Points, ParamsA, ParamsB
seam = Seam(Curve=circle_4, Seam=curve_curve.ParamsA)

circle_5 = Circle(seam)

# ---- group: Loop / Join all previos curves
curve_9 = Curve(curve_2)
curve_10 = Curve(sub_curve_3)
line_2 = Line(line)

merge_3 = Merge(Data1=curve_10, Data2=line_2)  # -> flatten(Result)
join_curves = JoinCurves(Curves=merge_3, Preserve=False)
merge_4 = Merge(Data1=curve_9, Data2=join_curves)  # -> flatten(Result)
join_curves_2 = JoinCurves(Curves=merge_4, Preserve=False)

curve_11 = Curve(join_curves_2)

# ---- group: Loop
loop_end_2 = LoopEnd(
    port=loop_start.port,
    Exit=False,
    Data=next_circle_radius,
    Data_2=circle_5,
    Data_3=curve_11,
    Data_4=merge_2,
    Data_5=list_without_current_circle,
    TimeOutVal=0,
    pausedState=False,
    state="Output last")  # -> D0, Data, D2, D3, D4

# ----
data_recorder = DataRecorder(loop_end_2.D2, DataLimit=-10, RecordData=True)
browse_history = BrowseHistory(
    Iteration=number_slider,
    Data_0=loop_end_2.D0,
    Data_1=loop_end_2.Data,
    Data_2=loop_end_2.D2,
    Data_3=loop_end_2.D3,
    Data_4=loop_end_2.D4)  # -> Data_0, Data_1, Data_2, Data_3, Data_4
browse_history_2 = BrowseHistory(Iteration=number_slider, Data_0=data_recorder)

# ---- group: Add last circle fully
panel_17 = Panel("0 to 0.999")
curve_12 = Curve(reparameterize(loop_end_2.Data))
curve_13 = Curve(loop_end_2.D2)

sub_curve_4 = SubCurve(BaseCurve=reparameterize(curve_12), Domain=panel_17)
merge_5 = Merge(Data1=flatten(curve_13), Data2=flatten(sub_curve_4))
join_curves_3 = JoinCurves(Curves=merge_5, Preserve=False)

curve_14 = Curve(join_curves_3)

# ----
data_dam = DataDam(DataDataA=curve_14, BufferDelay=10000000, BufferMode=0)
data_recorder_2 = DataRecorder(data_dam, DataLimit=-10, RecordData=True)

# ---- group: Connect start with rest of curve
curve_15 = Curve(curve_14)

end_points_2 = EndPoints(Curve=curve_15)  # -> Start, End
point_13 = Point(end_points_2.Start)
xy_plane_6 = XYPlane(Origin=Point(0, 0, 0))
vector_2pt_3 = Vector2Pt(PointA=point_13, PointB=xy_plane_6, Unitize=False)  # -> Vector, Length
line_sdl_3 = LineSDL(Start=point_13, Direction=vector_2pt_3.Vector, Length=vector_2pt_3.Length)
curve_curve_2 = CurveCurve(CurveA=curve_15, CurveB=line_sdl_3)  # -> Points, ParamsA, ParamsB
cull_index_3 = CullIndex(List=curve_curve_2.ParamsB, Indices="0", Wrap=True)
jitter_2 = Jitter(List=cull_index_3, Jitter=1, Seed=Slider(200, range=0..1000))  # -> Values, Indices
first_last_3 = FirstLast(List=jitter_2.Values)  # -> FirstValue, LastValue
cdomain_4 = ConstructDomain(DomainStart="0", DomainEnd=first_last_3.FirstValue)
sub_curve_5 = SubCurve(BaseCurve=line_sdl_3, Domain=cdomain_4)
merge_6 = Merge(Data1=flatten(curve_15), Data2=flatten(sub_curve_5))
join_curves_4 = JoinCurves(Curves=merge_6, Preserve=False)

curve_16 = Curve(join_curves_4)

# ---- group: Scale and Rotate shape
rotate_frame_shape = Slider(358.7, range=0..360)
number_slider_8 = Slider(0.98, range=0..1)
curve_17 = Curve(curve_16)

scale_2 = Scale(Geometry=curve_17, Center=Point(0, 0, 0), Factor=number_slider_8)  # -> Geometry, Transform
radians_4 = Radians(Degrees=rotate_frame_shape)
rotate = Rotate(Geometry=scale_2.Geometry, Angle=radians_4, Plane=PlaneXY(0, 0, 0))  # -> Geometry, Transform

curve_18 = Curve(rotate.Geometry)

# ----
curve_19 = Curve(curve_18)
project = Project(Curve=curve_19, Brep=brep_7, Direction=Vector(0, 0, 1))  # -> reparameterize(Curve)
divide_distance = DivideDistance(Curve=project, Distance=Slider(7.6, range=0..100))  # -> Points, Tangents, Parameters
brep_closest_point = BrepClosestPoint(Point=divide_distance.Points, Brep=brep_7)  # -> Point, Normal, Distance
plane_normal = PlaneNormal(Origin=brep_closest_point.Point, ZAxis=brep_closest_point.Normal)
align_plane = AlignPlane(Plane=plane_normal, Direction=unit_x)  # -> Plane, Angle
plane_3 = Plane(align_plane.Plane)
plane_4 = Plane(plane_3)
vector_2pt_4 = Vector2Pt(PointA=construct_point_4, PointB=plane_4, Unitize=False)  # -> Vector, Length
plane_normal_2 = PlaneNormal(Origin=plane_4, ZAxis=vector_2pt_4.Vector)
align_plane_2 = AlignPlane(Plane=plane_normal_2, Direction=unit_x)  # -> Plane, Angle
rotate_plane = RotatePlane(Plane=align_plane_2.Plane, Angle=radians)
flip_plane_2 = FlipPlane(Plane=rotate_plane, ReverseX=reverse_x, ReverseY=reverse_y, SwapAxes=swap_axes)
plane_5 = Plane(flip_plane_2)
list_item_5 = ListItem(List=plane_5, Index="100", Wrap=True)

# ---- group: Extruder nozzle position
number_slider_9 = Slider(-150, range=-1000..1000)
number_slider_10 = Slider(-554.4, range=-1000..1000)
number_slider_11 = Slider(438.5, range=-1000..1000)

construct_point_10 = ConstructPoint(XCoordinate=number_slider_9, YCoordinate=number_slider_10, ZCoordinate=number_slider_11)
xy_plane_7 = XYPlane(Origin=construct_point_10)

# ----
yz_plane = YZPlane(Origin=construct_point_10)
yz_plane_2 = YZPlane(Origin=construct_point_10)
xz_plane = XZPlane(Origin=construct_point_10)
flip_plane_3 = FlipPlane(Plane=yz_plane_2, ReverseX=False, ReverseY=False, SwapAxes=True)

# ---- group: Extruder nozzle position (continued)
plane_6 = Plane(xy_plane_7)

# ---- group: Extruder position visualisation
number_slider_12 = Slider(69.678, range=0..100)
unit_z_2 = UnitZ(Factor=number_slider_12)
move_2 = Move(Geometry=plane_6, Motion=unit_z_2)  # -> Geometry, Transform
cone = Cone(Base=move_2.Geometry, Radius=Slider(25.219, range=0..100), Length=expr("-x", number_slider_12))  # -> Cone, Tip
brep_9 = Brep(cone.Cone)

# ----
unit_y = UnitY(Factor=expr("x*-1", number_slider_12))
unit_x_3 = UnitX(Factor=number_slider_12)

# ---- group: Scale and Rotate shape
rotate_frame_shape_2 = Slider(115.2, range=0..360)
number_slider_13 = Slider(0.946, range=0..1)
curve_20 = Curve(curve_6)

scale_3 = Scale(Geometry=curve_20, Center=Point(0, 0, 0), Factor=number_slider_13)  # -> Geometry, Transform
radians_5 = Radians(Degrees=rotate_frame_shape_2)
rotate_2 = Rotate(Geometry=scale_3.Geometry, Angle=radians_5, Plane=PlaneXY(0, 0, 0))  # -> Geometry, Transform

curve_21 = Curve(rotate_2.Geometry)

# ----
curve_22 = Curve(curve_21)
fillet = Fillet(Curve=curve_22, Radius=Slider(1, range=0..15))
project_2 = Project(Curve=fillet, Brep=brep_8, Direction=Vector(0, 0, 1))  # -> reparameterize(Curve)
divide_distance_2 = DivideDistance(Curve=project_2, Distance=Slider(7.6, range=0..100))  # -> Points, Tangents, Parameters
brep_closest_point_2 = BrepClosestPoint(Point=divide_distance_2.Points, Brep=brep_8)  # -> Point, Normal, Distance
plane_normal_3 = PlaneNormal(Origin=brep_closest_point_2.Point, ZAxis=brep_closest_point_2.Normal)
project_3 = Project(Curve=curve_22, Brep=brep_8, Direction=Vector(0, 0, 1))  # -> reparameterize(Curve)
align_plane_3 = AlignPlane(Plane=plane_normal_3, Direction=unit_x_2)  # -> Plane, Angle
plane_7 = Plane(align_plane_3.Plane)
divide_curve = DivideCurve(Curve=curve_22, Count=0, Kinks=True)  # -> Points, Tangents, Parameters
divide_curve_2 = DivideCurve(Curve=project_3, Count=0, Kinks=True)  # -> Points, Tangents, Parameters
plane_8 = Plane(plane_7)
plane_9 = Plane(plane_7)
vector_2pt_5 = Vector2Pt(PointA=construct_point_5, PointB=plane_8, Unitize=False)  # -> Vector, Length
vector_2pt_6 = Vector2Pt(PointA=construct_point_6, PointB=plane_9, Unitize=False)  # -> Vector, Length
plane_normal_4 = PlaneNormal(Origin=plane_8, ZAxis=vector_2pt_5.Vector)
plane_normal_5 = PlaneNormal(Origin=plane_9, ZAxis=vector_2pt_6.Vector)
align_plane_4 = AlignPlane(Plane=plane_normal_4, Direction=vector)  # -> Plane, Angle
align_plane_5 = AlignPlane(Plane=plane_normal_5, Direction=vector_2)  # -> Plane, Angle
rotate_plane_2 = RotatePlane(Plane=align_plane_4.Plane, Angle=radians_2)
rotate_plane_3 = RotatePlane(Plane=align_plane_5.Plane, Angle=radians_3)
flip_plane_4 = FlipPlane(Plane=rotate_plane_2, ReverseX=reverse_x_2, ReverseY=reverse_y_2, SwapAxes=swap_axes_2)
flip_plane_5 = FlipPlane(Plane=rotate_plane_3, ReverseX=reverse_x_3, ReverseY=reverse_y_3, SwapAxes=swap_axes_3)
plane_10 = Plane(flip_plane_4)
plane_11 = Plane(flip_plane_5)
plane_12 = Plane(plane_10)
plane_13 = Plane(plane_10)

# ---- group: Convert planes to TCP position
plane_14 = Plane(tcp_plane)
plane_15 = Plane(plane_13)
plane_16 = Plane(plane_6)
orient = Orient(Geometry=plane_14, Source=plane_15, Target=plane_16)  # -> Geometry, Transform
transform = Transform(orient.Transform)
plane_17 = Plane(orient.Geometry)

# ----
plane_18 = Plane(plane_11)
plane_19 = Plane(plane_11)

# ---- group: Convert planes to TCP position
plane_20 = Plane(tcp_plane)
plane_21 = Plane(plane_19)
plane_22 = Plane(plane_6)
orient_2 = Orient(Geometry=plane_20, Source=plane_21, Target=plane_22)  # -> Geometry, Transform
transform_2 = Transform(orient_2.Transform)
plane_23 = Plane(orient_2.Geometry)

# ----
list_item_6 = ListItem(List=plane_12, Index="100", Wrap=True)
list_item_7 = ListItem(List=plane_18, Index="100", Wrap=True)
plane_24 = Plane(plane_17)
plane_25 = Plane(plane_23)
list_item_8 = ListItem(List=plane_24, Index=panel_9, Wrap=True)
list_item_9 = ListItem(List=plane_25, Index=panel_10, Wrap=True)

speed_parameter_5 = SpeedParameter(speed_parameter)
zone_parameter_5 = ZoneParameter(zone_parameter)
tool_parameter_2 = ToolParameter(tool_parameter)
configuration_5 = Integer(configuration)
motion_type_5 = Text(motion_type)
plane_26 = Plane(plane_17)
create_target = CreateTarget(
    Plane=flatten(plane_26),
    RobConf=configuration_5,
    Motion=motion_type_5,
    Tool=tool_parameter_2,
    Speed=speed_parameter_5,
    Zone=zone_parameter_5,
    IsCartesian=True)
target_parameter = TargetParameter(flatten(create_target))

speed_parameter_6 = SpeedParameter(speed_parameter_2)
zone_parameter_6 = ZoneParameter(zone_parameter_2)
tool_parameter_3 = ToolParameter(tool_parameter)
configuration_6 = Integer(configuration_2)
motion_type_6 = Text(motion_type_2)
plane_27 = Plane(list_item_9)
create_target_2 = CreateTarget(
    Plane=flatten(plane_27),
    RobConf=configuration_6,
    Motion=motion_type_6,
    Tool=tool_parameter_3,
    Speed=speed_parameter_6,
    Zone=zone_parameter_6,
    IsCartesian=True)
target_parameter_2 = TargetParameter(flatten(create_target_2))

target_parameter_3 = TargetParameter(target_parameter)
target_parameter_4 = TargetParameter(target_parameter_2)

# ---- group: Show plane axi
plane_28 = Plane(list_item_7)
plane_axis_viewer = PlaneAxisViewer(plane=plane_28, length=Slider(49.982, range=0..100))

# ----
curve_23 = Curve(reparameterize(project_2))
animation_controller_5 = Slider(0, range=0..1)
number_25 = Number(animation_controller_5)
vector_2pt_7 = Vector2Pt(PointA=divide_curve.Points, PointB=divide_curve_2.Points, Unitize=False)  # -> Vector, Length
subtraction_4 = Subtraction(A="1", B=number_25)
subtraction_5 = Subtraction(A="1", B=number_25)
graph_mapper_3 = GraphMapper(
    subtraction_4,
    x0=0,
    x1=1,
    y0=0,
    y1=1,
    A=19.5727559,
    B=-0.2368917613,
    container_name="Linear",
    Graph_x0=0.01679262891,
    Graph_x1=0.05832483992,
    Graph_y0=0.09178626537,
    Graph_y1=0.9046860933)
subtraction_6 = Subtraction(A="1", B=number_25)
graph_mapper_4 = GraphMapper(
    subtraction_5,
    x0=0,
    x1=1,
    y0=0,
    y1=1,
    container_name="Bezier",
    cpx=[0, 0, 0.4542430937, 1],
    cpy=[0.1811594367, 0.4033804536, 1, 1])
panel_18 = Panel("""5
3""")
graph_mapper_5 = GraphMapper(
    subtraction_6,
    x0=0,
    x1=1,
    y0=0,
    y1=1,
    container_name="Bezier",
    cpx=[0, 0.4909608364, 0.1561428159, 1],
    cpy=[0.5064923763, 0.4993562102, 1, 1])
pipe = Pipe(Curve=curve_23, Radius=Slider(1.5, range=0..10), Caps=2)
evaluate = Evaluate(Expression="if(x>0.95,0,1)", x=number_25)
number_26 = Number(graph_mapper_4)
graph_mapper_6 = GraphMapper(number_25, x0=0, x1=1, y0=0, y1=1, container_name="Bezier", cpx=[0, 1, 1, 1], cpy=[0, 0, 0.5452756882, 1])
mesh_brep = MeshBrep(
    Brep=pipe,
    Settings={GridMaxCount=0, GridMinCount=16, JaggedSeams=False, MaxEdgeLength=0, MinEdgeLength=0.0001, MinTolerance=0, Refine=True, RefineAngle=0, RelativeTolerance=0.65, SimplePlanes=True, Tolerance=0})
number_27 = Number(graph_mapper_5)
create_material_4 = CreateMaterial(
    Diffuse=ColourSwatch(SwatchColor=RGB(255, 255, 255)),
    Specular=RGB(255, 255, 255),
    Emission=RGB(0, 0, 0),
    Transparency=number_27,
    Shine=0)
create_material_5 = CreateMaterial(
    Diffuse=ColourSwatch(SwatchColor=RGB(0, 0, 0)),
    Specular=RGB(255, 255, 255),
    Emission=RGB(0, 0, 0),
    Transparency=0,
    Shine=0)
mesh_brep_2 = MeshBrep(
    Brep=brep_8,
    Settings={GridMaxCount=0, GridMinCount=16, JaggedSeams=False, MaxEdgeLength=0, MinEdgeLength=0.0001, MinTolerance=0, Refine=True, RefineAngle=0, RelativeTolerance=0.65, SimplePlanes=True, Tolerance=0})
multiplication_11 = Multiplication(A=graph_mapper_6, B=Slider(3.8, range=0..10))
number_28 = Number(graph_mapper_3)
create_material_6 = CreateMaterial(
    Diffuse=ColourSwatch(SwatchColor=RGB(0, 0, 0)),
    Specular=RGB(255, 255, 255),
    Emission=RGB(0, 0, 0),
    Transparency=0,
    Shine=0)
create_material_7 = CreateMaterial(
    Diffuse=ColourSwatch(SwatchColor=RGB(0, 0, 0)),
    Specular=RGB(255, 255, 255),
    Emission=RGB(0, 0, 0),
    Transparency=number_28,
    Shine=0)
stream_filter = StreamFilter(Gate=evaluate, Stream0=curve_23)

custom_preview = CustomPreview(Geometry=mesh_brep_2, Material=create_material_4)
custom_preview_lineweights_3 = CustomPreviewLineweights(Geometry=stream_filter, Shader=create_material_6, Thickness=multiplication_11, Absolute=False)
custom_preview_2 = CustomPreview(Geometry=mesh_brep, Material=create_material_7)

vector_3 = Vector(vector_2pt_7.Vector)
number_29 = Number(vector_2pt_7.Length)
number_30 = Number(number_25)
point_14 = Point(divide_curve.Points)

multiplication_12 = Multiplication(A=number_29, B=number_30)
line_sdl_4 = LineSDL(Start=point_14, Direction=vector_3, Length=multiplication_12)

line_3 = Line(line_sdl_4)

dash_pattern = DashPattern(Curve=line_3, Pattern=panel_18)  # -> Dashes, Gaps

custom_preview_3 = CustomPreview(Geometry=mesh_brep_2, Material=create_material_4)
custom_preview_lineweights_4 = CustomPreviewLineweights(Geometry=curve_21, Shader=create_material_5, Thickness=Slider(7.7, range=0..10), Absolute=False)
custom_preview_lineweights_5 = CustomPreviewLineweights(
    Geometry=dash_pattern.Dashes,
    Shader=ColourSwatch(SwatchColor=RGB(0, 0, 0)),
    Thickness=Slider(2.8, range=0..10),
    Absolute=False)
custom_preview_4 = CustomPreview(Geometry=mesh_brep, Material=create_material_7)
custom_preview_lineweights_6 = CustomPreviewLineweights(Geometry=stream_filter, Shader=create_material_6, Thickness=multiplication_11, Absolute=False)

geometry = Geometry(curve_23)
plane_29 = Plane(tcp_plane)

geometry_2 = Geometry(curve_23)
plane_30 = Plane(tcp_plane)

# ---- group: Upload to Robot
robot_ip_adress = Panel("192.168.178.22")
upload = Button()
pause = Button()
play = Button()
boolean_2 = Boolean(play)
boolean_3 = Boolean(pause)
boolean_4 = Boolean(upload)

# ---- group: Create Robot Program
list_11 = ValueList({"Bartlett-IRB120", "Bartlett-IRB1600", "Bartlett-KR6", "Bartlett-KR60", "Bartlett-UR10", "BURG Halle-UR5", "BURG Halle-UR5 on table", "KULeuven-IRB120", "KULeuven-UR5", "KULeuven-UR10"}, selected="BURG Halle-UR5")
merge_7 = Merge(Data1=flatten(target_parameter_3))

load_robot_system = LoadRobotSystem(Name=list_11, Base=PlaneXY(0, 0, 0))
create_program = CreateProgram(Name="DefaultProgram", RobotSystem=load_robot_system, Targets1=merge_7, StepSize=program_step_size)  # -> Program, Code, Duration, Warnings, Errors

program_parameter = ProgramParameter(create_program.Program)
number_31 = Number(create_program.Duration)
text = Text(create_program.Code)
text_2 = Text(create_program.Warnings)
text_3 = Text(create_program.Errors)

# ----
warnings = Panel(text_2)

ip_adress = Text(robot_ip_adress)
boolean_5 = Boolean(boolean_4)
boolean_6 = Boolean(boolean_2)
boolean_7 = Boolean(boolean_3)
remote_connection = RemoteConnection(Program=program_parameter, IP=ip_adress, Upload=boolean_5, Play=boolean_6, Pause=boolean_7)
text_4 = Text(remote_connection)
data_recorder_3 = DataRecorder(text_4, DataLimit=-10, RecordData=True)

# ---- group: Length of the program
list_length_5 = ListLength(List=text)
commands = Panel(list_length_5)

# ---- group: Create Robot Program
list_12 = ValueList({"Bartlett-IRB120", "Bartlett-IRB1600", "Bartlett-KR6", "Bartlett-KR60", "Bartlett-UR10", "BURG Halle-UR5", "BURG Halle-UR5 on table", "KULeuven-IRB120", "KULeuven-UR5", "KULeuven-UR10"}, selected="BURG Halle-UR5")
merge_8 = Merge(Data1=flatten(target_parameter_4))

load_robot_system_2 = LoadRobotSystem(Name=list_12, Base=PlaneXY(0, 0, 0))
create_program_2 = CreateProgram(Name="DefaultProgram", RobotSystem=load_robot_system_2, Targets1=merge_8, StepSize=program_step_size_2)  # -> Program, Code, Duration, Warnings, Errors

program_parameter_2 = ProgramParameter(create_program_2.Program)
number_32 = Number(create_program_2.Duration)
text_5 = Text(create_program_2.Warnings)
text_6 = Text(create_program_2.Code)
text_7 = Text(create_program_2.Errors)

# ---- group: Program Code and Errors
program_code = Panel(text_6)
warnings_2 = Panel(text_5)
errors = Panel(text_7)
program = Panel(program_parameter_2)

# ----
ip_adress_2 = Text(robot_ip_adress)
boolean_8 = Boolean(boolean_4)
boolean_9 = Boolean(boolean_2)
boolean_10 = Boolean(boolean_3)
remote_connection_2 = RemoteConnection(Program=program_parameter_2, IP=ip_adress_2, Upload=boolean_8, Play=boolean_9, Pause=boolean_10)
text_8 = Text(remote_connection_2)
data_recorder_4 = DataRecorder(text_8, DataLimit=-10, RecordData=True)

# ---- group: Length of the program
list_length_6 = ListLength(List=text_6)
commands_2 = Panel(list_length_6)

# ---- group: Robot Simulation
number_33 = Number(number_17)
number_34 = Number()

program_simulation = ProgramSimulation(Program=program_parameter, Time=number_33, Normalized=True)  # -> SystemMeshes, JointRotations, Plane, Index, Time, Program, Errors
check_collisions = CheckCollisions(
    Program=program_simulation.Program,
    FirstSet="7",
    SecondSet=graft(["3", "5"]),
    EnvironmentPlane=-1,
    LinearStepSize=Slider(1, range=0..10),
    AngularStepSize=0.7853981634)  # -> CollisionFound, TargetIndex, CollidedMeshes; disabled
simple_trail = SimpleTrail(Program=program_simulation.Program, Length=number_34, MechanicalGroup=0)  # disabled
split_list_3 = SplitList(List=program_simulation.SystemMeshes, Index=7)  # -> ListA, ListB

colliding_meshes_mesh = Mesh(check_collisions.CollidedMeshes)
number_35 = Number(program_simulation.JointRotations)
plane_31 = Plane(program_simulation.Plane)
integer_6 = Integer(program_simulation.Index)
curve_24 = Curve(simple_trail)
collisions = Panel(check_collisions.CollisionFound)
robot_mesh = Mesh(split_list_3.ListA)
tool_mesh = Mesh(split_list_3.ListB)

# ----
integer_7 = Integer(check_collisions.TargetIndex)
panel_19 = Panel(integer_7)
custom_preview_5 = CustomPreview(Geometry=colliding_meshes_mesh, Material=ColourSwatch(SwatchColor=RGB(255, 0, 0)))
degrees = Degrees(Radians=number_35)
panel_20 = Panel(integer_6)
panel_21 = Panel(degrees)

plane_32 = Plane(plane_31)

list_item_10 = ListItem(List=plane_32, Index=-1, Wrap=True)
orient_3 = Orient(Geometry=geometry, Source=plane_29, Target=list_item_10)  # -> Geometry, Transform

transform_3 = Transform(orient_3.Transform)
geometry_3 = Geometry(orient_3.Geometry)

pipe_2 = Pipe(Curve=geometry_3, Radius=Slider(2, range=0..10), Caps=2)  # disabled
mesh_brep_3 = MeshBrep(
    Brep=pipe_2,
    Settings={GridMaxCount=0, GridMinCount=16, JaggedSeams=False, MaxEdgeLength=0, MinEdgeLength=0.0001, MinTolerance=0, Refine=True, RefineAngle=0, RelativeTolerance=0.65, SimplePlanes=True, Tolerance=0})

# ---- group: Robot Simulation
number_36 = Number()
number_37 = Number(number_18)

program_simulation_2 = ProgramSimulation(Program=program_parameter_2, Time=number_37, Normalized=True)  # -> SystemMeshes, JointRotations, Plane, Index, Time, Program, Errors
check_collisions_2 = CheckCollisions(
    Program=program_simulation_2.Program,
    FirstSet="7",
    SecondSet=graft(["3", "5"]),
    EnvironmentPlane=-1,
    LinearStepSize=Slider(1, range=0..10),
    AngularStepSize=0.7853981634)  # -> CollisionFound, TargetIndex, CollidedMeshes
simple_trail_2 = SimpleTrail(Program=program_simulation_2.Program, Length=number_36, MechanicalGroup=0)
split_list_4 = SplitList(List=program_simulation_2.SystemMeshes, Index=7)  # -> ListA, ListB

number_38 = Number(program_simulation_2.JointRotations)
plane_33 = Plane(program_simulation_2.Plane)
collisions_2 = Panel(check_collisions_2.CollisionFound)
integer_8 = Integer(program_simulation_2.Index)
curve_25 = Curve(simple_trail_2)
colliding_meshes_mesh_2 = Mesh(check_collisions_2.CollidedMeshes)
robot_mesh_2 = Mesh(split_list_4.ListA)
tool_mesh_2 = Mesh(split_list_4.ListB)

# ----
plane_34 = Plane(plane_33)
list_item_11 = ListItem(List=plane_34, Index=-1, Wrap=True)
orient_4 = Orient(Geometry=list_item_5, Source=tcp_plane, Target=list_item_11)  # -> Geometry, Transform

# ---- group: Show plane axi
plane_35 = Plane(orient_4.Geometry)
plane_axis_viewer_2 = PlaneAxisViewer(plane=plane_35, length=Slider(30, range=0..30))

plane_36 = Plane(orient_4.Geometry)
plane_axis_viewer_3 = PlaneAxisViewer(plane=plane_36, length=Slider(31.723, range=0..200))

# ----
integer_9 = Integer(check_collisions_2.TargetIndex)
panel_22 = Panel(integer_9)
degrees_2 = Degrees(Radians=number_38)
panel_23 = Panel(integer_8)
panel_24 = Panel(degrees_2)
colliding_meshes_mesh_3 = Mesh(colliding_meshes_mesh_2)

plane_37 = Plane(plane_33)

list_item_12 = ListItem(List=plane_37, Index=-1, Wrap=True)
orient_5 = Orient(Geometry=geometry_2, Source=plane_30, Target=list_item_12)  # -> Geometry, Transform

transform_4 = Transform(orient_5.Transform)
geometry_4 = Geometry(orient_5.Geometry)

pipe_3 = Pipe(Curve=geometry_4, Radius=Slider(2.1, range=0..10), Caps=2)
mesh_brep_4 = MeshBrep(
    Brep=pipe_3,
    Settings={GridMaxCount=0, GridMinCount=16, JaggedSeams=False, MaxEdgeLength=0, MinEdgeLength=0.0001, MinTolerance=0, Refine=True, RefineAngle=0, RelativeTolerance=0.65, SimplePlanes=True, Tolerance=0})

# ---- group: Create extrusion simulation
simulation_index = Integer(integer_6)
point_15 = Point(flatten(plane_13))
transform_5 = Transform(transform_3)

split_list_5 = SplitList(List=point_15, Index=simulation_index)  # -> ListA, ListB
point_16 = Point(split_list_5.ListA)
cull_duplicates = CullDuplicates(Points=point_16, Tolerance=Slider(5.268, range=0..10), CullMode=3)  # -> Points, Indices, Valence
interpolate = Interpolate(Vertices=cull_duplicates.Points, Degree=0, Periodic=False, KnotStyle=0)  # -> Curve, Length, Domain
pipe_4 = Pipe(Curve=interpolate.Curve, Radius=Slider(2.73, range=0..10), Caps=2)  # disabled
transform_6 = Transform(Geometry=pipe_4, Transform=transform_5)

# ----
transform_7 = Transform(Geometry=point_16, Transform=transform_5)
polyline = PolyLine(Vertices=transform_7, Closed=False)
transform_8 = Transform(Geometry=interpolate.Curve, Transform=transform_5)

# ---- group: Create extrusion simulation (continued)
brep_10 = Brep(transform_6)

# ---- group: Robot Simulation
extrusion_line = Geometry(polyline)
mesh_2 = Mesh(mesh_brep_3)
geometry_5 = Geometry(geometry_3)
simulatied_robot_mesh = Mesh(robot_mesh)
tool_mesh_3 = Mesh(tool_mesh)
simulation_robot_trail = Curve(curve_24)
extruder_tip = Brep(brep_9)
trail_length = Slider(6847, range=0..10000)

tool_mesh_4 = Mesh(tool_mesh_2)
simulatied_robot_mesh_2 = Mesh(robot_mesh_2)
simulation_robot_trail_2 = Curve(curve_25)
geometry_6 = Geometry(geometry_4)
mesh_3 = Mesh(mesh_brep_4)
extruder_tip_2 = Brep(brep_9)
trail_length_2 = Slider(6847, range=0..10000)

trail_length_3 = Slider(6847, range=0..10000)

trail_length_4 = Slider(6847, range=0..10000)

# ----
create_material_8 = CreateMaterial(
    Diffuse=ColourSwatch(SwatchColor=RGB(158, 158, 158)),
    Specular=RGB(255, 255, 255),
    Emission=RGB(0, 0, 0),
    Transparency=0,
    Shine=number_slider_5)
create_material_9 = CreateMaterial(
    Diffuse=ColourSwatch(SwatchColor=RGB(255, 255, 255)),
    Specular=RGB(255, 255, 255),
    Emission=ColourSwatch(SwatchColor=RGB(0, 0, 0)),
    Transparency=0,
    Shine=number_slider_5)
create_material_10 = CreateMaterial(
    Diffuse=ColourSwatch(SwatchColor=RGB(176, 176, 176)),
    Specular=RGB(255, 255, 255),
    Emission=RGB(0, 0, 0),
    Transparency=0,
    Shine=number_slider_6)
create_material_11 = CreateMaterial(
    Diffuse=ColourSwatch(SwatchColor=RGB(255, 255, 255)),
    Specular=RGB(255, 255, 255),
    Emission=RGB(0, 0, 0),
    Transparency=0,
    Shine=number_slider_6)

# ---- group: Create Form TCP and Mesh
mold_form_brep_2 = Brep()  # disabled
height_num_2 = Number()  # disabled

cap_holes_5 = CapHoles(Brep=mold_form_brep_2)  # disabled
pen_sharpness = Slider(15.94, range=0..50)  # disabled
pen_thickness = Slider(5.3, range=0..100)  # disabled
point_17 = ConstructPoint(XCoordinate=0, YCoordinate=0, ZCoordinate=height_num_2)  # disabled
xy_plane_8 = XYPlane(Origin=point_17)  # disabled
number_39 = Number(pen_thickness)  # disabled
number_40 = Number(pen_sharpness)  # disabled
plane_38 = Plane(xy_plane_8)  # disabled
mesh_4 = Mesh(cap_holes_5)  # disabled
pen_holder_mesh = PenHolderMesh(number_3=number_39, number=height_num_2, number_2=number_40)  # disabled
create_tool_2 = CreateTool(Name="DefaultGHTool", TCP=plane_38, Weight=0, Mesh=mesh_4)  # -> Tool, TCP; disabled

tool_parameter_4 = ToolParameter(create_tool_2.Tool)  # disabled
tcp_plane_2 = Plane(plane_38)  # disabled

# ---- group: Convert planes to TCP position
plane_39 = Plane(tcp_plane_2)  # disabled
plane_40 = Plane()  # disabled
plane_41 = Plane(plane_6)  # disabled
orient_6 = Orient(Geometry=plane_39, Source=plane_40, Target=plane_41)  # -> Geometry, Transform; disabled
transform_9 = Transform(orient_6.Transform)  # disabled
plane_42 = Plane(orient_6.Geometry)  # disabled

# ----
number_slider_14 = Slider(-45.708, range=-100..0)  # disabled
plane_43 = Plane(plane_42)  # disabled
unit_z_3 = UnitZ(Factor=number_slider_14)  # disabled
list_item_13 = ListItem(List=plane_43, Index=0, Wrap=True)  # disabled
move_3 = Move(Geometry=list_item_13, Motion=unit_z_3)  # -> Geometry, Transform; disabled

speed_parameter_7 = SpeedParameter(speed_parameter_3)  # disabled
zone_parameter_7 = ZoneParameter(zone_parameter_3)  # disabled
tool_parameter_5 = ToolParameter(tool_parameter_4)  # disabled
configuration_7 = Integer(configuration_3)  # disabled
motion_type_7 = Text(motion_type_3)  # disabled
plane_44 = Plane(move_3.Geometry)  # disabled
create_target_3 = CreateTarget(
    Plane=flatten(plane_44),
    RobConf=configuration_7,
    Motion=motion_type_7,
    Tool=tool_parameter_5,
    Speed=speed_parameter_7,
    Zone=zone_parameter_7,
    IsCartesian=True)  # disabled
target_parameter_5 = TargetParameter(create_target_3)  # disabled

speed_parameter_8 = SpeedParameter(speed_parameter_4)  # disabled
zone_parameter_8 = ZoneParameter(zone_parameter_4)  # disabled
tool_parameter_6 = ToolParameter(tool_parameter_4)  # disabled
configuration_8 = Integer(configuration_4)  # disabled
motion_type_8 = Text(motion_type_4)  # disabled
plane_45 = Plane(plane_42)  # disabled
create_target_4 = CreateTarget(
    Plane=flatten(plane_45),
    RobConf=configuration_8,
    Motion=motion_type_8,
    Tool=tool_parameter_6,
    Speed=speed_parameter_8,
    Zone=zone_parameter_8,
    IsCartesian=True)  # disabled
target_parameter_6 = TargetParameter(flatten(create_target_4))  # disabled

# ---- group: Start angle configuration
_0 = Slider(0, range=-1..1)  # disabled
_1 = Slider(0, range=-1..1)  # disabled
_2 = Slider(0, range=-1..1)  # disabled
_3 = Slider(0, range=-1..1)  # disabled
_4 = Slider(0, range=-1..1)  # disabled
_5 = Slider(0, range=-1..1)  # disabled
boolean_toggle_2 = BooleanToggle(False)  # disabled

# ----
panel_25 = Panel(",")  # disabled
merge_9 = Merge(Data1=_0, Data2=_1, Data3=_2, Data4=_3, Data5=_4, Data6=_5)  # disabled
panel_26 = Panel("360")  # disabled
multiplication_13 = Multiplication(A=panel_26, B=merge_9)  # disabled

number_slider_15 = Slider(3, range=0..100)  # disabled
panel_27 = Panel("6")  # disabled
zone_soft_radius = Number(panel_27)  # disabled
tool_parameter_7 = ToolParameter(tool_parameter_4)  # disabled
speed_5 = Number(number_slider_15)  # disabled

# ---- group: Create Robot Program
list_13 = ValueList({"Bartlett-IRB120", "Bartlett-IRB1600", "Bartlett-KR6", "Bartlett-KR60", "Bartlett-UR10", "BURG Halle-UR5", "BURG Halle-UR5 on table", "KULeuven-IRB120", "KULeuven-UR5", "KULeuven-UR10"}, selected="BURG Halle-UR5")  # disabled

# ----
program_step_size_3 = Slider(0.64, range=0..1)  # disabled
polyline_2 = PolyLine(Closed=True)  # disabled
number_slider_16 = Slider(8.222, range=0..20)  # disabled

# ---- group: Create Robot Program
load_robot_system_3 = LoadRobotSystem(Name=list_13, Base=PlaneXY(0, 0, 0))  # disabled

# ----
kinematics = Kinematics(RobotSystem=load_robot_system_3, Target=target_parameter_5, DisplayGeometry=boolean_toggle_2)  # -> Meshes, Joints, Planes, Errors; disabled
text_split = TextSplit(Text=kinematics.Joints, Separators=panel_25)  # disabled
degrees_3 = Degrees(Radians=text_split)  # disabled
subtraction_7 = Subtraction(A=degrees_3, B=multiplication_13)  # disabled
number_41 = Number(subtraction_7)  # disabled
radians_6 = Radians(Degrees=number_41)  # disabled
text_join = TextJoin(Text=radians_6, Join=panel_25)  # disabled

start_angles_before_optimisation = Panel(degrees_3)  # disabled
start_angles_after_optimisation = Panel(number_41)  # disabled

# ---- group: Start angle configuration (continued)
joint_angles = Text(text_join)  # disabled

# ----
joint_angles_2 = Text(joint_angles)  # disabled
create_target_5 = CreateTarget(Joints=joint_angles_2, Tool=tool_parameter_7, Speed=speed_5, Zone=zone_soft_radius, IsCartesian=False)  # disabled
target_parameter_7 = TargetParameter(create_target_5)  # disabled

# ---- group: Create Robot Program (continued)
merge_10 = Merge(
    Data1=flatten(target_parameter_7),
    Data2=flatten(target_parameter_6),
    Data3=flatten(target_parameter_5),
    Data4=flatten(target_parameter_7))  # disabled

create_program_3 = CreateProgram(Name="DefaultProgram", RobotSystem=load_robot_system_3, Targets1=merge_10, StepSize=program_step_size_3)  # -> Program, Code, Duration, Warnings, Errors; disabled

program_parameter_3 = ProgramParameter(create_program_3.Program)  # disabled
text_9 = Text(create_program_3.Code)  # disabled
number_42 = Number(create_program_3.Duration)  # disabled
text_10 = Text(create_program_3.Warnings)  # disabled
text_11 = Text(create_program_3.Errors)  # disabled

# ----
ip_adress_3 = Text(robot_ip_adress)  # disabled
boolean_11 = Boolean(boolean_4)  # disabled
boolean_12 = Boolean(boolean_2)  # disabled
boolean_13 = Boolean(boolean_3)  # disabled
remote_connection_3 = RemoteConnection(Program=program_parameter_3, IP=ip_adress_3, Upload=boolean_11, Play=boolean_12, Pause=boolean_13)  # disabled
text_12 = Text(remote_connection_3)  # disabled
data_recorder_5 = DataRecorder(text_12, DataLimit=-10, RecordData=True)  # disabled

# ---- group: Upload to Robot (continued)
text_13 = Text(data_recorder_5)
log = Panel(text_13)

# ---- group: Length of the program
list_length_7 = ListLength(List=text_9)  # disabled
commands_3 = Panel(list_length_7)  # disabled

# ----
warnings_4 = Panel(text_10)  # disabled

# ---- group: Robot Simulation
number_43 = Number()  # disabled
number_44 = Number(number_18)  # disabled

program_simulation_3 = ProgramSimulation(Program=program_parameter_3, Time=number_44, Normalized=True)  # -> SystemMeshes, JointRotations, Plane, Index, Time, Program, Errors; disabled
check_collisions_3 = CheckCollisions(
    Program=program_simulation_3.Program,
    FirstSet=7,
    SecondSet=4,
    EnvironmentPlane=-1,
    LinearStepSize=100,
    AngularStepSize=0.7853981634)  # -> CollisionFound, TargetIndex, CollidedMeshes; disabled
simple_trail_3 = SimpleTrail(Program=program_simulation_3.Program, Length=number_43, MechanicalGroup=0)  # disabled
split_list_6 = SplitList(List=program_simulation_3.SystemMeshes, Index=7)  # -> ListA, ListB; disabled

collisions_3 = Panel(check_collisions_3.CollisionFound)  # disabled
colliding_meshes_mesh_4 = Mesh(check_collisions_3.CollidedMeshes)  # disabled
number_45 = Number(program_simulation_3.JointRotations)  # disabled
plane_46 = Plane(program_simulation_3.Plane)  # disabled
integer_10 = Integer(program_simulation_3.Index)  # disabled
curve_26 = Curve(simple_trail_3)  # disabled
robot_mesh_3 = Mesh(split_list_6.ListA)  # disabled
tool_mesh_5 = Mesh(split_list_6.ListB)  # disabled

# ----
plane_47 = Plane(plane_46)  # disabled
plane_48 = Plane(tcp_plane_2)  # disabled

list_item_14 = ListItem(List=plane_47, Index=-1, Wrap=True)  # disabled
orient_7 = Orient(Source=plane_48, Target=list_item_14)  # -> Geometry, Transform; disabled

transform_10 = Transform(orient_7.Transform)  # disabled

# ---- group: Move Curve according to TCP position
transform_11 = Transform(transform_10)  # disabled
curve_27 = Curve(polyline_2)  # disabled
transform_12 = Transform(Geometry=curve_27, Transform=transform_11)  # disabled
curve_28 = Curve(transform_12)  # disabled

# ---- group: Robot Simulation (continued)
curve_in_position = Curve(curve_28)

curve_in_position_2 = Curve(curve_28)

# ---- group: Create extrusion simulation
simulation_index_2 = Integer(integer_10)  # disabled
point_18 = Point()  # disabled
transform_13 = Transform(transform_10)  # disabled

split_list_7 = SplitList(List=point_18, Index=simulation_index_2)  # -> ListA, ListB; disabled
number_slider_17 = Slider(5.268, range=0..10)  # disabled
number_slider_18 = Slider(2.73, range=0..10)  # disabled
point_19 = Point(split_list_7.ListA)  # disabled
cull_duplicates_2 = CullDuplicates(Points=point_19, Tolerance=number_slider_17, CullMode=3)  # -> Points, Indices, Valence; disabled
interpolate_2 = Interpolate(Vertices=cull_duplicates_2.Points, Degree=3, Periodic=False, KnotStyle=0)  # -> Curve, Length, Domain; disabled
pipe_5 = Pipe(Curve=interpolate_2.Curve, Radius=number_slider_18, Caps=2)  # disabled
transform_14 = Transform(Geometry=pipe_5, Transform=transform_13)  # disabled

# ----
transform_15 = Transform(Geometry=cull_duplicates_2.Points, Transform=transform_13)  # disabled
polyline_3 = PolyLine(Vertices=point_19, Closed=False)  # disabled
smooth_polyline = SmoothPolyline(Polyline=polyline_3, Strength=1, Times=1)  # disabled
reduce = Reduce(Polyline=polyline_3, Tolerance=1)  # -> Polyline, Reduction; disabled
transform_16 = Transform(Geometry=interpolate_2.Curve, Transform=transform_13)  # disabled
custom_preview_lineweights_7 = CustomPreviewLineweights(
    Geometry=flatten(transform_16),
    Shader={diffuse=RGB(255, 105, 180), emission=RGB(76, 32, 54), shine=0.5, specular=RGB(255, 255, 255), transparency=0},
    Thickness=number_slider_16,
    Absolute=False)  # disabled

# ---- group: Create extrusion simulation (continued)
brep_11 = Brep(transform_14)  # disabled

# ---- group: Robot Simulation (continued)
extrusion_brep = Brep(brep_11)

extrusion_brep_2 = Brep(brep_11)

# ----
entwine = Entwine(
    Branch00=extrusion_line,
    Branch01=mesh_2,
    Branch02=geometry_5,
    Branch03=simulatied_robot_mesh,
    Branch04=tool_mesh_3,
    Branch05=extrusion_brep,
    Branch06=curve_in_position,
    Branch07=simulation_robot_trail,
    Branch08=extruder_tip,
    FlattenInputs=True)
entwine_2 = Entwine(
    Branch00=colliding_meshes_mesh_3,
    Branch01=mesh_3,
    Branch02=geometry_6,
    Branch03=simulatied_robot_mesh_2,
    Branch04=tool_mesh_4,
    Branch05=extrusion_brep_2,
    Branch06=curve_in_position_2,
    Branch07=simulation_robot_trail_2,
    Branch08=extruder_tip_2,
    FlattenInputs=True)
data = Data(entwine)
data_2 = Data(entwine_2)
orient_8 = Orient(Geometry=data, Source=PlaneXY(0, 0, 0), Target=xy_plane_2)  # -> Geometry, Transform
orient_9 = Orient(Geometry=data_2, Source=PlaneXY(0, 0, 0), Target=xy_plane_3)  # -> Geometry, Transform
data_3 = Data(orient_8.Geometry)
data_4 = Data(orient_9.Geometry)
explode_tree = ExplodeTree(Data=data_3)  # -> Branch0, Branch1, Branch2, Branch3, Branch4, Branch5, Branch6, Branch7, Branch8
explode_tree_2 = ExplodeTree(Data=data_4)  # -> Branch0, Branch1, Branch2, Branch3, Branch4, Branch5, Branch6, Branch7, Branch8

# ---- group: Robot Simulation (continued)
extrusion_line_2 = Geometry(explode_tree.Branch0)
mesh_5 = Mesh(explode_tree.Branch1)
geometry_7 = Geometry(explode_tree.Branch2)
simulatied_robot_mesh_3 = Mesh(explode_tree.Branch3)
tool_mesh_6 = Mesh(explode_tree.Branch4)
extrusion_brep_3 = Brep(explode_tree.Branch5)
curve_in_position_3 = Curve(explode_tree.Branch6)
simulation_robot_trail_3 = Curve(explode_tree.Branch7)
extruder_tip_3 = Brep(explode_tree.Branch8)

# ----
colliding_meshes_mesh_5 = Mesh(explode_tree_2.Branch0)
offset_mesh = OffsetMesh(Mesh=colliding_meshes_mesh_5, Distance=1, BothSides=False, CreateSolid=True)
custom_preview_6 = CustomPreview(Geometry=offset_mesh, Material=ColourSwatch(SwatchColor=RGB(255, 0, 0)))

# ---- group: Robot Simulation (continued)
tool_mesh_7 = Mesh(explode_tree_2.Branch4)
extrusion_brep_4 = Brep(explode_tree_2.Branch5)
simulatied_robot_mesh_4 = Mesh(explode_tree_2.Branch3)
curve_in_position_4 = Curve(explode_tree_2.Branch6)
simulation_robot_trail_4 = Curve(explode_tree_2.Branch7)
extruder_tip_4 = Brep(explode_tree_2.Branch8)
mesh_6 = Mesh(explode_tree_2.Branch1)
geometry_8 = Geometry(explode_tree_2.Branch2)

# ----
preview = CustomPreview(Geometry=curve_in_position_3, Shader=ColourSwatch(SwatchColor=RGBA(0, 136, 255, 143)))
preview_2 = CustomPreview(Geometry=extrusion_brep_3, Shader=ColourSwatch(SwatchColor=RGB(255, 31, 31)))

preview_3 = CustomPreview(Geometry=extruder_tip_3, Shader=create_material_2)
preview_4 = CustomPreview(Geometry=simulatied_robot_mesh_3, Shader=create_material_8)
custom_preview_7 = CustomPreview(Geometry=mesh_5, Material=create_material_7)
preview_5 = CustomPreview(Geometry=tool_mesh_6, Shader=create_material_9)
custom_preview_lineweights_8 = CustomPreviewLineweights(Geometry=flatten(extrusion_line_2), Shader=colour_picker, Thickness=Slider(5.506, range=0..20), Absolute=False)

custom_preview_lineweights_9 = CustomPreviewLineweights(Geometry=geometry_7, Shader=create_material_6, Thickness=Slider(10, range=0..10), Absolute=False)

preview_6 = CustomPreview(Geometry=simulatied_robot_mesh_4, Shader=create_material_10)
preview_7 = CustomPreview(Geometry=curve_in_position_4, Shader=ColourSwatch(SwatchColor=RGBA(0, 136, 255, 143)))
preview_8 = CustomPreview(Geometry=extrusion_brep_4, Shader=ColourSwatch(SwatchColor=RGB(255, 31, 31)))
preview_9 = CustomPreview(Geometry=tool_mesh_7, Shader=create_material_11)

custom_preview_8 = CustomPreview(Geometry=mesh_6, Material=create_material)
custom_preview_lineweights_10 = CustomPreviewLineweights(Geometry=geometry_8, Shader=create_material_6, Thickness=Slider(6.2, range=0..10), Absolute=False)
preview_10 = CustomPreview(Geometry=extruder_tip_4, Shader=create_material_3)

# ==== cluster PenHolderMesh
number = ClusterInput()
number_2 = ClusterInput()
number_3 = ClusterInput()
number_4 = Number(number)
number_5 = Number(number_2)
number_6 = Number(number_3)
subtraction = Subtraction(A=number_4, B=number_5)
unit_z = UnitZ(Factor=subtraction)
unit_z_2 = UnitZ(Factor=number_4)
circle = Circle(Plane=PlaneXY(0, 0, 0), Radius=number_6)
extrude = Extrude(Base=circle, Direction=unit_z)
construct_point = ConstructPoint(XCoordinate=0, YCoordinate=0, ZCoordinate=unit_z_2)
move = Move(Geometry=circle, Motion=unit_z)  # -> Geometry, Transform
extrude_point = ExtrudePoint(Base=move.Geometry, Point=construct_point)
merge = Merge(Data1=extrude_point, Data2=extrude)
mesh_brep = MeshBrep(
    Brep=merge,
    Settings={GridMaxCount=0, GridMinCount=16, JaggedSeams=False, MaxEdgeLength=0, MinEdgeLength=0.0001, MinTolerance=0, Refine=True, RefineAngle=0, RelativeTolerance=0.65, SimplePlanes=True, Tolerance=0})
brep = Brep([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])
mesh = Mesh(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)
merge_2 = Merge(Data1=mesh, Data2=mesh_brep)
mesh_join = MeshJoin(Meshes=merge_2)
mesh_2 = Mesh(mesh_join)
mesh_3 = ClusterOutput(mesh_2)

# ==== cluster PlaneAxisViewer
plane = ClusterInput()
panel = Panel("""Red
Green
Blue""")
length = ClusterInput()  # Size of the vector lines to display
plane_2 = Plane(graft(plane))
colour = Colour(panel)
deconstruct_plane = DeconstructPlane(Plane=plane_2)  # -> Origin, XAxis, YAxis, ZAxis
merge = Merge(Data1=deconstruct_plane.XAxis, Data2=deconstruct_plane.YAxis, Data3=deconstruct_plane.ZAxis)
multiplication = Multiplication(A=length, B=Slider(1.14, range=1..2))
amplitude = Amplitude(Vector=merge, Amplitude=length)
amplitude_2 = Amplitude(Vector=merge, Amplitude=multiplication)
move = Move(Geometry=deconstruct_plane.Origin, Motion=amplitude_2)  # -> Geometry, Transform
panel_2 = Panel("""X
Y
Z""")
text_tag = TextTag(Location=move.Geometry, Text=panel_2, Colour=colour)
vector_display_ex = VectorDisplayEx(Point=deconstruct_plane.Origin, Vector=amplitude, Colour=colour, Width=Slider(9.2, range=0..10))
