# Grasshopper definition Tool 001 test 01_PancakeEmergency_PancakeEmergency.gh (Grasshopper 1.0.7)

offset = Panel("0")
diameters = Panel("""126
141-9.2*2
116
116
110""")
heights = Panel("""0
20
180
183
183""")
subtraction = Subtraction(A=heights, B=offset)
number = Number(subtraction)
number_2 = Number(diameters)

number_3 = Number(number)
number_4 = Number(number_2)

point = ConstructPoint(XCoordinate=0, YCoordinate=0, ZCoordinate=number_3)
division = Division(A=number_4, B=2)
loft_options = LoftOptions(Closed=False, Adjust=False, Rebuild=0, Refit=0, Type=3)
circle = Circle(Plane=point, Radius=division)
loft = Loft(Curves=circle, Options=loft_options)
fillet_edge = FilletEdge(Shape=loft, Blend=0, Metric=0, Edges=Slider(8, range=0..10), Radii=Slider(2.941, range=0..10))
last = Panel("-1")
list_item = ListItem(List=number_3, Index=last, Wrap=True)

list_item_2 = ListItem(List=circle, Index=last, Wrap=True)
boundary_surfaces = BoundarySurfaces(Edges=list_item_2)
merge = Merge(Data1=fillet_edge, Data2=boundary_surfaces)
brep_join = BrepJoin(Breps=merge)  # -> Breps, Closed

height = Number(list_item)
brep = Brep(brep_join.Breps)

number_5 = Number(height)
brep_2 = Brep(brep)

construct_domain = ConstructDomain(DomainStart=Slider(28.045, range=0..40), DomainEnd=number_5)
range = Range(Domain=construct_domain, Steps=Slider(7, range=1..30))
construct_point = ConstructPoint(XCoordinate=0, YCoordinate=0, ZCoordinate=range)
xy_plane = XYPlane(Origin=construct_point)
brep_plane = BrepPlane(Brep=brep_2, Plane=xy_plane)  # -> Curves, Points

curve = Curve(brep_plane.Curves)

divide_curve = DivideCurve(Curve=curve, Count=Slider(17, range=1..100), Kinks=False)  # -> Points, Tangents, Parameters
point_2 = Point(flatten(divide_curve.Points))
jitter = Jitter(List=point_2, Jitter=Slider(1, range=0..1), Seed=2)  # -> Values, Indices
point_3 = Point(jitter.Values)
interpolate = Interpolate(Vertices=point_3, Degree=Slider(3, range=1..5), Periodic=False, KnotStyle=1)  # -> Curve, Length, Domain
project = Project(Curve=interpolate.Curve, Brep=brep, Direction=Vector(0, 0, 1))
